vi "Change_to_validate_Date.gvi"   [G Web Development Software 22.3.0]
inputs:
  "Date_Time_String input": string
  "Error Cluster input": error
outputs:
  "Error Cluster output": error
  "Validate date and time": string
uses:
  NI::G Core::Strings::Trim Whitespace.gvi
diagram:
  call "Trim Whitespace.gvi"(string=$"Date_Time_String input") -> (trimmed string=w1)
  String Length(string=w1) -> (length=w2)
  Is Greater(x=w2, y=10) -> w3
  case (w3) {
    frame False, Default {
      w4 = w1
      w5 = $"Error Cluster input"
    }
    frame True {
      String Subset(length (rest)=4, string=w1) -> w6
      String Subset(length (rest)=2, offset (0)=4, string=w1) -> w7
      String Subset(length (rest)=2, offset (0)=6, string=w1) -> w8
      String Subset(length (rest)=2, offset (0)=8, string=w1) -> w9
      String Subset(length (rest)=2, offset (0)=10, string=w1) -> w10
      String Subset(offset (0)=12, string=w1) -> w11
      Concatenate Strings(w6, ".", w7, ".", w8, ".", w9, ":", w10, ":", w11) -> w4
      w5 = $"Error Cluster input"
    }
  }
  $"Error Cluster output" <- w5
  $"Validate date and time" <- w4
