vi "Interpret_Basic_Settings.gviweb"   [G Web Development Software 22.3.0]
inputs:
  "Error input": error
  "Device Type": string = "Device"
  "Config File infos": string[]
  "Basic Settings Entrys": string[]
outputs:
  "Output Error": error
  "Basic Informations": T1[]
types:
  T1 = cluster{"Parameter Name": string, "Value": string, "Dimension": string, "Comment": string}
uses:
  WebApp::Get_Config_ini_Part.gviweb
  NI::G Core::Strings::Search and Replace Pattern.gvi
  NI::G Core::Strings::Trim Whitespace.gvi
  WebApp::Set_Eco_State.gviweb
diagram:
  call "Get_Config_ini_Part.gviweb"(Ini Array=$"Config File infos", ini Part from Array=3, Error in=$"Error input") -> (Ini Part as Array=w1, Output Error=w2)
  call "Get_Config_ini_Part.gviweb"(Ini Array=$"Config File infos", ini Part from Array=4, Error in=w2) -> (Ini Part as Array=w3, Output Error=w4)
  call "Get_Config_ini_Part.gviweb"(Ini Array=$"Config File infos", ini Part from Array=5, Error in=w4) -> (Ini Part as Array=w5, Output Error=w6)
  s1 = ""  # shift register
  s2 = ""  # shift register
  for {
    w7 = each element of $"Basic Settings Entrys"
    Match Pattern(regular expression="dim", string=w7) -> (after substring=w9, before substring=w10)
    call "Search and Replace Pattern.gvi"(String=w10, Muster="_", Ersetzungs-String=" ", Alle ersetzen=TRUE) -> (Ergebnis-String=w11)
    # w1: ini Basic Settings XS
    # w5: ini Basic Settings Gas
    call "Trim Whitespace.gvi"(string=w11) -> (trimmed string=w12)
    Match Pattern(regular expression="val", string=w9) -> (after substring=w13, before substring=w14)
    # w3: ini Basic Settings Elektro
    call "Search and Replace Pattern.gvi"(String=w14, Muster="=\"", Alle ersetzen=TRUE) -> (Ergebnis-String=w15)
    # w12: Param. Name
    # s2: Gas Type
    # s1: Control Mode
    call "Search and Replace Pattern.gvi"(String=w15, Muster="\"") -> (Ergebnis-String=w16)
    # w17: Dimension
    call "Trim Whitespace.gvi"(string=w16) -> (trimmed string=w17)
    call "Search and Replace Pattern.gvi"(String=w13, Muster="=\"", Alle ersetzen=TRUE) -> (Ergebnis-String=w18)
    # $"Device Type": Device type
    call "Search and Replace Pattern.gvi"(String=w18, Muster="\"") -> (Ergebnis-String=w19)
    # w20: value
    call "Trim Whitespace.gvi"(string=w19) -> (trimmed string=w20)
    case ($"Device Type") {
      frame "False", Default {
        w25 = "Unit_Type is missing/incorrect: Evaluation of the service report is not possible"
        w21 = w25
        w22 = w20
        w23 = s1
        w24 = s2
      }
      frame "623", "E523", "E623" {
        case (w12) {
          frame "False", Default {
            w21 = "✅"
            w22 = w20
            w23 = s1
          }
          frame "Drain Valve time0" {
            Decimal String To Number(default (0 I32)=0, string=w20) -> (number=w26)
            Decimal String To Number(default (0 I32)=0, string="7") -> (number=w27)
            Decimal String To Number(default (0 I32)=0, string="5") -> (number=w28)
            In Range And Coerce(lower limit=w28, upper limit=w27, x=w26) -> (In Range?=w29)
            case (w29) {
              frame False, Default {
                w30 = "❌"  # String {0}
                Concatenate Strings(w30, " ", w12, " ", "is out of range") -> w21
              }
              frame True {
                w21 = "✅"
              }
            }
            w22 = w20
            w23 = s1
          }
          frame "Drain Valve time1" {
            Decimal String To Number(default (0 I32)=0, string=w20) -> (number=w31)
            Decimal String To Number(default (0 I32)=0, string="20") -> (number=w32)
            Decimal String To Number(default (0 I32)=0, string="16") -> (number=w33)
            In Range And Coerce(lower limit=w33, upper limit=w32, x=w31) -> (In Range?=w34)
            case (w34) {
              frame False, Default {
                w35 = "❌"  # String {0}
                Concatenate Strings(w35, " ", w12, " ", "is out of range") -> w21
              }
              frame True {
                w21 = "✅"
              }
            }
            w22 = w20
            w23 = s1
          }
          frame "CDS-Sensor XS" {
            Decimal String To Number(string=w20) -> (number=w36)
            Is Equal(x=w36, y=1000) -> w37
            case (w37) {
              frame False, Default {
                w38 = "❌"  # String {0}
                Concatenate Strings(w38, "Incorrect calibration of the CDS sensor XS") -> w21
              }
              frame True {
                w21 = "✅"
              }
            }
            w22 = w20
            w23 = s1
          }
          frame "Ethernet eth0 mac", "MAC Address LAN" {
            Is Not Equal(x=w20, y="") -> w39
            case (w39) {
              frame False, Default {
                w40 = "❌"  # String {0}
                Concatenate Strings(w40, "Ethernet mac Adress is not available") -> w21
              }
              frame True {
                w21 = "✅"
              }
            }
            w22 = w20
            w23 = s1
          }
          frame "Altitude pressure sensor", "Installation voltage" {
            Is Not Equal(x=w20, y="") -> w41
            case (w41) {
              frame False, Default {
                w42 = "❌"  # String {0}
                Concatenate Strings(w42, " ", w12, " ", "is not available") -> w21
              }
              frame True {
                w21 = "✅"
              }
            }
            w22 = w20
            w23 = s1
          }
          frame "ShowMode" {
            Is Equal(x=w20, y="false") -> w43
            case (w43) {
              frame False, Default {
                Concatenate Strings("⚠️", " ShowMode is activated") -> w21
              }
              frame True {
                w21 = "✅"
              }
            }
            w22 = w20
            w23 = s1
          }
          frame "Control Temperature Dry Heat" {
            Decimal String To Number(default (0 I32)=0, string=w20) -> (number=w44)
            Decimal String To Number(default (0 I32)=0, string="45") -> (number=w45)
            Is Less Or Equal(x=w44, y=w45) -> w46
            case (w46) {
              frame True {
                w47 = "Temperature limit is too low, it could cause high water consumption"
                Concatenate Strings("⚠️", w47) -> w21
              }
              frame False {
                w21 = "✅"
              }
            }
            w22 = w20
            w23 = s1
          }
          frame "Control Temperature Moist Heat" {
            Decimal String To Number(default (0 I32)=0, string=w20) -> (number=w48)
            Decimal String To Number(default (0 I32)=0, string="40") -> (number=w49)
            Is Less Or Equal(x=w48, y=w49) -> w50
            case (w50) {
              frame True {
                w51 = "Temperature limit is too low, it could cause high water consumption"
                Concatenate Strings("⚠️", w51) -> w21
              }
              frame False {
                w21 = "✅"
              }
            }
            w22 = w20
            w23 = s1
          }
          frame "Control Temperature Off" {
            Decimal String To Number(default (0 I32)=0, string=w20) -> (number=w52)
            Decimal String To Number(default (0 I32)=0, string="60") -> (number=w53)
            Is Less Or Equal(x=w52, y=w53) -> w54
            case (w54) {
              frame True {
                w55 = "Temperature limit is too low, it could cause high water consumption"
                Concatenate Strings("⚠️", w55) -> w21
              }
              frame False {
                w21 = "✅"
              }
            }
            w22 = w20
            w23 = s1
          }
          frame "Control Mode" {
            Decimal String To Number(default (0 I32)=0, string=w20) -> (number=w56)
            case (w56) {
              frame 1, Default {
                w21 = "✅"
                w22 = "OFF"
              }
              frame 2 {
                w21 = "✅"
                w22 = "Eco"
              }
              frame 3 {
                w21 = "✅"
                w22 = "ON"
              }
              frame 0 {
                w21 = "✅"
                w22 = "Undefined"
              }
            }
            w23 = w22
          }
          frame "Plate a la carte weight" {
            Decimal String To Number(default (0 I32)=0, string=w20) -> (number=w57)
            case (w57) {
              frame 1, Default {
                w21 = "✅"
                w22 = "< 899g"
              }
              frame 2 {
                w21 = "✅"
                w22 = "1099 g"
              }
              frame 3 {
                w21 = "✅"
                w22 = "1100g"
              }
              frame 0 {
                w21 = "✅"
                w22 = "< 700g"
              }
            }
            w23 = w22
          }
          frame "Foam reduction iCareSystem" {
            Decimal String To Number(default (0 I32)=0, string=w20) -> (number=w58)
            case (w58) {
              frame 0 {
                w21 = "✅"
                w22 = "ON"
              }
              frame 1, Default {
                w21 = "✅"
                w22 = "OFF"
              }
            }
            w23 = s1
          }
          frame "Altitude boiling point" {
            Decimal String To Number(default (0 I32)=0, string=w20) -> (number=w59)
            Is Equal(x=w59, y=0) -> w60
            case (w60) {
              frame True {
                w61 = "❌"  # String {0}
                Concatenate Strings(w61, "Incorrect calibration of the Altitude boiling point") -> w21
              }
              frame False {
                w21 = "✅"
              }
            }
            w22 = w20
            w23 = s1
          }
          frame "CDS-Sensor", "Gas blower speed Hot Air bottom Max RPM", "Gas blower speed Hot Air bottom Max Ultravent RPM", "Gas blower speed Hot Air bottom Min RPM", "Gas blower speed Hot Air bottom Min Ultravent RPM", "Gas blower speed Hot Air bottom Start RPM", "Gas blower speed Hot Air bottom Start Ultravent RPM", "Gas blower speed Hot Air top Max RPM", "Gas blower speed Hot Air top Max Ultravent RPM", "Gas blower speed Hot Air top Min RPM", "Gas blower speed Hot Air top Min UltraVent RPM", "Gas blower speed Hot Air top Start RPM", "Gas blower speed Hot Air top Start UltraVent RPM", "Gas blower speed Steam Max RPM", "Gas blower speed Steam Max Ultravent RPM", "Gas blower speed Steam Min RPM", "Gas blower speed Steam Min UltraVent RPM", "Gas blower speed Steam Start RPM", "Gas blower speed Steam Start UltraVent RPM", "Gas type", "Magnetron Safety Chain bottom" {
            w62 = " Information not required for this device type"  # String {0}
            Concatenate Strings("[ℹ]", w62) -> w21
            w22 = w20
            w23 = s1
          }
          frame "Chefline phone setting", "Service phone setting", "Wifi wlan0 dhcp", "Wifi wlan0 dns", "Wifi wlan0 gateway", "Wifi wlan0 ip", "Wifi wlan0 mac", "Wifi wlan0 netmask" {
            call "Trim Whitespace.gvi"(string=w20) -> (trimmed string=w63)
            Is Empty String Or Path(string/path=w63) -> w64
            case (w64) {
              frame False, Default {
                w21 = "✅"
              }
              frame True {
                w65 = " Information is missing for this device type"  # String {0}
                Concatenate Strings("[ℹ]", w65) -> w21
              }
            }
            w22 = w20
            w23 = s1
          }
        }
        w24 = s2
      }
      frame "E101", "E102", "E201", "E202", "E61", "E61T", "E62" {
        case (w12) {
          frame "False", Default {
            w21 = "✅"
            w22 = w20
            w23 = s1
          }
          frame "CDS-Sensor" {
            Decimal String To Number(string=w20) -> (number=w66)
            Is Equal(x=w66, y=1350) -> w67
            case (w67) {
              frame False, Default {
                w68 = "❌"  # String {0}
                Concatenate Strings(w68, "Incorrect calibration of the CDS sensor") -> w21
              }
              frame True {
                w21 = "✅"
              }
            }
            w22 = w20
            w23 = s1
          }
          frame "Ethernet eth0 mac", "MAC Address LAN" {
            Is Not Equal(x=w20, y="") -> w69
            case (w69) {
              frame False, Default {
                w70 = "❌"  # String {0}
                Concatenate Strings(w70, "Ethernet mac Adress is not available") -> w21
              }
              frame True {
                w21 = "✅"
              }
            }
            w22 = w20
            w23 = s1
          }
          frame "Altitude pressure sensor", "Installation voltage" {
            Is Not Equal(x=w20, y="") -> w71
            case (w71) {
              frame False, Default {
                w72 = "❌"  # String {0}
                Concatenate Strings(w72, " ", w12, " ", "is not available") -> w21
              }
              frame True {
                w21 = "✅"
              }
            }
            w22 = w20
            w23 = s1
          }
          frame "ShowMode" {
            Is Equal(x=w20, y="false") -> w73
            case (w73) {
              frame False, Default {
                Concatenate Strings("⚠️", " ShowMode is activated") -> w21
              }
              frame True {
                w21 = "✅"
              }
            }
            w22 = w20
            w23 = s1
          }
          frame "Control Temperature Dry Heat" {
            Decimal String To Number(default (0 I32)=0, string=w20) -> (number=w74)
            Decimal String To Number(default (0 I32)=0, string="45") -> (number=w75)
            Is Less Or Equal(x=w74, y=w75) -> w76
            case (w76) {
              frame True {
                w77 = "Temperature limit is too low, it could cause high water consumption"
                Concatenate Strings("⚠️", w77) -> w21
              }
              frame False {
                w21 = "✅"
              }
            }
            w22 = w20
            w23 = s1
          }
          frame "Control Temperature Moist Heat" {
            Decimal String To Number(default (0 I32)=0, string=w20) -> (number=w78)
            Decimal String To Number(default (0 I32)=0, string="40") -> (number=w79)
            Is Less Or Equal(x=w78, y=w79) -> w80
            case (w80) {
              frame True {
                w81 = "Temperature limit is too low, it could cause high water consumption"
                Concatenate Strings("⚠️", w81) -> w21
              }
              frame False {
                w21 = "✅"
              }
            }
            w22 = w20
            w23 = s1
          }
          frame "Control Temperature Off" {
            Decimal String To Number(default (0 I32)=0, string=w20) -> (number=w82)
            Decimal String To Number(default (0 I32)=0, string="60") -> (number=w83)
            Is Less Or Equal(x=w82, y=w83) -> w84
            case (w84) {
              frame True {
                w85 = "Temperature limit is too low, it could cause high water consumption"
                Concatenate Strings("⚠️", w85) -> w21
              }
              frame False {
                w21 = "✅"
              }
            }
            w22 = w20
            w23 = s1
          }
          frame "Control Mode" {
            Decimal String To Number(default (0 I32)=0, string=w20) -> (number=w86)
            case (w86) {
              frame 1, Default {
                w21 = "✅"
                w22 = "OFF"
              }
              frame 2 {
                w21 = "✅"
                w22 = "Eco"
              }
              frame 3 {
                w21 = "✅"
                w22 = "ON"
              }
              frame 0 {
                w21 = "✅"
                w22 = "Undefined"
              }
            }
            w23 = w22
          }
          frame "Plate a la carte weight" {
            Decimal String To Number(default (0 I32)=0, string=w20) -> (number=w87)
            case (w87) {
              frame 1, Default {
                w21 = "✅"
                w22 = "< 899g"
              }
              frame 2 {
                w21 = "✅"
                w22 = "1099 g"
              }
              frame 3 {
                w21 = "✅"
                w22 = "1100g"
              }
              frame 0 {
                w21 = "✅"
                w22 = "< 700g"
              }
            }
            w23 = w22
          }
          frame "Foam reduction iCareSystem" {
            Decimal String To Number(default (0 I32)=0, string=w20) -> (number=w88)
            case (w88) {
              frame 0 {
                w21 = "✅"
                w22 = "ON"
              }
              frame 1, Default {
                w21 = "✅"
                w22 = "OFF"
              }
            }
            w23 = s1
          }
          frame "Altitude boiling point" {
            Decimal String To Number(string=w20) -> (number=w89)
            Is Equal(x=w89, y=0) -> w90
            case (w90) {
              frame True {
                w91 = "❌"  # String {0}
                Concatenate Strings(w91, "Incorrect calibration of the Altitude boiling point") -> w21
              }
              frame False {
                w21 = "✅"
              }
            }
            w22 = w20
            w23 = s1
          }
          frame "CDS-Sensor XS", "Drain Valve time0", "Drain Valve time1", "Gas blower speed Hot Air bottom Max RPM", "Gas blower speed Hot Air bottom Max Ultravent RPM", "Gas blower speed Hot Air bottom Min RPM", "Gas blower speed Hot Air bottom Min Ultravent RPM", "Gas blower speed Hot Air bottom Start RPM", "Gas blower speed Hot Air bottom Start Ultravent RPM", "Gas blower speed Hot Air top Max RPM", "Gas blower speed Hot Air top Max Ultravent RPM", "Gas blower speed Hot Air top Min RPM", "Gas blower speed Hot Air top Min UltraVent RPM", "Gas blower speed Hot Air top Start RPM", "Gas blower speed Hot Air top Start UltraVent RPM", "Gas blower speed Steam Max RPM", "Gas blower speed Steam Max Ultravent RPM", "Gas blower speed Steam Min RPM", "Gas blower speed Steam Min UltraVent RPM", "Gas blower speed Steam Start RPM", "Gas blower speed Steam Start UltraVent RPM", "Gas type" {
            w92 = " Information not required for this device type"  # String {0}
            Concatenate Strings("[ℹ]", w92) -> w21
            w22 = w20
            w23 = s1
          }
          frame "Chefline phone setting", "Service phone setting", "Wifi wlan0 dhcp", "Wifi wlan0 dns", "Wifi wlan0 gateway", "Wifi wlan0 ip", "Wifi wlan0 mac", "Wifi wlan0 netmask" {
            call "Trim Whitespace.gvi"(string=w20) -> (trimmed string=w93)
            Is Empty String Or Path(string/path=w93) -> w94
            case (w94) {
              frame False, Default {
                w21 = "✅"
              }
              frame True {
                w95 = " Information is missing for this device type"  # String {0}
                Concatenate Strings("[ℹ]", w95) -> w21
              }
            }
            w22 = w20
            w23 = s1
          }
        }
        w24 = s2
      }
      frame "G101", "G102", "G61", "G62" {
        case (w12) {
          frame "False", Default {
            w21 = "✅"
            w22 = w20
            w23 = s1
            w24 = s2
          }
          frame "CDS-Sensor" {
            Decimal String To Number(string=w20) -> (number=w96)
            Is Equal(x=w96, y=1350) -> w97
            case (w97) {
              frame False, Default {
                w98 = "❌"  # String {0}
                Concatenate Strings(w98, "Incorrect calibration of the CDS sensor") -> w21
              }
              frame True {
                w21 = "✅"
              }
            }
            w22 = w20
            w23 = s1
            w24 = s2
          }
          frame "Ethernet eth0 mac", "MAC Address LAN" {
            for {
              w99 = each element of w5
              Match Pattern(regular expression="=", string=w99) -> (after substring=w100, before substring=w101)
              call "Search and Replace Pattern.gvi"(String=w101, Muster="_", Ersetzungs-String=" ", Alle ersetzen=TRUE) -> (Ergebnis-String=w102)
              call "Trim Whitespace.gvi"(String=w102) -> (Gekürzter String=w103)
              Is Equal(x=w12, y=w103) -> w104
              stop if w104
            }
            call "Search and Replace Pattern.gvi"(String=w100, Muster="\"", Alle ersetzen=TRUE) -> (Ergebnis-String=w105)
            call "Trim Whitespace.gvi"(String=w105) -> (Gekürzter String=w106)
            Is Not Equal(x=w20, y=w106) -> w107
            case (w107) {
              frame False, Default {
                w108 = "❌"  # String {0}
                Concatenate Strings(w108, "Ethernet mac Adress is not available") -> w21
              }
              frame True {
                w21 = "✅"
              }
            }
            w22 = w20
            w23 = s1
            w24 = s2
          }
          frame "Altitude pressure sensor", "Installation voltage" {
            for {
              w109 = each element of w5
              Match Pattern(regular expression="=", string=w109) -> (after substring=w110, before substring=w111)
              call "Search and Replace Pattern.gvi"(String=w111, Muster="_", Ersetzungs-String=" ", Alle ersetzen=TRUE) -> (Ergebnis-String=w112)
              call "Trim Whitespace.gvi"(String=w112) -> (Gekürzter String=w113)
              Is Equal(x=w12, y=w113) -> w114
              stop if w114
            }
            call "Search and Replace Pattern.gvi"(String=w110, Muster="\"", Alle ersetzen=TRUE) -> (Ergebnis-String=w115)
            call "Trim Whitespace.gvi"(String=w115) -> (Gekürzter String=w116)
            Is Not Equal(x=w20, y=w116) -> w117
            case (w117) {
              frame False, Default {
                w118 = "❌"  # String {0}
                Concatenate Strings(w118, " ", w12, " ", "is not available") -> w21
              }
              frame True {
                w21 = "✅"
              }
            }
            w22 = w20
            w23 = s1
            w24 = s2
          }
          frame "Gas blower speed Hot Air top Max RPM", "Gas blower speed Hot Air top Min RPM", "Gas blower speed Hot Air top Start RPM", "Gas blower speed Steam Max RPM", "Gas blower speed Steam Min RPM", "Gas blower speed Steam Start RPM" {
            Decimal String To Number(default (0 I32)=0, string=w20) -> (number=w119)
            Is Not Equal To 0(x=w119) -> w120
            case (w120) {
              frame False, Default {
                w121 = "❌"  # String {0}
                Concatenate Strings(w121, " ", $"Device Type", " ", "is out of range!") -> w21
              }
              frame True {
                w21 = "✅"
              }
            }
            w22 = w20
            w23 = s1
            w24 = s2
          }
          frame "ShowMode" {
            for {
              w122 = each element of w5
              Match Pattern(regular expression="=", string=w122) -> (after substring=w123, before substring=w124)
              call "Search and Replace Pattern.gvi"(String=w124, Muster="_", Ersetzungs-String=" ", Alle ersetzen=TRUE) -> (Ergebnis-String=w125)
              call "Trim Whitespace.gvi"(String=w125) -> (Gekürzter String=w126)
              Is Equal(x=w12, y=w126) -> w127
              stop if w127
            }
            call "Search and Replace Pattern.gvi"(String=w123, Muster="\"", Alle ersetzen=TRUE) -> (Ergebnis-String=w128)
            call "Trim Whitespace.gvi"(String=w128) -> (Gekürzter String=w129)
            Is Equal(x=w20, y=w129) -> w130
            case (w130) {
              frame False, Default {
                Concatenate Strings("⚠️", " ShowMode is activated") -> w21
              }
              frame True {
                w21 = "✅"
              }
            }
            w22 = w20
            w23 = s1
            w24 = s2
          }
          frame "Control Temperature Dry Heat" {
            Decimal String To Number(default (0 I32)=0, string=w20) -> (number=w131)
            for {
              w132 = each element of w5
              Match Pattern(regular expression="=", string=w132) -> (after substring=w133, before substring=w134)
              call "Search and Replace Pattern.gvi"(String=w134, Muster="_", Ersetzungs-String=" ", Alle ersetzen=TRUE) -> (Ergebnis-String=w135)
              call "Trim Whitespace.gvi"(String=w135) -> (Gekürzter String=w136)
              Is Equal(x=w12, y=w136) -> w137
              stop if w137
            }
            call "Search and Replace Pattern.gvi"(String=w133, Muster="\"", Alle ersetzen=TRUE) -> (Ergebnis-String=w138)
            call "Trim Whitespace.gvi"(String=w138) -> (Gekürzter String=w139)
            Decimal String To Number(default (0 I32)=0, string=w139) -> (number=w140)
            Is Less Or Equal(x=w131, y=w140) -> w141
            case (w141) {
              frame True {
                w142 = "Temperature limit is too low, it could cause high water consumption"
                Concatenate Strings("⚠️", w142) -> w21
              }
              frame False {
                w21 = "✅"
              }
            }
            w22 = w20
            w23 = s1
            w24 = s2
          }
          frame "Control Temperature Moist Heat" {
            Decimal String To Number(default (0 I32)=0, string=w20) -> (number=w143)
            for {
              w144 = each element of w5
              Match Pattern(regular expression="=", string=w144) -> (after substring=w145, before substring=w146)
              call "Search and Replace Pattern.gvi"(String=w146, Muster="_", Ersetzungs-String=" ", Alle ersetzen=TRUE) -> (Ergebnis-String=w147)
              call "Trim Whitespace.gvi"(String=w147) -> (Gekürzter String=w148)
              Is Equal(x=w12, y=w148) -> w149
              stop if w149
            }
            call "Search and Replace Pattern.gvi"(String=w145, Muster="\"", Alle ersetzen=TRUE) -> (Ergebnis-String=w150)
            call "Trim Whitespace.gvi"(String=w150) -> (Gekürzter String=w151)
            Decimal String To Number(default (0 I32)=0, string=w151) -> (number=w152)
            Is Less Or Equal(x=w143, y=w152) -> w153
            case (w153) {
              frame True {
                w154 = "Temperature limit is too low, it could cause high water consumption"
                Concatenate Strings("⚠️", w154) -> w21
              }
              frame False {
                w21 = "✅"
              }
            }
            w22 = w20
            w23 = s1
            w24 = s2
          }
          frame "Control Temperature Off" {
            Decimal String To Number(default (0 I32)=0, string=w20) -> (number=w155)
            for {
              w156 = each element of w5
              Match Pattern(regular expression="=", string=w156) -> (after substring=w157, before substring=w158)
              call "Search and Replace Pattern.gvi"(String=w158, Muster="_", Ersetzungs-String=" ", Alle ersetzen=TRUE) -> (Ergebnis-String=w159)
              call "Trim Whitespace.gvi"(String=w159) -> (Gekürzter String=w160)
              Is Equal(x=w12, y=w160) -> w161
              stop if w161
            }
            call "Search and Replace Pattern.gvi"(String=w157, Muster="\"", Alle ersetzen=TRUE) -> (Ergebnis-String=w162)
            call "Trim Whitespace.gvi"(String=w162) -> (Gekürzter String=w163)
            Decimal String To Number(default (0 I32)=0, string=w163) -> (number=w164)
            Is Less Or Equal(x=w155, y=w164) -> w165
            case (w165) {
              frame True {
                w166 = "Temperature limit is too low, it could cause high water consumption"
                Concatenate Strings("⚠️", w166) -> w21
              }
              frame False {
                w21 = "✅"
              }
            }
            w22 = w20
            w23 = s1
            w24 = s2
          }
          frame "Control Mode" {
            Decimal String To Number(default (0 I32)=0, string=w20) -> (number=w167)
            case (w167) {
              frame 1, Default {
                w21 = "✅"
                w22 = "OFF"
              }
              frame 2 {
                w21 = "✅"
                w22 = "Eco"
              }
              frame 3 {
                w21 = "✅"
                w22 = "ON"
              }
              frame 0 {
                w21 = "✅"
                w22 = "Undefined"
              }
            }
            w23 = w22
            w24 = s2
          }
          frame "Plate a la carte weight" {
            Decimal String To Number(default (0 I32)=0, string=w20) -> (number=w168)
            case (w168) {
              frame 1, Default {
                w21 = "✅"
                w22 = "< 899g"
              }
              frame 2 {
                w21 = "✅"
                w22 = "1099 g"
              }
              frame 3 {
                w21 = "✅"
                w22 = "1100g"
              }
              frame 0 {
                w21 = "✅"
                w22 = "< 700g"
              }
            }
            w23 = w22
            w24 = s2
          }
          frame "Gas type" {
            w21 = "✅"
            w22 = w20
            w23 = s1
            w24 = w20
          }
          frame "Foam reduction iCareSystem" {
            Decimal String To Number(default (0 I32)=0, string=w20) -> (number=w169)
            case (w169) {
              frame 0 {
                w21 = "✅"
                w22 = "ON"
              }
              frame 1, Default {
                w21 = "✅"
                w22 = "OFF"
              }
            }
            w23 = s1
            w24 = s2
          }
          frame "Altitude boiling point" {
            for {
              w170 = each element of w5
              Match Pattern(regular expression="=", string=w170) -> (after substring=w171, before substring=w172)
              call "Search and Replace Pattern.gvi"(String=w172, Muster="_", Ersetzungs-String=" ", Alle ersetzen=TRUE) -> (Ergebnis-String=w173)
              call "Trim Whitespace.gvi"(String=w173) -> (Gekürzter String=w174)
              Is Equal(x=w12, y=w174) -> w175
              stop if w175
            }
            call "Search and Replace Pattern.gvi"(String=w171, Muster="\"", Alle ersetzen=TRUE) -> (Ergebnis-String=w176)
            call "Trim Whitespace.gvi"(String=w176) -> (Gekürzter String=w177)
            Is Equal(x=w20, y=w177) -> w178
            case (w178) {
              frame True {
                w179 = "❌"  # String {0}
                Concatenate Strings(w179, "Incorrect calibration of the Altitude boiling point") -> w21
              }
              frame False {
                w21 = "✅"
              }
            }
            w22 = w20
            w23 = s1
            w24 = s2
          }
          frame "CDS-Sensor XS", "Drain Valve time0", "Drain Valve time1", "Gas blower speed Hot Air bottom Max RPM", "Gas blower speed Hot Air bottom Min RPM", "Gas blower speed Hot Air bottom Start RPM" {
            w180 = " Information not required for this device type"  # String {0}
            Concatenate Strings("[ℹ]", w180) -> w21
            w22 = w20
            w23 = s1
            w24 = s2
          }
          frame "Chefline phone setting", "Service phone setting", "Wifi wlan0 dhcp", "Wifi wlan0 dns", "Wifi wlan0 gateway", "Wifi wlan0 ip", "Wifi wlan0 mac", "Wifi wlan0 netmask" {
            call "Trim Whitespace.gvi"(string=w20) -> (trimmed string=w181)
            Is Empty String Or Path(string/path=w181) -> w182
            case (w182) {
              frame False, Default {
                w21 = "✅"
              }
              frame True {
                w183 = " Information is missing for this device type"  # String {0}
                Concatenate Strings("[ℹ]", w183) -> w21
              }
            }
            w22 = w20
            w23 = s1
            w24 = s2
          }
        }
      }
      frame "G201", "G202" {
        case (w12) {
          frame "False", Default {
            w21 = "✅"
            w22 = w20
            w23 = s1
            w24 = s2
          }
          frame "CDS-Sensor" {
            Decimal String To Number(string=w20) -> (number=w184)
            Is Equal(x=w184, y=1350) -> w185
            case (w185) {
              frame False, Default {
                w186 = "❌"  # String {0}
                Concatenate Strings(w186, "Incorrect calibration of the CDS sensor") -> w21
              }
              frame True {
                w21 = "✅"
              }
            }
            w22 = w20
            w23 = s1
            w24 = s2
          }
          frame "Ethernet eth0 mac", "MAC Address LAN" {
            for {
              w187 = each element of w5
              Match Pattern(regular expression="=", string=w187) -> (after substring=w188, before substring=w189)
              call "Search and Replace Pattern.gvi"(String=w189, Muster="_", Ersetzungs-String=" ", Alle ersetzen=TRUE) -> (Ergebnis-String=w190)
              call "Trim Whitespace.gvi"(String=w190) -> (Gekürzter String=w191)
              Is Equal(x=w12, y=w191) -> w192
              stop if w192
            }
            call "Search and Replace Pattern.gvi"(String=w188, Muster="\"", Alle ersetzen=TRUE) -> (Ergebnis-String=w193)
            call "Trim Whitespace.gvi"(String=w193) -> (Gekürzter String=w194)
            Is Not Equal(x=w20, y=w194) -> w195
            case (w195) {
              frame False, Default {
                w196 = "❌"  # String {0}
                Concatenate Strings(w196, "Ethernet mac Adress is not available") -> w21
              }
              frame True {
                w21 = "✅"
              }
            }
            w22 = w20
            w23 = s1
            w24 = s2
          }
          frame "Altitude pressure sensor", "Installation voltage" {
            for {
              w197 = each element of w5
              Match Pattern(regular expression="=", string=w197) -> (after substring=w198, before substring=w199)
              call "Search and Replace Pattern.gvi"(String=w199, Muster="_", Ersetzungs-String=" ", Alle ersetzen=TRUE) -> (Ergebnis-String=w200)
              call "Trim Whitespace.gvi"(String=w200) -> (Gekürzter String=w201)
              Is Equal(x=w12, y=w201) -> w202
              stop if w202
            }
            call "Search and Replace Pattern.gvi"(String=w198, Muster="\"", Alle ersetzen=TRUE) -> (Ergebnis-String=w203)
            call "Trim Whitespace.gvi"(String=w203) -> (Gekürzter String=w204)
            Is Not Equal(x=w20, y=w204) -> w205
            case (w205) {
              frame False, Default {
                w206 = "❌"  # String {0}
                Concatenate Strings(w206, " ", w12, " ", "is not available") -> w21
              }
              frame True {
                w21 = "✅"
              }
            }
            w22 = w20
            w23 = s1
            w24 = s2
          }
          frame "Gas blower speed Hot Air bottom Max RPM", "Gas blower speed Hot Air bottom Min RPM", "Gas blower speed Hot Air bottom Start RPM", "Gas blower speed Hot Air top Max RPM", "Gas blower speed Hot Air top Min RPM", "Gas blower speed Hot Air top Start RPM", "Gas blower speed Steam Max RPM", "Gas blower speed Steam Min RPM", "Gas blower speed Steam Start RPM" {
            Decimal String To Number(default (0 I32)=0, string=w20) -> (number=w207)
            Is Not Equal To 0(x=w207) -> w208
            case (w208) {
              frame False, Default {
                w209 = "❌"  # String {0}
                Concatenate Strings(w209, " ", w12, " ", "is out of range!") -> w21
              }
              frame True {
                w21 = "✅"
              }
            }
            w22 = w20
            w23 = s1
            w24 = s2
          }
          frame "ShowMode" {
            for {
              w210 = each element of w5
              Match Pattern(regular expression="=", string=w210) -> (after substring=w211, before substring=w212)
              call "Search and Replace Pattern.gvi"(String=w212, Muster="_", Ersetzungs-String=" ", Alle ersetzen=TRUE) -> (Ergebnis-String=w213)
              call "Trim Whitespace.gvi"(String=w213) -> (Gekürzter String=w214)
              Is Equal(x=w12, y=w214) -> w215
              stop if w215
            }
            call "Search and Replace Pattern.gvi"(String=w211, Muster="\"", Alle ersetzen=TRUE) -> (Ergebnis-String=w216)
            call "Trim Whitespace.gvi"(String=w216) -> (Gekürzter String=w217)
            Is Equal(x=w20, y=w217) -> w218
            case (w218) {
              frame False, Default {
                Concatenate Strings("⚠️", " ShowMode is activated") -> w21
              }
              frame True {
                w21 = "✅"
              }
            }
            w22 = w20
            w23 = s1
            w24 = s2
          }
          frame "Control Temperature Dry Heat" {
            Decimal String To Number(default (0 I32)=0, string=w20) -> (number=w219)
            for {
              w220 = each element of w5
              Match Pattern(regular expression="=", string=w220) -> (after substring=w221, before substring=w222)
              call "Search and Replace Pattern.gvi"(String=w222, Muster="_", Ersetzungs-String=" ", Alle ersetzen=TRUE) -> (Ergebnis-String=w223)
              call "Trim Whitespace.gvi"(String=w223) -> (Gekürzter String=w224)
              Is Equal(x=w12, y=w224) -> w225
              stop if w225
            }
            call "Search and Replace Pattern.gvi"(String=w221, Muster="\"", Alle ersetzen=TRUE) -> (Ergebnis-String=w226)
            call "Trim Whitespace.gvi"(String=w226) -> (Gekürzter String=w227)
            Decimal String To Number(default (0 I32)=0, string=w227) -> (number=w228)
            Is Less Or Equal(x=w219, y=w228) -> w229
            case (w229) {
              frame True {
                w230 = "Temperature limit is too low, it could cause high water consumption"
                Concatenate Strings("⚠️", w230) -> w21
              }
              frame False {
                w21 = "✅"
              }
            }
            w22 = w20
            w23 = s1
            w24 = s2
          }
          frame "Control Temperature Moist Heat" {
            Decimal String To Number(default (0 I32)=0, string=w20) -> (number=w231)
            for {
              w232 = each element of w5
              Match Pattern(regular expression="=", string=w232) -> (after substring=w233, before substring=w234)
              call "Search and Replace Pattern.gvi"(String=w234, Muster="_", Ersetzungs-String=" ", Alle ersetzen=TRUE) -> (Ergebnis-String=w235)
              call "Trim Whitespace.gvi"(String=w235) -> (Gekürzter String=w236)
              Is Equal(x=w12, y=w236) -> w237
              stop if w237
            }
            call "Search and Replace Pattern.gvi"(String=w233, Muster="\"", Alle ersetzen=TRUE) -> (Ergebnis-String=w238)
            call "Trim Whitespace.gvi"(String=w238) -> (Gekürzter String=w239)
            Decimal String To Number(default (0 I32)=0, string=w239) -> (number=w240)
            Is Less Or Equal(x=w231, y=w240) -> w241
            case (w241) {
              frame True {
                w242 = "Temperature limit is too low, it could cause high water consumption"
                Concatenate Strings("⚠️", w242) -> w21
              }
              frame False {
                w21 = "✅"
              }
            }
            w22 = w20
            w23 = s1
            w24 = s2
          }
          frame "Control Temperature Off" {
            Decimal String To Number(default (0 I32)=0, string=w20) -> (number=w243)
            for {
              w244 = each element of w5
              Match Pattern(regular expression="=", string=w244) -> (after substring=w245, before substring=w246)
              call "Search and Replace Pattern.gvi"(String=w246, Muster="_", Ersetzungs-String=" ", Alle ersetzen=TRUE) -> (Ergebnis-String=w247)
              call "Trim Whitespace.gvi"(String=w247) -> (Gekürzter String=w248)
              Is Equal(x=w12, y=w248) -> w249
              stop if w249
            }
            call "Search and Replace Pattern.gvi"(String=w245, Muster="\"", Alle ersetzen=TRUE) -> (Ergebnis-String=w250)
            call "Trim Whitespace.gvi"(String=w250) -> (Gekürzter String=w251)
            Decimal String To Number(default (0 I32)=0, string=w251) -> (number=w252)
            Is Less Or Equal(x=w243, y=w252) -> w253
            case (w253) {
              frame True {
                w254 = "Temperature limit is too low, it could cause high water consumption"
                Concatenate Strings("⚠️", w254) -> w21
              }
              frame False {
                w21 = "✅"
              }
            }
            w22 = w20
            w23 = s1
            w24 = s2
          }
          frame "Control Mode" {
            Decimal String To Number(default (0 I32)=0, string=w20) -> (number=w255)
            case (w255) {
              frame 1, Default {
                w21 = "✅"
                w22 = "OFF"
              }
              frame 2 {
                w21 = "✅"
                w22 = "Eco"
              }
              frame 3 {
                w21 = "✅"
                w22 = "ON"
              }
              frame 0 {
                w21 = "✅"
                w22 = "Undefined"
              }
            }
            w23 = w22
            w24 = s2
          }
          frame "Plate a la carte weight" {
            Decimal String To Number(default (0 I32)=0, string=w20) -> (number=w256)
            case (w256) {
              frame 1, Default {
                w21 = "✅"
                w22 = "< 899g"
              }
              frame 2 {
                w21 = "✅"
                w22 = "1099 g"
              }
              frame 3 {
                w21 = "✅"
                w22 = "1100g"
              }
              frame 0 {
                w21 = "✅"
                w22 = "< 700g"
              }
            }
            w23 = w22
            w24 = s2
          }
          frame "Gas type" {
            w21 = "✅"
            w22 = w20
            w23 = s1
            w24 = w20
          }
          frame "Foam reduction iCareSystem" {
            Decimal String To Number(default (0 I32)=0, string=w20) -> (number=w257)
            case (w257) {
              frame 0 {
                w21 = "✅"
                w22 = "ON"
              }
              frame 1, Default {
                w21 = "✅"
                w22 = "OFF"
              }
            }
            w23 = s1
            w24 = s2
          }
          frame "Altitude boiling point" {
            for {
              w258 = each element of w5
              Match Pattern(regular expression="=", string=w258) -> (after substring=w259, before substring=w260)
              call "Search and Replace Pattern.gvi"(String=w260, Muster="_", Ersetzungs-String=" ", Alle ersetzen=TRUE) -> (Ergebnis-String=w261)
              call "Trim Whitespace.gvi"(String=w261) -> (Gekürzter String=w262)
              Is Equal(x=w12, y=w262) -> w263
              stop if w263
            }
            call "Search and Replace Pattern.gvi"(String=w259, Muster="\"", Alle ersetzen=TRUE) -> (Ergebnis-String=w264)
            call "Trim Whitespace.gvi"(String=w264) -> (Gekürzter String=w265)
            Is Equal(x=w20, y=w265) -> w266
            case (w266) {
              frame True {
                w267 = "❌"  # String {0}
                Concatenate Strings(w267, "Incorrect calibration of the Altitude boiling point") -> w21
              }
              frame False {
                w21 = "✅"
              }
            }
            w22 = w20
            w23 = s1
            w24 = s2
          }
          frame "CDS-Sensor XS", "Drain Valve time0", "Drain Valve time1" {
            w268 = " Information not required for this device type"  # String {0}
            Concatenate Strings("[ℹ]", w268) -> w21
            w22 = w20
            w23 = s1
            w24 = s2
          }
          frame "Chefline phone setting", "Service phone setting", "Wifi wlan0 dhcp", "Wifi wlan0 dns", "Wifi wlan0 gateway", "Wifi wlan0 ip", "Wifi wlan0 mac", "Wifi wlan0 netmask" {
            call "Trim Whitespace.gvi"(string=w20) -> (trimmed string=w269)
            Is Empty String Or Path(string/path=w269) -> w270
            case (w270) {
              frame False, Default {
                w21 = "✅"
              }
              frame True {
                w271 = " Information is missing for this device type"  # String {0}
                Concatenate Strings("[ℹ]", w271) -> w21
              }
            }
            w22 = w20
            w23 = s1
            w24 = s2
          }
        }
      }
    }
    Property Node(instance in=T1 {all zero or empty}, "Parameter Name"=w12, "Value"=w22, "Dimension"=w17, "Comment"=w21) -> (instance out=w272)
    append w272 to w8
    next s1 = w23
    next s2 = w24
  }
  for {
    w273 = each element of w8
    Property Node(instance in=w273) -> ("Parameter Name"=w275, "Value"=w276, "Dimension"=w277, "Comment"=w278)
    call "Set_Eco_State.gviweb"(Control Mode=s1, Parameter Name=w275, Comment in=w278, Error input=w6) -> (Comment out=w279, Output=w280)
    Property Node(instance in=T1 {all zero or empty}, "Parameter Name"=w275, "Value"=w276, "Dimension"=w277, "Comment"=w279) -> (instance out=w281)
    append w281 to w274
  }
  $"Basic Informations" <- w274
  $"Output Error" <- w280
