vi "Interpret_Basic_Settings_iVario.gviweb"   [G Web Development Software 22.3.0]
inputs:
  "Basic Settings Entrys": string[]
  "Device Type": string = "Device"
  "Error input": error
outputs:
  "Basic Informations": T1[]
  "Output Error": error
panel controls:
  "Config File infos": string[]
types:
  T1 = cluster{"Parameter Name": string, "Value": string, "Dimension": string, "Comment": string}
uses:
  WebApp::Get_Config_ini_Part.gviweb
  NI::G Core::Strings::Search and Replace Pattern.gvi
  NI::G Core::Strings::Trim Whitespace.gvi
  WebApp::Set_Eco_State.gviweb
diagram:
  call "Get_Config_ini_Part.gviweb"(Ini Array=$"Config File infos", ini Part from Array=3, Error in=$"Error input") -> (Ini Part as Array=w1, Output Error=w2)
  call "Get_Config_ini_Part.gviweb"(Ini Array=$"Config File infos", ini Part from Array=4, Error in=w2) -> (Ini Part as Array=w3, Output Error=w4)
  call "Get_Config_ini_Part.gviweb"(Ini Array=$"Config File infos", ini Part from Array=5, Error in=w4) -> (Ini Part as Array=w5, Output Error=w6)
  # [ℹ]
  # [ℹ]
  s1 = ""  # shift register
  s2 = ""  # shift register
  for {
    w7 = each element of $"Basic Settings Entrys"
    Match Pattern(regular expression="dim", string=w7) -> (after substring=w9, before substring=w10, match substring=w11)
    case (w11) {
      frame "False", Default {
        Match Pattern(regular expression="val", string=w7) -> (after substring=w13, before substring=w12)
        w14 = "N.A"
      }
      frame "dim" {
        Match Pattern(regular expression="val", string=w9) -> (after substring=w13, before substring=w14)
        w12 = w10
      }
    }
    call "Search and Replace Pattern.gvi"(String=w12, Muster="_", Ersetzungs-String=" ", Alle ersetzen=TRUE) -> (Ergebnis-String=w15)
    # $"Device Type": Device type
    # s2: Gas Type
    # s1: Control Mode
    call "Trim Whitespace.gvi"(string=w15) -> (trimmed string=w16)
    call "Search and Replace Pattern.gvi"(String=w14, Muster="=\"", Alle ersetzen=TRUE) -> (Ergebnis-String=w17)
    call "Search and Replace Pattern.gvi"(String=w17, Muster="\"") -> (Ergebnis-String=w18)
    # w16: Param. Name
    call "Trim Whitespace.gvi"(string=w18) -> (trimmed string=w19)
    # w1: ini Basic Settings XS
    # w3: ini Basic Settings Elektro
    # w5: ini Basic Settings Gas
    call "Search and Replace Pattern.gvi"(String=w13, Muster="=\"", Alle ersetzen=TRUE) -> (Ergebnis-String=w20)
    call "Search and Replace Pattern.gvi"(String=w20, Muster="\"") -> (Ergebnis-String=w21)
    # w22: value
    call "Trim Whitespace.gvi"(string=w21) -> (trimmed string=w22)
    # w19: Dimension
    case ($"Device Type") {
      frame "False", Default {
        w27 = "Unit_Type is missing/incorrect: Evaluation of the service report is not possible"
        w23 = w27
        w24 = w22
        w25 = s1
        w26 = s2
      }
      frame "2-XS", "2-XS P" {
        case (w16) {
          frame "False", Default {
            Is Empty String Or Path(string/path=w22) -> w28
            case (w28) {
              frame False, Default {
                w23 = "✅"
              }
              frame True {
                w29 = " Information not required for this device type"  # String {0}
                Concatenate Strings("[ℹ]", w29) -> w23
              }
            }
            w24 = w22
            w25 = s1
          }
          frame "Deep Frying Option", "Energy optimisation" {
            Is Empty String Or Path(string/path=w22) -> w30
            case (w30) {
              frame False, Default {
                w23 = "✅"
              }
              frame True {
                w31 = " Information is missing for this device type"  # String {0}
                Concatenate Strings("⚠️", w31) -> w23
              }
            }
            w24 = w22
            w25 = s1
          }
          frame "CDS-Sensor" {
            Decimal String To Number(string=w22) -> (number=w32)
            Is Equal(x=w32, y=1350) -> w33
            case (w33) {
              frame False, Default {
                w34 = "❌"  # String {0}
                Concatenate Strings(w34, "Incorrect calibration of the CDS sensor XS") -> w23
              }
              frame True {
                w23 = "✅"
              }
            }
            w24 = w22
            w25 = s1
          }
          frame "Ethernet eth0 mac", "MAC Address LAN" {
            Is Not Equal(x=w22, y="") -> w35
            case (w35) {
              frame False, Default {
                w36 = "❌"  # String {0}
                Concatenate Strings(w36, "Ethernet mac Adress is not available") -> w23
              }
              frame True {
                w23 = "✅"
              }
            }
            w24 = w22
            w25 = s1
          }
          frame "ShowMode" {
            Is Equal(x=w22, y="false") -> w37
            case (w37) {
              frame False, Default {
                Concatenate Strings("⚠️", " ShowMode is activated") -> w23
              }
              frame True {
                w23 = "✅"
              }
            }
            w24 = w22
            w25 = s1
          }
          frame "Control Temperature Dry Heat" {
            Decimal String To Number(default (0 I32)=0, string=w22) -> (number=w38)
            Decimal String To Number(default (0 I32)=0, string="45") -> (number=w39)
            Is Less Or Equal(x=w38, y=w39) -> w40
            case (w40) {
              frame True {
                w41 = "Temperature limit is too low, it could cause high water consumption"
                Concatenate Strings("⚠️", w41) -> w23
              }
              frame False {
                w23 = "✅"
              }
            }
            w24 = w22
            w25 = s1
          }
          frame "Low Temperature Cooking", "Power State WA82", "iZoneControl" {
            w42 = " Information not required for this device type"  # String {0}
            Concatenate Strings("[ℹ]", w42) -> w23
            w24 = w22
            w25 = s1
          }
        }
        w26 = s2
      }
      frame "2-S", "2-S P", "L", "L P", "XL", "XL P" {
        case (w16) {
          frame "False", Default {
            Is Empty String Or Path(string/path=w22) -> w43
            case (w43) {
              frame False, Default {
                w23 = "✅"
              }
              frame True {
                w44 = " Information not available for this device type"  # String {0}
                Concatenate Strings("[ℹ]", w44) -> w23
              }
            }
            w24 = w22
            w25 = s1
          }
          frame "Deep Frying Option", "Energy optimisation", "Low Temperature Cooking", "iZoneControl" {
            Is Empty String Or Path(string/path=w22) -> w45
            case (w45) {
              frame False, Default {
                w23 = "✅"
              }
              frame True {
                w46 = " Information is missing for this device type"  # String {0}
                Concatenate Strings("⚠️", w46) -> w23
              }
            }
            w24 = w22
            w25 = s1
          }
          frame "Hot water", "Power State" {
            case ($"Device Type") {
              frame "False", Default {
                w47 = " Information not available for this device type"  # String {0}
                Concatenate Strings("[ℹ]", w47) -> w23
              }
              frame "L", "L P", "XL", "XL P" {
                Is Empty String Or Path(string/path=w22) -> w48
                case (w48) {
                  frame False, Default {
                    w23 = "✅"
                  }
                  frame True {
                    w49 = " Information is missing for this device type"  # String {0}
                    Concatenate Strings("⚠️", w49) -> w23
                  }
                }
              }
            }
            w24 = w22
            w25 = s1
          }
          frame "CDS-Sensor" {
            Decimal String To Number(string=w22) -> (number=w50)
            Is Equal(x=w50, y=1350) -> w51
            case (w51) {
              frame False, Default {
                w52 = "❌"  # String {0}
                Concatenate Strings(w52, "Incorrect calibration of the CDS sensor XS") -> w23
              }
              frame True {
                w23 = "✅"
              }
            }
            w24 = w22
            w25 = s1
          }
          frame "Ethernet eth0 mac", "MAC Address LAN" {
            Is Not Equal(x=w22, y="") -> w53
            case (w53) {
              frame False, Default {
                w54 = "❌"  # String {0}
                Concatenate Strings(w54, "Ethernet mac Adress is not available") -> w23
              }
              frame True {
                w23 = "✅"
              }
            }
            w24 = w22
            w25 = s1
          }
          frame "ShowMode" {
            Is Equal(x=w22, y="false") -> w55
            case (w55) {
              frame False, Default {
                Concatenate Strings("⚠️", " ShowMode is activated") -> w23
              }
              frame True {
                w23 = "✅"
              }
            }
            w24 = w22
            w25 = s1
          }
          frame "Control Temperature Dry Heat" {
            Decimal String To Number(default (0 I32)=0, string=w22) -> (number=w56)
            Decimal String To Number(default (0 I32)=0, string="45") -> (number=w57)
            Is Less Or Equal(x=w56, y=w57) -> w58
            case (w58) {
              frame True {
                w59 = "Temperature limit is too low, it could cause high water consumption"
                Concatenate Strings("⚠️", w59) -> w23
              }
              frame False {
                w23 = "✅"
              }
            }
            w24 = w22
            w25 = s1
          }
        }
        w26 = s2
      }
    }
    Property Node(instance in=T1 {all zero or empty}, "Parameter Name"=w16, "Value"=w24, "Dimension"=w19, "Comment"=w23) -> (instance out=w60)
    append w60 to w8
    next s1 = w25
    next s2 = w26
  }
  for {
    w61 = each element of w8
    Property Node(instance in=w61) -> ("Parameter Name"=w63, "Value"=w64, "Dimension"=w65, "Comment"=w66)
    call "Set_Eco_State.gviweb"(Control Mode=s1, Parameter Name=w63, Comment in=w66, Error input=w6) -> (Comment out=w67, Output=w68)
    Property Node(instance in=T1 {all zero or empty}, "Parameter Name"=w63, "Value"=w64, "Dimension"=w65, "Comment"=w67) -> (instance out=w69)
    append w69 to w62
  }
  $"Basic Informations" <- w62
  $"Output Error" <- w68
