vi "Interpret_Common_Information.gviweb"   [G Web Development Software 22.3.0]
inputs:
  "Common Information Entrys": string[]
  "Error Cluster Constant": error
  "Language Entrys": string[]
outputs:
  "Output Error": error
  "Boards Informations:": T1[]
  "Device:": string
  "common": T2[]
  "Unit-type": string
  "Ultravent": string
  "Startup Date and Time": string
  "Auto Dose": string
types:
  T1 = cluster{"Boards": string, "Informations": string}
  T2 = cluster{"Parameter Name": string, "Value": string, "Comment": string}
uses:
  WebApp::Get_Config_ini_Part.gviweb
  NI::G Core::Strings::Search and Replace Pattern.gvi
  NI::G Core::Strings::Trim Whitespace.gvi
  WebApp::Change_to_validate_Date.gvi
diagram:
  call "Get_Config_ini_Part.gviweb"(Ini Array=$"Language Entrys", ini Part from Array=0, Error in=$"Error Cluster Constant") -> (Ini Part as Array=w1, Output Error=w2)
  call "Get_Config_ini_Part.gviweb"(Ini Array=$"Language Entrys", ini Part from Array=1, Error in=w2) -> (Ini Part as Array=w3, Output Error=w4)
  call "Get_Config_ini_Part.gviweb"(Ini Array=$"Language Entrys", ini Part from Array=2, Error in=w4) -> (Ini Part as Array=w5, Output Error=w6)
  s1 = "Device"  # shift register
  s2 = "Ultravent_not_available"  # shift register
  s3 = ""  # shift register
  s4 = ""  # shift register
  for {
    w7 = each element of $"Common Information Entrys"
    Match Pattern(regular expression="=", string=w7) -> (after substring=w9, before substring=w10)
    call "Search and Replace Pattern.gvi"(String=w10, Muster="val", Alle ersetzen=TRUE) -> (Ergebnis-String=w11)
    call "Search and Replace Pattern.gvi"(String=w11, Muster="_", Ersetzungs-String=" ", Alle ersetzen=TRUE) -> (Ergebnis-String=w12)
    call "Trim Whitespace.gvi"(String=w12) -> (Gekürzter String=w13)
    call "Search and Replace Pattern.gvi"(String=w9, Muster="\"", Alle ersetzen=TRUE) -> (Ergebnis-String=w14)
    # parm.value
    case (w13) {
      frame "False", Default {
        w15 = s1
        w16 = s2
        w17 = FALSE
        w18 = s4
      }
      frame "Chemical Controller Revision" {
        Is Equal(x=w14, y="0") -> w19
        case (w19) {
          frame False, Default {
            w18 = "AutoDose_available"
          }
          frame True {
            w18 = "AutoDose_not_available"
          }
        }
        w15 = s1
        w16 = s2
        w17 = FALSE
      }
      frame "Status UltraVent" {
        case (w14) {
          frame "false", Default {
            w16 = "Ultravent_not_available"
          }
          frame "true" {
            w16 = "Ultravent_available"
          }
        }
        w15 = s1
        w17 = FALSE
        w18 = s4
      }
      frame "Unit Type" {
        case (w14) {
          frame "False", Default {
            w20 = "No_Analyse.png"
            w15 = w14
            w17 = TRUE
          }
          frame "623", "E523" {
            call "Search and Replace Pattern.gvi"(string=s1, pattern="Device", replace string=w14) -> (result string=w15)
            w20 = "E523.jpg"
            w17 = FALSE
          }
          frame "E61", "E61T" {
            call "Search and Replace Pattern.gvi"(string=s1, pattern="Device", replace string=w14) -> (result string=w15)
            w20 = "E61.jpg"
            w17 = FALSE
          }
          frame "G61" {
            call "Search and Replace Pattern.gvi"(string=s1, pattern="Device", replace string=w14) -> (result string=w15)
            w20 = "G61.jpg"
            w17 = FALSE
          }
          frame "G62" {
            call "Search and Replace Pattern.gvi"(string=s1, pattern="Device", replace string=w14) -> (result string=w15)
            w20 = "G62.jpg"
            w17 = FALSE
          }
          frame "E62" {
            call "Search and Replace Pattern.gvi"(string=s1, pattern="Device", replace string=w14) -> (result string=w15)
            w20 = "E62.jpg"
            w17 = FALSE
          }
          frame "E101", "G101" {
            call "Search and Replace Pattern.gvi"(string=s1, pattern="Device", replace string=w14) -> (result string=w15)
            w20 = "E101.jpg"
            w17 = FALSE
          }
          frame "E102", "G102" {
            call "Search and Replace Pattern.gvi"(string=s1, pattern="Device", replace string=w14) -> (result string=w15)
            w20 = "E102.jpg"
            w17 = FALSE
          }
          frame "E201", "G201" {
            call "Search and Replace Pattern.gvi"(string=s1, pattern="Device", replace string=w14) -> (result string=w15)
            w20 = "E102.jpg"
            w17 = FALSE
          }
          frame "E202", "G202" {
            call "Search and Replace Pattern.gvi"(string=s1, pattern="Device", replace string=w14) -> (result string=w15)
            w20 = "E202.jpg"
            w17 = FALSE
          }
        }
        $"Device:" <- w20
        w16 = s2
        w18 = s4
      }
    }
    Is Empty String Or Path(string/path=w14) -> w21
    case (w21) {
      frame False {
        # w14: param_values
        # w13: param_name
        # w5: ini_Ultravent_infos
        # w16: Ultravent state
        # w15: Device type
        case (w13) {
          frame "False", Default {
            w22 = "✅"
            w23 = w14
            w24 = w16
            w25 = w6
            w26 = s3
            w27 = w18
          }
          frame "Date and Time" {
            call "Change_to_validate_Date.gvi"(Date_Time_String input=w14, Error Cluster input=w6) -> (Validate date and time=w23, Error Cluster output=w25)
            Decimal String To Number(string=w14) -> (offset past number=w28)
            Is Equal(x=w28, y=14) -> w29
            case (w29) {
              frame False, Default {
                w30 = "❌"  # String {0}
                Concatenate Strings(w30, " ", w13, " ", "is incorrect") -> w22
              }
              frame True {
                w22 = "✅"
              }
            }
            w24 = w16
            w26 = s3
            w27 = w18
          }
          frame "Startup Date and Time" {
            call "Change_to_validate_Date.gvi"(Date_Time_String input=w14, Error Cluster input=w6) -> (Validate date and time=w23, Error Cluster output=w25)
            Decimal String To Number(string=w14) -> (offset past number=w31)
            Is Equal(x=w31, y=14) -> w32
            case (w32) {
              frame False, Default {
                w33 = "❌"  # String {0}
                Concatenate Strings(w33, " ", w13, " ", "is incorrect") -> w22
              }
              frame True {
                w22 = "✅"
              }
            }
            w24 = w16
            w26 = w14
            w27 = w18
          }
          frame "Unit Serial number" {
            String Length(string=w14) -> (length=w34)
            Is Equal(x=w34, y=16) -> w35
            case (w35) {
              frame False, Default {
                w36 = "❌"  # String {0}
                Concatenate Strings(w36, " ", w13, " ", "is incorrect") -> w22
              }
              frame True {
                w22 = "✅"
              }
            }
            w23 = w14
            w24 = w16
            w25 = w6
            w26 = s3
            w27 = w18
          }
          frame "Language" {
            Decimal String To Number(string=w14) -> (number=w37)
            Is Greater Or Equal(x=w37, y=1) -> w38
            Is Less Or Equal(x=w37, y=65) -> w39
            Logical And(w38, w39) -> w40
            case (w40) {
              frame False, Default {
                w41 = "❌"  # String {0}
                Concatenate Strings(w41, " ", w13, " ", "is missing") -> w22
                w25 = w6
                w23 = w14
              }
              frame True {
                case (w37) {
                  frame 0, Default {
                    w25 = w6
                    w23 = w14
                  }
                  frame 1 {
                    w25 = w6
                    w23 = "catalan"
                  }
                  frame 2 {
                    w25 = w6
                    w23 = "czech"
                  }
                  frame 3 {
                    w25 = w6
                    w23 = "cymraeg"
                  }
                  frame 4 {
                    w25 = w6
                    w23 = "danish"
                  }
                  frame 5 {
                    w25 = w6
                    w23 = "german"
                  }
                  frame 6 {
                    w25 = w6
                    w23 = "german (Austria)"
                  }
                  frame 7 {
                    w25 = w6
                    w23 = "german (Swiss)"
                  }
                  frame 8 {
                    w25 = w6
                    w23 = "estonian"
                  }
                  frame 9 {
                    w25 = w6
                    w23 = "english (Australia)"
                  }
                  frame 10 {
                    w25 = w6
                    w23 = "english (Canada)"
                  }
                  frame 11 {
                    w25 = w6
                    w23 = "english (UK)"
                  }
                  frame 12 {
                    w25 = w6
                    w23 = "english (USA)"
                  }
                  frame 13 {
                    w25 = w6
                    w23 = "english (others)"
                  }
                  frame 14 {
                    w25 = w6
                    w23 = "spanish"
                  }
                  frame 15 {
                    w25 = w6
                    w23 = "spanish (Chile)"
                  }
                  frame 16 {
                    w25 = w6
                    w23 = "spanish (Peru)"
                  }
                  frame 17 {
                    w25 = w6
                    w23 = "spanish (USA)"
                  }
                  frame 18 {
                    w25 = w6
                    w23 = "spanish (Mexiko)"
                  }
                  frame 19 {
                    w25 = w6
                    w23 = "basque"
                  }
                  frame 20 {
                    w25 = w6
                    w23 = "french"
                  }
                  frame 21 {
                    w25 = w6
                    w23 = "french (Swiss)"
                  }
                  frame 22 {
                    w25 = w6
                    w23 = "french (Canada)"
                  }
                  frame 23 {
                    w25 = w6
                    w23 = "gaelic"
                  }
                  frame 24 {
                    w25 = w6
                    w23 = "croatian"
                  }
                  frame 25 {
                    w25 = w6
                    w23 = "icelandic"
                  }
                  frame 26 {
                    w25 = w6
                    w23 = "italian"
                  }
                  frame 27 {
                    w25 = w6
                    w23 = "italian (Swiss)"
                  }
                  frame 28 {
                    w25 = w6
                    w23 = "latvian"
                  }
                  frame 29 {
                    w25 = w6
                    w23 = "lithuanian"
                  }
                  frame 30 {
                    w25 = w6
                    w23 = "hungarian"
                  }
                  frame 31 {
                    w25 = w6
                    w23 = "malay"
                  }
                  frame 32 {
                    w25 = w6
                    w23 = "dutch"
                  }
                  frame 33 {
                    w25 = w6
                    w23 = "norgwgian"
                  }
                  frame 34 {
                    w25 = w6
                    w23 = "polish"
                  }
                  frame 35 {
                    w25 = w6
                    w23 = "portugese"
                  }
                  frame 36 {
                    w25 = w6
                    w23 = "portugese (Brasil)"
                  }
                  frame 37 {
                    w25 = w6
                    w23 = "romanian"
                  }
                  frame 38 {
                    w25 = w6
                    w23 = "slovensky"
                  }
                  frame 39 {
                    w25 = w6
                    w23 = "slovene"
                  }
                  frame 40 {
                    w25 = w6
                    w23 = "serbian"
                  }
                  frame 41 {
                    w25 = w6
                    w23 = "serbian (cyrill)"
                  }
                  frame 42 {
                    w25 = w6
                    w23 = "finnish"
                  }
                  frame 43 {
                    w25 = w6
                    w23 = "swedish"
                  }
                  frame 44 {
                    w25 = w6
                    w23 = "turkish"
                  }
                  frame 45 {
                    w25 = w6
                    w23 = "greek"
                  }
                  frame 46 {
                    w25 = w6
                    w23 = "bulgarian"
                  }
                  frame 47 {
                    w25 = w6
                    w23 = "russian"
                  }
                  frame 48 {
                    w25 = w6
                    w23 = "ukrainian"
                  }
                  frame 49 {
                    w25 = w6
                    w23 = "hebrew"
                  }
                  frame 50 {
                    w25 = w6
                    w23 = "arabic"
                  }
                  frame 51 {
                    w25 = w6
                    w23 = "hindi"
                  }
                  frame 52 {
                    w25 = w6
                    w23 = "thai"
                  }
                  frame 53 {
                    w25 = w6
                    w23 = "korean"
                  }
                  frame 54 {
                    w25 = w6
                    w23 = "japanese"
                  }
                  frame 55 {
                    w25 = w6
                    w23 = "chinese (new)"
                  }
                  frame 56 {
                    w25 = w6
                    w23 = "chinese (old)"
                  }
                  frame 57 {
                    w25 = w6
                    w23 = "philippine"
                  }
                  frame 58 {
                    w25 = w6
                    w23 = "english (India)"
                  }
                  frame 59 {
                    w25 = w6
                    w23 = "indonesian"
                  }
                  frame 60 {
                    w25 = w6
                    w23 = "persian"
                  }
                  frame 61 {
                    w25 = w6
                    w23 = "chinese (traditional & others)"
                  }
                  frame 62 {
                    w25 = w6
                    w23 = "spanish (Argentina)"
                  }
                  frame 63 {
                    w25 = w6
                    w23 = "spanish (Colombia)"
                  }
                  frame 64 {
                    w25 = w6
                    w23 = "azerbaijan"
                  }
                  frame 65 {
                    w25 = w6
                    w23 = "vietnamese"
                  }
                }
                w22 = "✅"
              }
            }
            w24 = w16
            w26 = s3
            w27 = w18
          }
          frame "Unit Type" {
            case (w14) {
              frame "False", Default {
                w42 = "Unit type is incorrect, analysis of the service report XML file is not possible"
                One Button Dialog(button name ("OK")="OK", message=w42)
                w43 = "❌"  # String {0}
                Concatenate Strings(w43, " ", w13, " ", "is incorrect") -> w22
              }
              frame "623", "E101", "E102", "E201", "E202", "E523", "E61", "E61T", "E62", "E623", "G101", "G102", "G201", "G202", "G61", "G62" {
                w22 = "✅"
              }
            }
            w23 = w14
            w24 = w16
            w25 = w6
            w26 = s3
            w27 = w18
          }
          frame "UltraVent Serial number" {
            case (w16) {
              frame "False", Default {
                w44 = "  UltraVent is not implemented for this device !"  # String {0}
                Concatenate Strings("[ℹ]", w44) -> w22
              }
              frame "Ultravent_available" {
                call "Trim Whitespace.gvi"(String=w14) -> (Gekürzter String=w45)
                Is Not Equal(x=w45, y="") -> w46
                case (w46) {
                  frame False, Default {
                    w47 = "❌"  # String {0}
                    Concatenate Strings(w47, " ", w13, " ", "is missing") -> w22
                  }
                  frame True {
                    case (w45) {
                      frame "False", Default {
                        w22 = "✅"
                      }
                      frame "0" {
                        w48 = "❌"  # String {0}
                        Concatenate Strings(w48, " ", w13, " ", "is incorrect") -> w22
                      }
                      frame "" {
                        w49 = "❌"  # String {0}
                        Concatenate Strings(w49, " ", w13, " ", "is missing") -> w22
                      }
                    }
                  }
                }
              }
            }
            w23 = w14
            w24 = w16
            w25 = w6
            w26 = s3
            w27 = w18
          }
          frame "UltraVent SW-version" {
            case (w16) {
              frame "False", Default {
                w50 = "  UltraVent is not implemented for this device !"  # String {0}
                Concatenate Strings("[ℹ]", w50) -> w22
              }
              frame "Ultravent_available" {
                Is Not Equal(x=w14, y="") -> w51
                case (w51) {
                  frame False, Default {
                    w52 = "❌"  # String {0}
                    Concatenate Strings(w52, " ", w13, " ", "is missing") -> w22
                  }
                  frame True {
                    case (w14) {
                      frame "False", Default {
                        w22 = "✅"
                      }
                      frame "0.0.0" {
                        w53 = "❌"  # String {0}
                        Concatenate Strings(w53, " ", w13, " ", "is incorrect") -> w22
                      }
                    }
                  }
                }
              }
            }
            w23 = w14
            w24 = w16
            w25 = w6
            w26 = s3
            w27 = w18
          }
          frame "Software version" {
            Match Pattern(regular expression="LM100", string=w14) -> (match substring=w54)
            Is Equal(x=w54, y="LM100") -> w55
            case (w55) {
              frame False, Default {
                w56 = "❌"  # String {0}
                Concatenate Strings(w56, " ", w13, " ", "is incorrect") -> w22
              }
              frame True {
                w22 = "✅"
              }
            }
            w23 = w14
            w24 = w16
            w25 = w6
            w26 = s3
            w27 = w18
          }
          frame "Chemical Controller Revision", "Chemical Controller SW-version", "Chemical Controller Serial number", "Conductivity Sensor Revision", "Conductivity Sensor SW-version", "Conductivity Sensor Serial number" {
            case (w18) {
              frame "False", Default {
                w57 = " Information not required for this device type"  # String {0}
                Concatenate Strings("[ℹ]", w57) -> w22
              }
              frame "AutoDose_available" {
                Is Empty String Or Path(string/path=w14) -> w58
                Is Equal(x=w14, y="0") -> w59
                Is Equal(x=w14, y="0.0.0") -> w60
                Logical Or(w59, w60, w58) -> w61
                case (w61) {
                  frame True {
                    w62 = "❌"  # String {0}
                    Concatenate Strings(w62, " ", w13, " ", "is incorrect") -> w22
                  }
                  frame False {
                    w22 = "✅"
                  }
                }
              }
            }
            w23 = w14
            w24 = w14
            w25 = w6
            w26 = s3
            w27 = w18
          }
          frame "SDcard inserted" {
            Match Pattern(regular expression="OK", string=w14) -> (match substring=w63)
            Is Equal(x=w14, y=w63) -> w64
            case (w64) {
              frame False, Default {
                w65 = "❌"  # String {0}
                Concatenate Strings(w65, " ", "Check the inserted SDcard !", " ") -> w22
              }
              frame True {
                w22 = "✅"
              }
            }
            w23 = w14
            w24 = w16
            w25 = w6
            w26 = s3
            w27 = w18
          }
        }
      }
      frame True {
        case (w15) {
          frame "False", Default {
            case (w13) {
              frame "False", Default {
                w66 = "❌"  # String {0}
                Concatenate Strings(w66, " ", w13, " ", "is missing") -> w22
              }
              frame "Unit Type" {
                w67 = "Unit type is missing, analysis of the service report XML file is not possible"
                One Button Dialog(button name ("OK")="OK", message=w67)
                w68 = "❌"  # String {0}
                Concatenate Strings(w68, " ", w13, " ", "is missing") -> w22
              }
            }
          }
          frame "623", "E523" {
            # w13: par.name
            case (w13) {
              frame "Burner Control Manufactoring date", "Burner Control Revision", "Burner Control SW-version", "Burner Control Serial number", "Chemical Controller Revision", "Chemical Controller SW-version", "Chemical Controller Serial number", "Conductivity Sensor Revision", "Conductivity Sensor SW-version", "Conductivity Sensor Serial number", "Fan M16 Revision", "Fan M16 SW-version", "Fan M16 Serial number", "Fan M22 Revision", "Fan M22 SW-version", "Fan M22 Serial number", "Magnetron Power Supply Temperature bottom", "Magnetron Power Supply Temperature top", "Magnetron Temperature bottom", "Magnetron Temperature top", "Magnetron bottom Revision", "Magnetron bottom SW-version", "Magnetron bottom Serial number", "Magnetron top Revision", "Magnetron top SW-version", "Magnetron top Serial number", "Pump-Board Manufacturing date", "Pump-Board Revision", "Pump-Board SW-version", "Pump-Board Serial number" {
                w69 = " Information not required for this device type"  # String {0}
                Concatenate Strings("[ℹ]", w69) -> w22
              }
              frame "Energy optimisation", "Script version" {
                w70 = " Information is not implemented for this device"  # String {0}
                Concatenate Strings("[ℹ]", w70) -> w22
              }
              frame "UltraVent SW-version" {
                case (w16) {
                  frame "False", Default {
                    w71 = "   UltraVent is not implemented for this device !"  # String {0}
                    Concatenate Strings("[ℹ]", w71) -> w22
                  }
                  frame "Ultravent_available" {
                    Is Not Equal(x=w14, y="") -> w72
                    case (w72) {
                      frame False, Default {
                        w73 = "❌"  # String {0}
                        Concatenate Strings(w73, " ", w13, " ", "is missing") -> w22
                      }
                      frame True {
                        case (w14) {
                          frame "False", Default {
                            w22 = "✅"
                          }
                          frame "0.0.0" {
                            w74 = "❌"  # String {0}
                            Concatenate Strings(w74, " ", w13, " ", "is incorrect") -> w22
                          }
                        }
                      }
                    }
                  }
                }
              }
              frame "UltraVent Serial number" {
                case (w16) {
                  frame "False", Default {
                    w75 = "   UltraVent is not implemented for this device !"  # String {0}
                    Concatenate Strings("[ℹ]", w75) -> w22
                  }
                  frame "Ultravent_available" {
                    Is Not Equal(x=w14, y="") -> w76
                    case (w76) {
                      frame False, Default {
                        w77 = "❌"  # String {0}
                        Concatenate Strings(w77, " ", w13, " ", "is missing") -> w22
                      }
                      frame True {
                        case (w14) {
                          frame "False", Default {
                            w22 = "✅"
                          }
                          frame "0" {
                            w78 = "❌"  # String {0}
                            Concatenate Strings(w78, " ", w13, " ", "is incorrect") -> w22
                          }
                        }
                      }
                    }
                  }
                }
              }
              frame "True", Default {
                w79 = "❌"  # String {0}
                Concatenate Strings(w79, " ", w13, " ", "is missing") -> w22
              }
            }
          }
          frame "E61", "E62" {
            case (w13) {
              frame "Burner Control Manufactoring date", "Burner Control Revision", "Burner Control SW-version", "Burner Control Serial number", "Chemical Controller Revision", "Chemical Controller SW-version", "Chemical Controller Serial number", "Conductivity Sensor Revision", "Conductivity Sensor SW-version", "Fan M16 Revision", "Fan M16 SW-version", "Fan M16 Serial number", "Fan M22 Revision", "Fan M22 SW-version", "Fan M22 Serial number", "Magnetron bottom Revision", "Magnetron bottom SW-version", "Magnetron bottom Serial number", "Magnetron top Revision", "Magnetron top SW-version", "Magnetron top Serial number", "SW-Version", "XS Additional PCB", "XS Additional PCB Revision", "XS Additional PCB SW-Version", "XS Additional PCB Serial Number" {
                w80 = " Information is not required for this device"  # String {0}
                Concatenate Strings("[ℹ]", w80) -> w22
              }
              frame "Script version" {
                w81 = " Information is not implemented for this device"  # String {0}
                Concatenate Strings("[ℹ]", w81) -> w22
              }
              frame "UltraVent SW-version" {
                case (w16) {
                  frame "False", Default {
                    w82 = "   UltraVent is not implemented for this device !"  # String {0}
                    Concatenate Strings("[ℹ]", w82) -> w22
                  }
                  frame "Ultravent_available" {
                    Is Not Equal(x=w14, y="") -> w83
                    case (w83) {
                      frame False, Default {
                        w84 = "❌"  # String {0}
                        Concatenate Strings(w84, " ", w13, " ", "is missing") -> w22
                      }
                      frame True {
                        case (w14) {
                          frame "False", Default {
                            w22 = "✅"
                          }
                          frame "0.0.0" {
                            w85 = "❌"  # String {0}
                            Concatenate Strings(w85, " ", w13, " ", "is incorrect") -> w22
                          }
                        }
                      }
                    }
                  }
                }
              }
              frame "Conductivity Sensor Serial number" {
                case (w18) {
                  frame "False", Default {
                    w86 = " Information is not implemented for this device"  # String {0}
                    Concatenate Strings("[ℹ]", w86) -> w22
                  }
                  frame "AutoDose_available" {
                    Is Not Equal(x=w14, y="") -> w87
                    case (w87) {
                      frame False, Default {
                        w88 = "❌"  # String {0}
                        Concatenate Strings(w88, " ", w13, " ", "is missing") -> w22
                      }
                      frame True {
                        case (w14) {
                          frame "False", Default {
                            w22 = "✅"
                          }
                          frame "0", "0.0.0" {
                            w89 = "❌"  # String {0}
                            Concatenate Strings(w89, " ", w13, " ", "is incorrect") -> w22
                          }
                        }
                      }
                    }
                  }
                }
              }
              frame "UltraVent Serial number" {
                case (w16) {
                  frame "False", Default {
                    w90 = "   UltraVent is not implemented for this device !"  # String {0}
                    Concatenate Strings("[ℹ]", w90) -> w22
                  }
                  frame "Ultravent_available" {
                    Is Not Equal(x=w14, y="") -> w91
                    case (w91) {
                      frame False, Default {
                        w92 = "❌"  # String {0}
                        Concatenate Strings(w92, " ", w13, " ", "is missing") -> w22
                      }
                      frame True {
                        case (w14) {
                          frame "False", Default {
                            w22 = "✅"
                          }
                          frame "0.0.0" {
                            w93 = "❌"  # String {0}
                            Concatenate Strings(w93, " ", w13, " ", "is incorrect") -> w22
                          }
                        }
                      }
                    }
                  }
                }
              }
              frame "True", Default {
                w94 = "❌"  # String {0}
                Concatenate Strings(w94, " ", w13, " ", "is missing") -> w22
              }
            }
          }
          frame "E61T", "E62T" {
            case (w13) {
              frame "Burner Control Manufactoring date", "Burner Control Revision", "Burner Control SW-version", "Burner Control Serial number", "Fan M16 Revision", "Fan M16 SW-version", "Fan M16 Serial number", "Fan M22 Revision", "Fan M22 SW-version", "Fan M22 Serial number", "SW-Version", "XS Additional PCB", "XS Additional PCB Revision", "XS Additional PCB SW-Version", "XS Additional PCB Serial Number" {
                w95 = " Information not required for this device type"  # String {0}
                Concatenate Strings("[ℹ]", w95) -> w22
              }
              frame "Energy optimisation", "Script version" {
                w96 = " Information is not implemented for this device"  # String {0}
                Concatenate Strings("[ℹ]", w96) -> w22
              }
              frame "UltraVent SW-version" {
                case (w16) {
                  frame "False", Default {
                    w97 = "   UltraVent is not implemented for this device !"  # String {0}
                    Concatenate Strings("[ℹ]", w97) -> w22
                  }
                  frame "Ultravent_available" {
                    Is Not Equal(x=w14, y="") -> w98
                    case (w98) {
                      frame False, Default {
                        w99 = "❌"  # String {0}
                        Concatenate Strings(w99, " ", w13, " ", "is missing") -> w22
                      }
                      frame True {
                        case (w14) {
                          frame "False", Default {
                            w22 = "✅"
                          }
                          frame "0.0.0" {
                            w100 = "❌"  # String {0}
                            Concatenate Strings(w100, " ", w13, " ", "is incorrect") -> w22
                          }
                        }
                      }
                    }
                  }
                }
              }
              frame "Conductivity Sensor Serial number" {
                case (w18) {
                  frame "False", Default {
                    w101 = " Information is not implemented for this device"  # String {0}
                    Concatenate Strings("[ℹ]", w101) -> w22
                  }
                  frame "AutoDose_available" {
                    Is Not Equal(x=w14, y="") -> w102
                    case (w102) {
                      frame False, Default {
                        w103 = "❌"  # String {0}
                        Concatenate Strings(w103, " ", w13, " ", "is missing") -> w22
                      }
                      frame True {
                        case (w14) {
                          frame "False", Default {
                            w22 = "✅"
                          }
                          frame "0.0.0" {
                            w104 = "❌"  # String {0}
                            Concatenate Strings(w104, " ", w13, " ", "is incorrect") -> w22
                          }
                        }
                      }
                    }
                  }
                }
              }
              frame "UltraVent Serial number" {
                case (w18) {
                  frame "False", Default {
                    w105 = "   UltraVent is not implemented for this device !"  # String {0}
                    Concatenate Strings("[ℹ]", w105) -> w22
                  }
                  frame "Ultravent_available" {
                    Is Not Equal(x=w14, y="") -> w106
                    case (w106) {
                      frame False, Default {
                        w107 = "❌"  # String {0}
                        Concatenate Strings(w107, " ", w13, " ", "is missing") -> w22
                      }
                      frame True {
                        case (w14) {
                          frame "False", Default {
                            w22 = "✅"
                          }
                          frame "0" {
                            w108 = "❌"  # String {0}
                            Concatenate Strings(w108, " ", w13, " ", "is incorrect") -> w22
                          }
                        }
                      }
                    }
                  }
                }
              }
              frame "True", Default {
                w109 = "❌"  # String {0}
                Concatenate Strings(w109, " ", w13, " ", "is missing") -> w22
              }
            }
          }
          frame "E101", "E102" {
            case (w13) {
              frame "Burner Control Manufactoring date", "Burner Control Revision", "Burner Control SW-version", "Burner Control Serial number", "Chemical Controller SW-version", "Chemical Controller Serial number", "Conductivity Sensor Revision", "Conductivity Sensor SW-version", "Conductivity Sensor Serial number", "Fan M22 Revision", "Fan M22 SW-version", "Fan M22 Serial number", "Magnetron bottom Revision", "Magnetron bottom SW-version", "Magnetron bottom Serial number", "Magnetron top Revision", "Magnetron top SW-version", "Magnetron top Serial number", "SW-Version", "XS Additional PCB", "XS Additional PCB Revision", "XS Additional PCB SW-Version", "XS Additional PCB Serial Number" {
                w110 = " Information not required for this device type"  # String {0}
                Concatenate Strings("[ℹ]", w110) -> w22
              }
              frame "Energy optimisation", "Script version" {
                w111 = "  Information is not implemented for this device"  # String {0}
                Concatenate Strings("[ℹ]", w111) -> w22
              }
              frame "UltraVent SW-version" {
                case (w16) {
                  frame "False", Default {
                    w112 = "  UltraVent is not implemented for this device !"  # String {0}
                    Concatenate Strings("[ℹ]", w112) -> w22
                  }
                  frame "Ultravent_available" {
                    Is Not Equal(x=w14, y="") -> w113
                    case (w113) {
                      frame False, Default {
                        w114 = "❌"  # String {0}
                        Concatenate Strings(w114, " ", w13, " ", "is missing") -> w22
                      }
                      frame True {
                        case (w14) {
                          frame "False", Default {
                            w22 = "✅"
                          }
                          frame "0.0.0" {
                            w115 = "❌"  # String {0}
                            Concatenate Strings(w115, " ", w13, " ", "is incorrect") -> w22
                          }
                        }
                      }
                    }
                  }
                }
              }
              frame "Chemical Controller Revision" {
                case (w18) {
                  frame "False", Default {
                    w116 = " Information is not implemented for this device"  # String {0}
                    Concatenate Strings("[ℹ]", w116) -> w22
                  }
                  frame "AutoDose_available" {
                    Is Not Equal(x=w14, y="") -> w117
                    case (w117) {
                      frame False, Default {
                        w118 = "❌"  # String {0}
                        Concatenate Strings(w118, " ", w13, " ", "is missing") -> w22
                      }
                      frame True {
                        case (w14) {
                          frame "False", Default {
                            w22 = "✅"
                          }
                          frame "0.0.0" {
                            w119 = "❌"  # String {0}
                            Concatenate Strings(w119, " ", w13, " ", "is incorrect") -> w22
                          }
                        }
                      }
                    }
                  }
                }
              }
              frame "UltraVent Serial number" {
                case (w16) {
                  frame "False", Default {
                    w120 = "   UltraVent is not implemented for this device !"  # String {0}
                    Concatenate Strings("[ℹ]", w120) -> w22
                  }
                  frame "Ultravent_available" {
                    Is Not Equal(x=w14, y="") -> w121
                    case (w121) {
                      frame False, Default {
                        w122 = "❌"  # String {0}
                        Concatenate Strings(w122, " ", w13, " ", "is missing") -> w22
                      }
                      frame True {
                        case (w14) {
                          frame "False", Default {
                            w22 = "✅"
                          }
                          frame "0" {
                            w123 = "❌"  # String {0}
                            Concatenate Strings(w123, " ", w13, " ", "is incorrect") -> w22
                          }
                        }
                      }
                    }
                  }
                }
              }
              frame "True", Default {
                w124 = "❌"  # String {0}
                Concatenate Strings(w124, " ", w13, " ", "is missing") -> w22
              }
            }
          }
          frame "G101", "G102" {
            case (w13) {
              frame "Chemical Controller SW-version", "Chemical Controller Serial number", "Conductivity Sensor Revision", "Conductivity Sensor SW-version", "Conductivity Sensor Serial number", "Fan M22 Revision", "Fan M22 SW-version", "Fan M22 Serial number", "Magnetron bottom Revision", "Magnetron bottom SW-version", "Magnetron bottom Serial number", "Magnetron top Revision", "Magnetron top SW-version", "Magnetron top Serial number", "XS Additional PCB", "XS Additional PCB Revision", "XS Additional PCB SW-Version", "XS Additional PCB Serial Number" {
                w125 = " Information not required for this device type"  # String {0}
                Concatenate Strings("[ℹ]", w125) -> w22
              }
              frame "Energy optimisation", "Script version" {
                w126 = " Information is not implemented for this device"  # String {0}
                Concatenate Strings("[ℹ]", w126) -> w22
              }
              frame "UltraVent SW-version" {
                case (w16) {
                  frame "False", Default {
                    w127 = "   UltraVent is not implemented for this device !"  # String {0}
                    Concatenate Strings("[ℹ]", w127) -> w22
                  }
                  frame "Ultravent_available" {
                    Is Not Equal(x=w14, y="") -> w128
                    case (w128) {
                      frame False, Default {
                        w129 = "❌"  # String {0}
                        Concatenate Strings(w129, " ", w13, " ", "is missing") -> w22
                      }
                      frame True {
                        case (w14) {
                          frame "False", Default {
                            w22 = "✅"
                          }
                          frame "0.0.0" {
                            w130 = "❌"  # String {0}
                            Concatenate Strings(w130, " ", w13, " ", "is incorrect") -> w22
                          }
                        }
                      }
                    }
                  }
                }
              }
              frame "Chemical Controller Revision" {
                case (w18) {
                  frame "False", Default {
                    w131 = "   UltraVent is not implemented for this device !"  # String {0}
                    Concatenate Strings("[ℹ]", w131) -> w22
                  }
                  frame "AutoDose_available" {
                    Is Not Equal(x=w14, y="") -> w132
                    case (w132) {
                      frame False, Default {
                        w133 = "❌"  # String {0}
                        Concatenate Strings(w133, " ", w13, " ", "is missing") -> w22
                      }
                      frame True {
                        case (w14) {
                          frame "False", Default {
                            w22 = "✅"
                          }
                          frame "0.0.0" {
                            w134 = "❌"  # String {0}
                            Concatenate Strings(w134, " ", w13, " ", "is incorrect") -> w22
                          }
                        }
                      }
                    }
                  }
                }
              }
              frame "UltraVent Serial number" {
                case (w16) {
                  frame "False", Default {
                    w135 = "   UltraVent is not implemented for this device !"  # String {0}
                    Concatenate Strings("[ℹ]", w135) -> w22
                  }
                  frame "Ultravent_available" {
                    Is Not Equal(x=w14, y="") -> w136
                    case (w136) {
                      frame False, Default {
                        w137 = "❌"  # String {0}
                        Concatenate Strings(w137, " ", w13, " ", "is missing") -> w22
                      }
                      frame True {
                        case (w14) {
                          frame "False", Default {
                            w22 = "✅"
                          }
                          frame "0" {
                            w138 = "❌"  # String {0}
                            Concatenate Strings(w138, " ", w13, " ", "is incorrect") -> w22
                          }
                        }
                      }
                    }
                  }
                }
              }
              frame "True", Default {
                w139 = "❌"  # String {0}
                Concatenate Strings(w139, " ", w13, " ", "is missing") -> w22
              }
            }
          }
          frame "E201", "E202" {
            case (w13) {
              frame "Burner Control Manufactoring date", "Burner Control Revision", "Burner Control SW-version", "Burner Control Serial number", "Chemical Controller Revision", "Chemical Controller SW-version", "Chemical Controller Serial number", "Conductivity Sensor Revision", "Conductivity Sensor SW-version", "Conductivity Sensor Serial number", "Magnetron bottom Revision", "Magnetron bottom SW-version", "Magnetron bottom Serial number", "Magnetron top Revision", "Magnetron top SW-version", "Magnetron top Serial number", "SW-Version", "XS Additional PCB", "XS Additional PCB Revision", "XS Additional PCB SW-Version", "XS Additional PCB Serial Number" {
                w140 = " Information not required for this device type"  # String {0}
                Concatenate Strings("[ℹ]", w140) -> w22
              }
              frame "Energy optimisation", "Script version" {
                w141 = " Information is not implemented for this device"  # String {0}
                Concatenate Strings("[ℹ]", w141) -> w22
              }
              frame "UltraVent SW-version" {
                case (w16) {
                  frame "False", Default {
                    w142 = "   UltraVent is not implemented for this device !"  # String {0}
                    Concatenate Strings("[ℹ]", w142) -> w22
                  }
                  frame "Ultravent_available" {
                    Is Not Equal(x=w14, y="") -> w143
                    case (w143) {
                      frame False, Default {
                        w144 = "❌"  # String {0}
                        Concatenate Strings(w144, " ", w13, " ", "is missing") -> w22
                      }
                      frame True {
                        case (w14) {
                          frame "False", Default {
                            w22 = "✅"
                          }
                          frame "0.0.0" {
                            w145 = "❌"  # String {0}
                            Concatenate Strings(w145, " ", w13, " ", "is incorrect") -> w22
                          }
                        }
                      }
                    }
                  }
                }
              }
              frame "UltraVent Serial number" {
                case (w16) {
                  frame "False", Default {
                    w146 = "   UltraVent is not implemented for this device !"  # String {0}
                    Concatenate Strings("[ℹ]", w146) -> w22
                  }
                  frame "Ultravent_available" {
                    Is Not Equal(x=w14, y="") -> w147
                    case (w147) {
                      frame False, Default {
                        w148 = "❌"  # String {0}
                        Concatenate Strings(w148, " ", w13, " ", "is missing") -> w22
                      }
                      frame True {
                        case (w14) {
                          frame "False", Default {
                            w22 = "✅"
                          }
                          frame "0" {
                            w149 = "❌"  # String {0}
                            Concatenate Strings(w149, " ", w13, " ", "is incorrect") -> w22
                          }
                        }
                      }
                    }
                  }
                }
              }
              frame "True", Default {
                w150 = "❌"  # String {0}
                Concatenate Strings(w150, " ", w13, " ", "is missing") -> w22
              }
            }
          }
          frame "G201", "G202" {
            case (w13) {
              frame "Chemical Controller SW-version", "Chemical Controller Serial number", "Conductivity Sensor Revision", "Conductivity Sensor SW-version", "Conductivity Sensor Serial number", "Magnetron bottom Revision", "Magnetron bottom SW-version", "Magnetron bottom Serial number", "Magnetron top Revision", "Magnetron top SW-version", "Magnetron top Serial number", "XS Additional PCB", "XS Additional PCB Revision", "XS Additional PCB SW-Version", "XS Additional PCB Serial Number" {
                w151 = " Information not required for this device type"  # String {0}
                Concatenate Strings("[ℹ]", w151) -> w22
              }
              frame "Energy optimisation", "Script version" {
                w152 = " Information is not implemented for this device"  # String {0}
                Concatenate Strings("[ℹ]", w152) -> w22
              }
              frame "UltraVent SW-version" {
                case (w16) {
                  frame "False", Default {
                    w153 = "   UltraVent is not implemented for this device !"  # String {0}
                    Concatenate Strings("[ℹ]", w153) -> w22
                  }
                  frame "Ultravent_available" {
                    Is Not Equal(x=w14, y="") -> w154
                    case (w154) {
                      frame False, Default {
                        w155 = "❌"  # String {0}
                        Concatenate Strings(w155, " ", w13, " ", "is missing") -> w22
                      }
                      frame True {
                        case (w14) {
                          frame "False", Default {
                            w22 = "✅"
                          }
                          frame "0.0.0" {
                            w156 = "❌"  # String {0}
                            Concatenate Strings(w156, " ", w13, " ", "is incorrect") -> w22
                          }
                        }
                      }
                    }
                  }
                }
              }
              frame "Chemical Controller Revision" {
                case (w18) {
                  frame "False", Default {
                    w157 = " Information is not implemented for this device"  # String {0}
                    Concatenate Strings("[ℹ]", w157) -> w22
                  }
                  frame "AutoDose_available" {
                    Is Not Equal(x=w14, y="") -> w158
                    case (w158) {
                      frame False, Default {
                        w159 = "❌"  # String {0}
                        Concatenate Strings(w159, " ", w13, " ", "is missing") -> w22
                      }
                      frame True {
                        case (w14) {
                          frame "False", Default {
                            w22 = "✅"
                          }
                          frame "0.0.0" {
                            w160 = "❌"  # String {0}
                            Concatenate Strings(w160, " ", w13, " ", "is incorrect") -> w22
                          }
                        }
                      }
                    }
                  }
                }
              }
              frame "UltraVent Serial number" {
                case (w16) {
                  frame "False", Default {
                    w161 = "   UltraVent is not implemented for this device !"  # String {0}
                    Concatenate Strings("[ℹ]", w161) -> w22
                  }
                  frame "Ultravent_available" {
                    Is Not Equal(x=w14, y="") -> w162
                    case (w162) {
                      frame False, Default {
                        w163 = "❌"  # String {0}
                        Concatenate Strings(w163, " ", w13, " ", "is missing") -> w22
                      }
                      frame True {
                        case (w14) {
                          frame "False", Default {
                            w22 = "✅"
                          }
                          frame "0" {
                            w164 = "❌"  # String {0}
                            Concatenate Strings(w164, " ", w13, " ", "is incorrect") -> w22
                          }
                        }
                      }
                    }
                  }
                }
              }
              frame "True", Default {
                w165 = "❌"  # String {0}
                Concatenate Strings(w165, " ", w13, " ", "is missing") -> w22
              }
            }
          }
          frame "G61", "G62" {
            case (w13) {
              frame "Chemical Controller Revision", "Chemical Controller SW-version", "Chemical Controller Serial number", "Conductivity Sensor Revision", "Conductivity Sensor SW-version", "Conductivity Sensor Serial number", "Fan M16 Revision", "Fan M16 SW-version", "Fan M16 Serial number", "Fan M22 Revision", "Fan M22 SW-version", "Fan M22 Serial number", "Magnetron bottom Revision", "Magnetron bottom SW-version", "Magnetron bottom Serial number", "Magnetron top Revision", "Magnetron top SW-version", "Magnetron top Serial number", "XS Additional PCB", "XS Additional PCB Revision", "XS Additional PCB SW-Version", "XS Additional PCB Serial Number" {
                w166 = " Information not required for this device type"  # String {0}
                Concatenate Strings("[ℹ]", w166) -> w22
              }
              frame "Energy optimisation", "Script version" {
                w167 = " Information is not implemented for this device"  # String {0}
                Concatenate Strings("[ℹ]", w167) -> w22
              }
              frame "UltraVent SW-version" {
                case (w16) {
                  frame "False", Default {
                    w168 = "   UltraVent is not implemented for this device !"  # String {0}
                    Concatenate Strings("[ℹ]", w168) -> w22
                  }
                  frame "Ultravent_available" {
                    Is Not Equal(x=w14, y="") -> w169
                    case (w169) {
                      frame False, Default {
                        w170 = "❌"  # String {0}
                        Concatenate Strings(w170, " ", w13, " ", "is missing") -> w22
                      }
                      frame True {
                        case (w14) {
                          frame "False", Default {
                            w22 = "✅"
                          }
                          frame "0.0.0" {
                            w171 = "❌"  # String {0}
                            Concatenate Strings(w171, " ", w13, " ", "is incorrect") -> w22
                          }
                        }
                      }
                    }
                  }
                }
              }
              frame "UltraVent Serial number" {
                case (w16) {
                  frame "False", Default {
                    w172 = "   UltraVent is not implemented for this device !"  # String {0}
                    Concatenate Strings("[ℹ]", w172) -> w22
                  }
                  frame "Ultravent_available" {
                    Is Not Equal(x=w14, y="") -> w173
                    case (w173) {
                      frame False, Default {
                        w174 = "❌"  # String {0}
                        Concatenate Strings(w174, " ", w13, " ", "is missing") -> w22
                      }
                      frame True {
                        case (w14) {
                          frame "False", Default {
                            w22 = "✅"
                          }
                          frame "0" {
                            w175 = "❌"  # String {0}
                            Concatenate Strings(w175, " ", w13, " ", "is incorrect") -> w22
                          }
                        }
                      }
                    }
                  }
                }
              }
              frame "True", Default {
                w176 = "❌"  # String {0}
                Concatenate Strings(w176, " ", w13, " ", "is missing") -> w22
              }
            }
          }
        }
        w23 = w14
        w24 = w16
        w25 = w6
        w26 = s3
        w27 = w18
      }
    }
    Property Node(instance in=T2 {all zero or empty}, "Parameter Name"=w13, "Value"=w23, "Comment"=w22) -> (instance out=w177)
    append w177 to w8
    next s1 = w15
    next s2 = w24
    next s3 = w26
    next s4 = w27
    stop if w17
  }
  $Ultravent <- s2
  $"Unit-type" <- s1
  s5 = string[] []  # shift register
  s6 = string[] []  # shift register
  for {
    w178 = each element of w8
    Property Node(instance in=w178) -> ("Parameter Name"=w179, "Value"=w180)
    case (w179) {
      frame "False", Default {
        w181 = s5
        w182 = s6
      }
      frame "Touchcontroller type" {
        Insert Into Array(inArray=s6, new=w179) -> w182
        case (w180) {
          frame "False", Default {
            w183 = "------"
          }
          frame "T1" {
            w183 = "Atmel Chip"
          }
          frame "T2" {
            w183 = "ILITEK"
          }
        }
        Insert Into Array(inArray=s5, new=w183) -> w181
      }
      frame "CPU-Board Revision" {
        Insert Into Array(inArray=s6, new=w179) -> w182
        case (w180) {
          frame "False", Default {
            w184 = "Benchmark Board"
          }
          frame "A0" {
            w184 = "Avnet Board"
          }
        }
        Insert Into Array(inArray=s5, new=w184) -> w181
      }
      frame "IO-Board Serial number" {
        Insert Into Array(inArray=s6, new=w179) -> w182
        String Subset(length (rest)=1, string=w180) -> w185
        case (w185) {
          frame "False", Default {
            w186 = "IO"
          }
          frame "C" {
            w186 = "IO LO"
          }
        }
        Insert Into Array(inArray=s5, new=w186) -> w181
      }
      frame "Pump-Board Serial number" {
        Insert Into Array(inArray=s6, new="Pump-Board μC-Type") -> w182
        String Subset(length (rest)=3, string=w180) -> w187
        case (w187) {
          frame "False", Default {
            w188 = "IO"
          }
          frame "PC6" {
            w188 = "G4"
          }
          frame "PC3" {
            w188 = "F1"
          }
        }
        Insert Into Array(inArray=s5, new=w188) -> w181
      }
    }
    next s5 = w181
    next s6 = w182
  }
  for {
    w189 = each element of s6
    w190 = each element of s5
    Property Node(instance in=T1 {all zero or empty}, "Boards"=w189, "Informations"=w190) -> (instance out=w192)
    append w192 to w191
  }
  $"Boards Informations:" <- w191
  $"Auto Dose" <- s4
  $"Startup Date and Time" <- s3
  $"Output Error" <- w25
  $common <- w8
