vi "Interpret_Diagnostic_RT_Calibration.gviweb"   [G Web Development Software 22.3.0]
inputs:
  "Error Cluster Constant": error
  "Diagnostic RT Calibration Entrys": string[]
outputs:
  "Diagnostic RT Calibration": T1[]
  "Output Error": error
  "Calibrated": bool
panel indicators:
  "in range?": bool
types:
  T1 = cluster{"Parameter Name": string, "Combi": string, "Dry": string, "Wet": string, "Dimension": string, "Comment": string}
uses:
  NI::G Core::Strings::Search and Replace Pattern.gvi
  NI::G Core::Strings::Trim Whitespace.gvi
diagram:
  # [ℹ]
  s1 = FALSE  # shift register
  for {
    w1 = each element of $"Diagnostic RT Calibration Entrys"
    Match Pattern(regular expression="Combi", string=w1) -> (after substring=w3, before substring=w4)
    call "Search and Replace Pattern.gvi"(String=w4, Muster="_", Ersetzungs-String=" ", Alle ersetzen=TRUE) -> (Ergebnis-String=w5)
    call "Trim Whitespace.gvi"(string=w5) -> (trimmed string=w6)
    Match Pattern(regular expression="Dry", string=w3) -> (after substring=w7, before substring=w8)
    Match Pattern(regular expression="Wet", string=w7) -> (after substring=w9, before substring=w10)
    call "Search and Replace Pattern.gvi"(String=w10, Muster="=\"", Alle ersetzen=TRUE) -> (Ergebnis-String=w11)
    call "Search and Replace Pattern.gvi"(String=w11, Muster="\"", Alle ersetzen=TRUE) -> (Ergebnis-String=w12)
    call "Search and Replace Pattern.gvi"(String=w8, Muster="=\"", Alle ersetzen=TRUE) -> (Ergebnis-String=w13)
    call "Search and Replace Pattern.gvi"(String=w13, Muster="\"", Alle ersetzen=TRUE) -> (Ergebnis-String=w14)
    call "Trim Whitespace.gvi"(string=w14) -> (trimmed string=w15)
    Match Pattern(regular expression="dim", string=w9) -> (after substring=w16, before substring=w17)
    call "Search and Replace Pattern.gvi"(String=w17, Muster="=\"", Alle ersetzen=TRUE) -> (Ergebnis-String=w18)
    call "Search and Replace Pattern.gvi"(String=w18, Muster="\"", Alle ersetzen=TRUE) -> (Ergebnis-String=w19)
    call "Trim Whitespace.gvi"(string=w19) -> (trimmed string=w20)
    call "Search and Replace Pattern.gvi"(String=w16, Muster="=\"", Alle ersetzen=TRUE) -> (Ergebnis-String=w21)
    call "Search and Replace Pattern.gvi"(String=w21, Muster="\"", Alle ersetzen=TRUE) -> (Ergebnis-String=w22)
    call "Trim Whitespace.gvi"(string=w22) -> (trimmed string=w23)
    Match Pattern(regular expression="CalibN", string=w6) -> (match substring=w24)
    case (w24) {
      frame "False", Default {
        case (w6) {
          frame "False", Default {
            w26 = "✅"
          }
          frame "Clima Output P1" {
            Decimal String To Number(default (0 I32)=0, string=w12) -> (number=w27)
            Is Not Equal To 0(x=w27) -> w28
            case (w28) {
              frame False, Default {
                w29 = "❌"  # String {0}
                Concatenate Strings(w29, " The pressure box is brocken") -> w26
              }
              frame True {
                w26 = "✅"
              }
            }
          }
          frame "Boiling temperature" {
            Floating Point String To Number(default (0 DBL)=0, string=w12, use system decimal point (T)=TRUE) -> (number=w30)
            In Range And Coerce(lower limit=83, upper limit=102, x=w30) -> (In Range?=w31)
            case (w31) {
              frame False, Default {
                w32 = "❌"  # String {0}
                Concatenate Strings(w32, " The pressure box is brocken") -> w26
              }
              frame True {
                Is Equal(x=w30, y=99.99) -> w33
                case (w33) {
                  frame False, Default {
                    w26 = "✅"
                  }
                  frame True {
                    Concatenate Strings("⚠️", " Default value of the boiling temperature is stored!", "\r", "\r", "Please start a calibration again.") -> w26
                  }
                }
              }
            }
            $"in range?" <- w31
          }
        }
        w25 = s1
      }
      frame "CalibN" {
        Decimal String To Number(default (0 I32)=0, string=w15) -> (number=w34)
        Is Not Equal To 0(x=w34) -> w35
        Decimal String To Number(default (0 I32)=0, string=w12) -> (number=w36)
        Is Not Equal To 0(x=w36) -> w37
        Decimal String To Number(default (0 I32)=0, string=w20) -> (number=w38)
        Is Not Equal To 0(x=w38) -> w39
        Logical And(w35, w37, w39) -> w40
        case (w40) {
          frame False, Default {
            Concatenate Strings("[ℹ]", " Information is not necessary") -> w26
            w25 = s1
          }
          frame True {
            Concatenate Strings("✅", "Calibration values are stored correctly") -> w26
            w25 = TRUE
          }
        }
      }
    }
    Property Node(instance in=T1 {all zero or empty}, "Parameter Name"=w6, "Combi"=w15, "Dry"=w12, "Wet"=w20, "Dimension"=w23, "Comment"=w26) -> (instance out=w41)
    append w41 to w2
    next s1 = w25
  }
  $Calibrated <- s1
  case (s1) {
    frame True {
      w42 = $"Error Cluster Constant"
      w43 = w2
    }
    frame False {
      for {
        w44 = each element of w2
        Property Node(instance in=w44) -> ("Parameter Name"=w45, "Combi"=w46, "Dry"=w47, "Wet"=w48, "Dimension"=w49, "Comment"=w50, instance out=w51)
        Match Pattern(regular expression="CalibN", string=w45) -> (match substring=w52)
        case (w52) {
          frame "False", Default {
            w53 = w50
          }
          frame "CalibN" {
            w53 = "Calibration values are not stored correctly"
          }
        }
        Property Node(instance in=w51, "Parameter Name"=w45, "Combi"=w46, "Dry"=w47, "Wet"=w48, "Dimension"=w49, "Comment"=w53) -> (instance out=w54)
        append w54 to w43
      }
      w42 = $"Error Cluster Constant"
    }
  }
  $"Output Error" <- w42
  $"Diagnostic RT Calibration" <- w43
