vi "Interpret_Diagnostic_RT_Data_Sensors.gviweb"   [G Web Development Software 22.3.0]
inputs:
  "Diagnostic Settings Entrys": string[]
  "Config File infos": string[]
  "Device Type": string = "Device"
  "Error input": error
  "Auto Dose": string
outputs:
  "Output Error": error
  "Diagnostic_RT_Data_Sensors": T1[]
types:
  T1 = cluster{"Parameter Name": string, "Actual": string, "Dimension": string, "Limit": string, "maximum": string, "Time_stamp": string, "Comment": string}
  T2 = cluster{"Parameter Name": string, "Actual": string, "Dimension": string, "Limit": string, "maximum": string, "time_stamp": string, "comment": string}
uses:
  WebApp::Get_Config_ini_Part.gviweb
  NI::G Core::Strings::Search and Replace Pattern.gvi
  NI::G Core::Strings::Trim Whitespace.gvi
diagram:
  call "Get_Config_ini_Part.gviweb"(Ini Array=$"Config File infos", ini Part from Array=6, Error in=$"Error input") -> (Ini Part as Array=w1, Output Error=w2)
  for (after w1) {
    w3 = each element of $"Diagnostic Settings Entrys"
    Match Pattern(regular expression="actual", string=w3) -> (after substring=w5, before substring=w6)
    call "Search and Replace Pattern.gvi"(String=w6, Muster="_", Ersetzungs-String=" ", Alle ersetzen=TRUE) -> (Ergebnis-String=w7)
    call "Trim Whitespace.gvi"(string=w7) -> (trimmed string=w8)
    Match Pattern(regular expression="dim", string=w5) -> (after substring=w9, before substring=w10)
    call "Search and Replace Pattern.gvi"(String=w10, Muster="=\"", Alle ersetzen=TRUE) -> (Ergebnis-String=w11)
    call "Search and Replace Pattern.gvi"(String=w11, Muster="\"", Alle ersetzen=TRUE) -> (Ergebnis-String=w12)
    call "Trim Whitespace.gvi"(string=w12) -> (trimmed string=w13)
    call "Search and Replace Pattern.gvi"(String=w9, Muster="=\"", Alle ersetzen=TRUE) -> (Ergebnis-String=w14)
    Match Pattern(regular expression="lim", string=w14) -> (after substring=w15, before substring=w16)
    Match Pattern(regular expression="maximum", string=w15) -> (after substring=w17, before substring=w18)
    Match Pattern(regular expression="time_stamp", string=w17) -> (after substring=w19, before substring=w20)
    # w8: parm name
    # w13: actual
    # timestamp
    case ($"Device Type") {
      frame "False", Default {
        w21 = "✅"
      }
      frame "623", "E523", "E623" {
        # w8: parm name
        # w13: actual
        # w19: timestamp
        case (w8) {
          frame "False", Default {
            Decimal String To Number(string=w19) -> (offset past number=w22)
            Is Greater(x=w22, y=10) -> w23
            case (w23) {
              frame False, Default {
                Decimal String To Number(default (0 I32)=0, string=w13) -> (number=w24)
                In Range And Coerce(lower limit=0, upper limit=614, x=w24) -> (In Range?=w25)
                case (w25) {
                  frame False, Default {
                    w21 = "❌ Temperature not plausible, please check the sensor"
                  }
                  frame True {
                    w21 = "✅"
                  }
                }
              }
              frame True {
                call "Search and Replace Pattern.gvi"(String=w8, Muster="Temperature ", Alle ersetzen=TRUE) -> (Ergebnis-String=w26)
                w27 = "❌"  # String {0}
                Concatenate Strings(w27, "maximum temperatur of", " ", w26, "\r\n", "was reached") -> w21
              }
            }
          }
          frame "Cabinet B9", "Chemical Controller Temperature NTC", "HotAir Bottom Average HeatReq Lifetime Burner", "HotAir Bottom Average HeatReq Lifetime Device", "HotAir Top Average HeatReq Lifetime Burner", "HotAir Top Average HeatReq Lifetime Device", "Magnetron Power Supply Temperature bottom", "Magnetron Power Supply Temperature top", "Magnetron Temperature bottom", "Magnetron Temperature top", "Steam Average HeatReq Lifetime Burner", "Steam Average HeatReq Lifetime Device", "Temperature Fan Bottom", "Temperature Fan Middle", "Temperature LED handle side", "Temperature LED hinge side", "Temperature Pump Board" {
            w28 = " Information not required for this device type"  # String {0}
            Concatenate Strings("[ℹ]", w28) -> w21
          }
        }
      }
      frame "E61", "E62" {
        case (w8) {
          frame "False", Default {
            Decimal String To Number(string=w19) -> (offset past number=w29)
            Is Greater(x=w29, y=10) -> w30
            case (w30) {
              frame False, Default {
                Decimal String To Number(default (0 I32)=0, string=w13) -> (number=w31)
                In Range And Coerce(lower limit=0, upper limit=614, x=w31) -> (In Range?=w32)
                case (w32) {
                  frame False, Default {
                    w21 = "❌ Temperature not plausible, please check the sensor"
                  }
                  frame True {
                    w21 = "✅"
                  }
                }
              }
              frame True {
                call "Search and Replace Pattern.gvi"(String=w8, Muster="Temperature ", Alle ersetzen=TRUE) -> (Ergebnis-String=w33)
                w34 = "❌"  # String {0}
                Concatenate Strings(w34, "maximum temperatur of", " ", w33, "\r\n", "was reached") -> w21
              }
            }
          }
          frame "Cabinet B9", "Electrical Compartment B10", "HotAir Bottom Average HeatReq Lifetime Burner", "HotAir Bottom Average HeatReq Lifetime Device", "HotAir Top Average HeatReq Lifetime Burner", "HotAir Top Average HeatReq Lifetime Device", "Magnetron Power Supply Temperature bottom", "Magnetron Power Supply Temperature top", "Magnetron Temperature bottom", "Magnetron Temperature top", "Steam Average HeatReq Lifetime Burner", "Steam Average HeatReq Lifetime Device", "Temperature Fan Bottom", "Temperature Fan Middle" {
            w35 = " Information not required for this device type"  # String {0}
            Concatenate Strings("[ℹ]", w35) -> w21
          }
          frame "Chemical Controller Temperature NTC" {
            case ($"Auto Dose") {
              frame "AutoDose_available" {
                Floating Point String To Number(string=w13, use system decimal point (T)=TRUE) -> (number=w36)
                Is Equal To 0(x=w36) -> w37
                case (w37) {
                  frame True {
                    w21 = "❌ Temperature not plausible, please check the sensor"
                  }
                  frame False {
                    w21 = "✅"
                  }
                }
              }
              frame "False", Default {
                w38 = " Information not required for this device type"  # String {0}
                Concatenate Strings("[ℹ]", w38) -> w21
              }
            }
          }
        }
      }
      frame "E61T", "E62T" {
        case (w8) {
          frame "False", Default {
            Decimal String To Number(string=w19) -> (offset past number=w39)
            Is Greater(x=w39, y=10) -> w40
            case (w40) {
              frame False, Default {
                Decimal String To Number(default (0 I32)=0, string=w13) -> (number=w41)
                In Range And Coerce(lower limit=0, upper limit=614, x=w41) -> (In Range?=w42)
                case (w42) {
                  frame False, Default {
                    w21 = "❌ Temperature not plausible, please check the sensor"
                  }
                  frame True {
                    w21 = "✅"
                  }
                }
              }
              frame True {
                call "Search and Replace Pattern.gvi"(String=w8, Muster="Temperature ", Alle ersetzen=TRUE) -> (Ergebnis-String=w43)
                w44 = "❌"  # String {0}
                Concatenate Strings(w44, "maximum temperatur of", " ", w43, "\r\n", "was reached") -> w21
              }
            }
          }
          frame "Cabinet B9", "Electrical Compartment B10", "HotAir Bottom Average HeatReq Lifetime Burner", "HotAir Bottom Average HeatReq Lifetime Device", "HotAir Top Average HeatReq Lifetime Burner", "HotAir Top Average HeatReq Lifetime Device", "Steam Average HeatReq Lifetime Burner", "Steam Average HeatReq Lifetime Device", "Temperature Fan Bottom", "Temperature Fan Middle" {
            w45 = " Information not required for this device type"  # String {0}
            Concatenate Strings("[ℹ]", w45) -> w21
          }
          frame "Chemical Controller Temperature NTC" {
            case ($"Auto Dose") {
              frame "AutoDose_available" {
                Floating Point String To Number(string=w13, use system decimal point (T)=TRUE) -> (number=w46)
                Is Equal To 0(x=w46) -> w47
                case (w47) {
                  frame True {
                    w21 = "❌ Temperature not plausible, please check the sensor"
                  }
                  frame False {
                    w21 = "✅"
                  }
                }
              }
              frame "False", Default {
                w48 = " Information not required for this device type"  # String {0}
                Concatenate Strings("[ℹ]", w48) -> w21
              }
            }
          }
        }
      }
      frame "G61", "G62" {
        # w13: actual
        case (w8) {
          frame "False", Default {
            Decimal String To Number(string=w19) -> (offset past number=w49)
            Is Greater(x=w49, y=10) -> w50
            case (w50) {
              frame False, Default {
                Decimal String To Number(default (0 I32)=0, string=w13) -> (number=w51)
                In Range And Coerce(lower limit=1, upper limit=614, x=w51) -> (In Range?=w52)
                case (w52) {
                  frame False, Default {
                    w21 = "❌ Value is not plausible, please check the sensor"
                  }
                  frame True {
                    w21 = "✅"
                  }
                }
              }
              frame True {
                call "Search and Replace Pattern.gvi"(String=w8, Muster="Temperature ", Alle ersetzen=TRUE) -> (Ergebnis-String=w53)
                w54 = "❌"  # String {0}
                Concatenate Strings(w54, "maximum temperatur of", " ", w53, "\r\n", "was reached") -> w21
              }
            }
          }
          frame "Cabinet B9", "Electrical Compartment B10", "HotAir Bottom Average HeatReq Last3Month", "HotAir Bottom Average HeatReq Lifetime Burner", "HotAir Bottom Average HeatReq Lifetime Device", "Magnetron Power Supply Temperature bottom", "Magnetron Power Supply Temperature top", "Magnetron Temperature bottom", "Magnetron Temperature top", "Temperature Fan Bottom", "Temperature Fan Middle" {
            w55 = " Information not required for this device type"  # String {0}
            Concatenate Strings("[ℹ]", w55) -> w21
          }
          frame "Chemical Controller Temperature NTC" {
            case ($"Auto Dose") {
              frame "AutoDose_available" {
                Floating Point String To Number(string=w13, use system decimal point (T)=TRUE) -> (number=w56)
                Is Equal To 0(x=w56) -> w57
                case (w57) {
                  frame True {
                    w21 = "❌ Temperature not plausible, please check the sensor"
                  }
                  frame False {
                    w21 = "✅"
                  }
                }
              }
              frame "False", Default {
                w58 = " Information not required for this device type"  # String {0}
                Concatenate Strings("[ℹ]", w58) -> w21
              }
            }
          }
        }
      }
      frame "E101", "E102" {
        case (w8) {
          frame "False", Default {
            Decimal String To Number(string=w19) -> (offset past number=w59)
            Is Greater(x=w59, y=10) -> w60
            case (w60) {
              frame False, Default {
                Decimal String To Number(default (0 I32)=0, string=w13) -> (number=w61)
                In Range And Coerce(lower limit=0, upper limit=614, x=w61) -> (In Range?=w62)
                case (w62) {
                  frame False, Default {
                    w21 = "❌ Temperature not plausible, please check the sensor"
                  }
                  frame True {
                    w21 = "✅"
                  }
                }
              }
              frame True {
                call "Search and Replace Pattern.gvi"(String=w8, Muster="Temperature ", Alle ersetzen=TRUE) -> (Ergebnis-String=w63)
                w64 = "❌"  # String {0}
                Concatenate Strings(w64, "maximum temperatur of", " ", w63, "\r\n", "was reached") -> w21
              }
            }
          }
          frame "Cabinet B9", "Electrical Compartment B10", "HotAir Bottom Average HeatReq Lifetime Burner", "HotAir Bottom Average HeatReq Lifetime Device", "HotAir Top Average HeatReq Lifetime Burner", "HotAir Top Average HeatReq Lifetime Device", "Magnetron Power Supply Temperature bottom", "Magnetron Power Supply Temperature top", "Magnetron Temperature bottom", "Magnetron Temperature top", "Steam Average HeatReq Lifetime Burner", "Steam Average HeatReq Lifetime Device", "Temperature Fan Bottom" {
            w65 = " Information not required for this device type"  # String {0}
            Concatenate Strings("[ℹ]", w65) -> w21
          }
          frame "Chemical Controller Temperature NTC" {
            case ($"Auto Dose") {
              frame "AutoDose_available" {
                Floating Point String To Number(string=w13, use system decimal point (T)=TRUE) -> (number=w66)
                Is Equal To 0(x=w66) -> w67
                case (w67) {
                  frame True {
                    w21 = "❌ Temperature not plausible, please check the sensor"
                  }
                  frame False {
                    w21 = "✅"
                  }
                }
              }
              frame "False", Default {
                w68 = " Information not required for this device type"  # String {0}
                Concatenate Strings("[ℹ]", w68) -> w21
              }
            }
          }
        }
      }
      frame "E201", "E202" {
        case (w8) {
          frame "False", Default {
            Decimal String To Number(string=w19) -> (offset past number=w69)
            Is Greater(x=w69, y=10) -> w70
            case (w70) {
              frame False, Default {
                Decimal String To Number(default (0 I32)=0, string=w13) -> (number=w71)
                In Range And Coerce(lower limit=0, upper limit=614, x=w71) -> (In Range?=w72)
                case (w72) {
                  frame False, Default {
                    w21 = "❌ Temperature not plausible, please check the sensor"
                  }
                  frame True {
                    w21 = "✅"
                  }
                }
              }
              frame True {
                call "Search and Replace Pattern.gvi"(String=w8, Muster="Temperature ", Alle ersetzen=TRUE) -> (Ergebnis-String=w73)
                w74 = "❌"  # String {0}
                Concatenate Strings(w74, "maximum temperatur of", " ", w73, "\r\n", "was reached") -> w21
              }
            }
          }
          frame "Chemical Controller Temperature NTC", "Electrical Compartment B10", "HotAir Bottom Average HeatReq Lifetime Burner", "HotAir Bottom Average HeatReq Lifetime Device", "HotAir Top Average HeatReq Lifetime Burner", "HotAir Top Average HeatReq Lifetime Device", "Magnetron Power Supply Temperature bottom", "Magnetron Power Supply Temperature top", "Magnetron Temperature bottom", "Magnetron Temperature top", "Steam Average HeatReq Lifetime Burner", "Steam Average HeatReq Lifetime Device", "Temperature LED handle side", "Temperature LED hinge side" {
            w75 = " Information not required for this device type"  # String {0}
            Concatenate Strings("[ℹ]", w75) -> w21
          }
        }
      }
      frame "G101", "G102" {
        case (w8) {
          frame "False", Default {
            Decimal String To Number(string=w19) -> (offset past number=w76)
            Is Greater(x=w76, y=10) -> w77
            case (w77) {
              frame False, Default {
                Decimal String To Number(default (0 I32)=0, string=w13) -> (number=w78)
                In Range And Coerce(lower limit=0, upper limit=614, x=w78) -> (In Range?=w79)
                case (w79) {
                  frame False, Default {
                    w21 = "❌ Temperature not plausible, please check the sensor"
                  }
                  frame True {
                    w21 = "✅"
                  }
                }
              }
              frame True {
                call "Search and Replace Pattern.gvi"(String=w8, Muster="Temperature ", Alle ersetzen=TRUE) -> (Ergebnis-String=w80)
                w81 = "❌"  # String {0}
                Concatenate Strings(w81, "maximum temperatur of", " ", w80, "\r\n", "was reached") -> w21
              }
            }
          }
          frame "Cabinet B9", "Electrical Compartment B10", "HotAir Bottom Average HeatReq Lifetime Burner", "HotAir Bottom Average HeatReq Lifetime Device", "Magnetron Power Supply Temperature bottom", "Magnetron Power Supply Temperature top", "Magnetron Temperature bottom", "Magnetron Temperature top", "Temperature Fan Bottom" {
            w82 = " Information not required for this device type"  # String {0}
            Concatenate Strings("[ℹ]", w82) -> w21
          }
          frame "Chemical Controller Temperature NTC" {
            case ($"Auto Dose") {
              frame "AutoDose_available" {
                Floating Point String To Number(string=w13, use system decimal point (T)=TRUE) -> (number=w83)
                Is Equal To 0(x=w83) -> w84
                case (w84) {
                  frame True {
                    w21 = "❌ Temperature not plausible, please check the sensor"
                  }
                  frame False {
                    w21 = "✅"
                  }
                }
              }
              frame "False", Default {
                w85 = " Information not required for this device type"  # String {0}
                Concatenate Strings("[ℹ]", w85) -> w21
              }
            }
          }
        }
      }
      frame "G201", "G202" {
        case (w8) {
          frame "False", Default {
            Decimal String To Number(string=w19) -> (offset past number=w86)
            Is Greater(x=w86, y=10) -> w87
            case (w87) {
              frame False, Default {
                Decimal String To Number(default (0 I32)=0, string=w13) -> (number=w88)
                In Range And Coerce(lower limit=0, upper limit=614, x=w88) -> (In Range?=w89)
                case (w89) {
                  frame False, Default {
                    w21 = "❌ Temperature not plausible, please check the sensor"
                  }
                  frame True {
                    w21 = "✅"
                  }
                }
              }
              frame True {
                call "Search and Replace Pattern.gvi"(String=w8, Muster="Temperature ", Alle ersetzen=TRUE) -> (Ergebnis-String=w90)
                w91 = "❌"  # String {0}
                Concatenate Strings(w91, "maximum temperatur of", " ", w90, "\r\n", "was reached") -> w21
              }
            }
          }
          frame "Chemical Controller Temperature NTC", "Electrical Compartment B10", "Magnetron Power Supply Temperature bottom", "Magnetron Power Supply Temperature top", "Magnetron Temperature bottom", "Magnetron Temperature top", "Temperature LED handle side", "Temperature LED hinge side" {
            w92 = " Information not required for this device type"  # String {0}
            Concatenate Strings("[ℹ]", w92) -> w21
          }
        }
      }
    }
    call "Search and Replace Pattern.gvi"(String=w16, Muster="\"", Alle ersetzen=TRUE) -> (Ergebnis-String=w93)
    call "Trim Whitespace.gvi"(string=w93) -> (trimmed string=w94)
    call "Search and Replace Pattern.gvi"(String=w19, Muster="\"", Alle ersetzen=TRUE) -> (Ergebnis-String=w95)
    call "Trim Whitespace.gvi"(string=w95) -> (trimmed string=w96)
    String Length(string=w96) -> (length=w97)
    Is Greater(x=w97, y=10) -> w98
    case (w98) {
      frame False, Default {
        w99 = w96
      }
      frame True {
        String Subset(length (rest)=4, string=w96) -> w100
        String Subset(length (rest)=2, offset (0)=4, string=w96) -> w101
        String Subset(length (rest)=2, offset (0)=6, string=w96) -> w102
        String Subset(length (rest)=2, offset (0)=8, string=w96) -> w103
        String Subset(length (rest)=2, offset (0)=10, string=w96) -> w104
        String Subset(offset (0)=12, string=w96) -> w105
        Concatenate Strings(w100, ".", w101, ".", w102, " ", w103, ":", w104, ":", w105) -> w99
      }
    }
    call "Search and Replace Pattern.gvi"(String=w18, Muster="=\"", Alle ersetzen=TRUE) -> (Ergebnis-String=w106)
    call "Search and Replace Pattern.gvi"(String=w106, Muster="\"", Alle ersetzen=TRUE) -> (Ergebnis-String=w107)
    call "Trim Whitespace.gvi"(string=w107) -> (trimmed string=w108)
    call "Search and Replace Pattern.gvi"(String=w20, Muster="=\"", Alle ersetzen=TRUE) -> (Ergebnis-String=w109)
    call "Search and Replace Pattern.gvi"(String=w109, Muster="\"", Alle ersetzen=TRUE) -> (Ergebnis-String=w110)
    call "Trim Whitespace.gvi"(string=w110) -> (trimmed string=w111)
    Property Node(instance in=T2 {all zero or empty}, "Parameter Name"=w8, "Actual"=w13, "Dimension"=w94, "Limit"=w108, "maximum"=w111, "time_stamp"=w99, "comment"=w21) -> (instance out=w112)
    append w112 to w4
  }
  $Diagnostic_RT_Data_Sensors <- w4
  $"Output Error" <- w2
