vi "Interpret_Diagnostic_RT_Data_Sensors_Heating.gviweb"   [G Web Development Software 22.3.0]
inputs:
  "Diagnostic Settings Entrys": string[]
  "Error input": error
  "Device Type": string = "Device"
outputs:
  "Output Error": error
  "Output": T1[]
panel controls:
  "Config File infos": string[]
types:
  T1 = cluster{"Parameter Name": string, "Actual": string, "Dimension": string, "comment": string}
uses:
  WebApp::Get_Config_ini_Part.gviweb
  NI::G Core::Strings::Search and Replace Pattern.gvi
  NI::G Core::Strings::Trim Whitespace.gvi
diagram:
  call "Get_Config_ini_Part.gviweb"(Ini Array=$"Config File infos", ini Part from Array=6, Error in=$"Error input") -> (Ini Part as Array=w1, Output Error=w2)
  for (after w1) {
    w3 = each element of $"Diagnostic Settings Entrys"
    Match Pattern(regular expression="actual=", string=w3) -> (after substring=w5, before substring=w6)
    call "Search and Replace Pattern.gvi"(String=w6, Muster="_", Ersetzungs-String=" ", Alle ersetzen=TRUE) -> (Ergebnis-String=w7)
    call "Trim Whitespace.gvi"(string=w7) -> (trimmed string=w8)
    Match Pattern(regular expression="dim=", string=w5) -> (after substring=w9, before substring=w10)
    call "Search and Replace Pattern.gvi"(String=w10, Muster="=\"", Alle ersetzen=TRUE) -> (Ergebnis-String=w11)
    call "Search and Replace Pattern.gvi"(String=w11, Muster="\"", Alle ersetzen=TRUE) -> (Ergebnis-String=w12)
    call "Trim Whitespace.gvi"(string=w12) -> (trimmed string=w13)
    case ($"Device Type") {
      frame "False", Default {
        w14 = "✅"
      }
      frame "2-XS", "2-XS P" {
        case (w8) {
          frame "False", Default {
            Decimal String To Number(default (0 I32)=0, string=w13) -> (number=w15)
            In Range And Coerce(lower limit=1, upper limit=614, x=w15) -> (In Range?=w16)
            case (w16) {
              frame False {
                w14 = "❌ Temperature not plausible, please check the sensor"
              }
              frame True {
                w14 = "✅"
              }
            }
          }
          frame "B109", "B110", "B111", "B112", "B113", "B114", "B115", "B116", "B117", "B118" {
            w17 = " Information not required for this device type"  # String {0}
            Concatenate Strings("[ℹ]", w17) -> w14
          }
        }
      }
      frame "2-S", "2-S P" {
        case (w8) {
          frame "False", Default {
            Decimal String To Number(default (0 I32)=0, string=w13) -> (number=w18)
            In Range And Coerce(lower limit=1, upper limit=614, x=w18) -> (In Range?=w19)
            case (w19) {
              frame False {
                w14 = "❌ Temperature not plausible, please check the sensor"
              }
              frame True {
                w14 = "✅"
              }
            }
          }
          frame "B113", "B114", "B115", "B116", "B117", "B118" {
            w20 = " Information not required for this device type"  # String {0}
            Concatenate Strings("[ℹ]", w20) -> w14
          }
        }
      }
      frame "L", "L P" {
        case (w8) {
          frame "False", Default {
            Decimal String To Number(default (0 I32)=0, string=w13) -> (number=w21)
            In Range And Coerce(lower limit=1, upper limit=614, x=w21) -> (In Range?=w22)
            case (w22) {
              frame False {
                w14 = "❌ Temperature not plausible, please check the sensor"
              }
              frame True {
                w14 = "✅"
              }
            }
          }
          frame "B113", "B114", "B115", "B116", "B117", "B118" {
            w23 = " Information not required for this device type"  # String {0}
            Concatenate Strings("[ℹ]", w23) -> w14
          }
          frame "Right Core Probe Temperature B311", "Right Core Probe Temperature B312", "Right Core Probe Temperature B313", "Right Core Probe Temperature B314", "Right Core Probe Temperature B315", "Right Core Probe Temperature B316", "Right Pan Temperature B211" {
            w24 = " Information not required for this device type"  # String {0}
            Concatenate Strings("[ℹ]", w24) -> w14
          }
        }
      }
      frame "XL", "XL P" {
        case (w8) {
          frame "False", Default {
            Decimal String To Number(default (0 I32)=0, string=w13) -> (number=w25)
            In Range And Coerce(lower limit=1, upper limit=614, x=w25) -> (In Range?=w26)
            case (w26) {
              frame False {
                w14 = "❌ Temperature not plausible, please check the sensor"
              }
              frame True {
                w14 = "✅"
              }
            }
          }
          frame "Right Core Probe Temperature B311", "Right Core Probe Temperature B312", "Right Core Probe Temperature B313", "Right Core Probe Temperature B314", "Right Core Probe Temperature B315", "Right Core Probe Temperature B316", "Right Pan Temperature B211" {
            w27 = " Information not required for this device type"  # String {0}
            Concatenate Strings("[ℹ]", w27) -> w14
          }
        }
      }
    }
    Match Pattern(regular expression="heat_request=", string=w9) -> (before substring=w28, match substring=w29)
    case (w29) {
      frame "False", Default {
        Match Pattern(regular expression="maximum=", string=w9) -> (before substring=w30)
      }
      frame "heat_request=" {
        w30 = w28
      }
    }
    call "Search and Replace Pattern.gvi"(String=w30, Muster="\"", Alle ersetzen=TRUE) -> (Ergebnis-String=w31)
    # w13: actual
    call "Trim Whitespace.gvi"(string=w31) -> (trimmed string=w32)
    Property Node(instance in=T1 {all zero or empty}, "Parameter Name"=w8, "Actual"=w13, "Dimension"=w32, "comment"=w14) -> (instance out=w33)
    append w33 to w4
  }
  $Output <- w4
  $"Output Error" <- w2
