vi "Interpret_Diagnostic_RT_Data_Sensors_Movement.gviweb"   [G Web Development Software 22.3.0]
inputs:
  "Diagnostic Settings mouvement Entrys": string[]
  "Device Type": string = "Device"
  "Error input": error
outputs:
  "Output Error": error
  "Output mouvement": T2[]
panel controls:
  "Config File infos": string[]
panel indicators:
  "Output": T1[]
types:
  T1 = cluster{"Parameter Name": string, "Down_Switch": string, "Status": string, "Up_Switch": string, "dim": string, "Comment": string}
  T2 = cluster{"Parameter Name": string, "Command": string, "Down_Switch": string, "Status": string, "Up_Switch": string, "dim": string, "Comment": string}
uses:
  WebApp::Get_Config_ini_Part.gviweb
  NI::G Core::Strings::Search and Replace Pattern.gvi
  NI::G Core::Strings::Trim Whitespace.gvi
diagram:
  call "Get_Config_ini_Part.gviweb"(Ini Array=$"Config File infos", ini Part from Array=6, Error in=$"Error input") -> (Ini Part as Array=w1, Output Error=w2)
  for (after $"Device Type") (after w1) {
    w3 = each element of $"Diagnostic Settings mouvement Entrys"
    Match Pattern(regular expression="Command=", string=w3) -> (after substring=w5, before substring=w6)
    Match Pattern(regular expression="Down_Switch=", string=w5) -> (after substring=w7, before substring=w8)
    Match Pattern(regular expression="Status=", string=w7) -> (after substring=w9, before substring=w10)
    call "Search and Replace Pattern.gvi"(String=w10, Muster="\"", Alle ersetzen=TRUE) -> (Ergebnis-String=w11)
    call "Search and Replace Pattern.gvi"(String=w6, Muster="_", Ersetzungs-String=" ", Alle ersetzen=TRUE) -> (Ergebnis-String=w12)
    call "Search and Replace Pattern.gvi"(String=w12, Muster="\"", Alle ersetzen=TRUE) -> (Ergebnis-String=w13)
    call "Trim Whitespace.gvi"(string=w13) -> (trimmed string=w14)
    Match Pattern(regular expression="Up_Switch=", string=w9) -> (after substring=w15, before substring=w16)
    call "Search and Replace Pattern.gvi"(String=w16, Muster="\"", Alle ersetzen=TRUE) -> (Ergebnis-String=w17)
    call "Search and Replace Pattern.gvi"(String=w8, Muster="\"", Alle ersetzen=TRUE) -> (Ergebnis-String=w18)
    call "Trim Whitespace.gvi"(string=w18) -> (trimmed string=w19)
    case (w14) {
      frame "False", Default {
        w20 = "✅"
      }
      frame "PT1 Potentiometer", "PT2 Potentiometer" {
        Floating Point String To Number(default (0 DBL)=0, string=w17, use system decimal point (T)=TRUE) -> (number=w21)
        Is Greater(x=w21, y=65000) -> w22
        case (w22) {
          frame False, Default {
            w20 = "✅"
          }
          frame True {
            w20 = "❌ Potentiometer is disconnected or broken !"
          }
        }
      }
    }
    Match Pattern(regular expression="dim=", string=w15) -> (after substring=w23, before substring=w24)
    call "Search and Replace Pattern.gvi"(String=w24, Muster="\"", Alle ersetzen=TRUE) -> (Ergebnis-String=w25)
    call "Search and Replace Pattern.gvi"(String=w23, Muster="\"", Alle ersetzen=TRUE) -> (Ergebnis-String=w26)
    Property Node(instance in=T2 {all zero or empty}, "Parameter Name"=w14, "Command"=w19, "Down_Switch"=w11, "Status"=w17, "Up_Switch"=w25, "dim"=w26, "Comment"=w20) -> (instance out=w27)
    append w27 to w4
  }
  $"Output mouvement" <- w4
  $"Output Error" <- w2
