vi "Interpret_Diagnostic_Service_History.gviweb"   [G Web Development Software 22.3.0]
inputs:
  "Diagnostic Service History Entrys": string[]
  "Error Cluster input": error
  "Device Type": string = "Device"
outputs:
  "Error Output": error
  "Diagnostic Service History Output": T1[]
types:
  T1 = cluster{"Parameter Name": string, "First Time": string, "Last Time": string, "Quantity": string, "Comment": string}
uses:
  NI::G Core::Strings::Trim Whitespace.gvi
  NI::G Core::Strings::Search and Replace Pattern.gvi
  WebApp::Change_to_validate_Date.gvi
diagram:
  for {
    w1 = each element of $"Diagnostic Service History Entrys"
    Match Pattern(regular expression="First_Time=", string=w1) -> (after substring=w3, before substring=w4)
    call "Trim Whitespace.gvi"(string=w4) -> (trimmed string=w5)
    Match Pattern(regular expression=" Last_Time=", string=w3) -> (after substring=w6, before substring=w7)
    call "Search and Replace Pattern.gvi"(String=w7, Muster="\"", Alle ersetzen=TRUE) -> (Ergebnis-String=w8)
    call "Trim Whitespace.gvi"(string=w8) -> (trimmed string=w9)
    call "Change_to_validate_Date.gvi"(Date_Time_String input=w9, Error Cluster input=$"Error Cluster input") -> (Validate date and time=w10, Error Cluster output=w11)
    Match Pattern(regular expression="Quantity=", string=w6) -> (after substring=w12, before substring=w13)
    call "Search and Replace Pattern.gvi"(String=w13, Muster="\"", Alle ersetzen=TRUE) -> (Ergebnis-String=w14)
    call "Trim Whitespace.gvi"(string=w14) -> (trimmed string=w15)
    call "Change_to_validate_Date.gvi"(Date_Time_String input=w15, Error Cluster input=w11) -> (Validate date and time=w16, Error Cluster output=w17)
    call "Search and Replace Pattern.gvi"(String=w12, Muster="\"", Alle ersetzen=TRUE) -> (Ergebnis-String=w18)
    call "Trim Whitespace.gvi"(string=w18) -> (trimmed string=w19)
    Property Node(instance in=T1 {all zero or empty}, "Parameter Name"=w5, "First Time"=w10, "Last Time"=w16, "Quantity"=w19) -> (instance out=w20)
    append w20 to w2
  }
  s1 = T1[] []  # shift register
  for {
    w21 = each element of w2
    Property Node(instance in=w21) -> ("Quantity"=w22)
    Floating Point String To Number(default (0 DBL)=0, string=w22, use system decimal point (T)=TRUE) -> (number=w23)
    Is Greater Or Equal(x=w23, y=1) -> w24
    case (w24) {
      frame False, Default {
        w25 = s1
      }
      frame True {
        Insert Into Array(inArray=s1, new=w21) -> w25
      }
    }
    next s1 = w25
  }
  for {
    w26 = each element of s1
    Property Node(instance in=w26) -> ("Quantity"=w28, "Comment"=w29)
    Floating Point String To Number(default (0 DBL)=0, string=w28, use system decimal point (T)=TRUE) -> (number=w30)
    Is Greater Or Equal(x=w30, y=10) -> w31
    case (w31) {
      frame False, Default {
        w32 = w26
        w33 = w29
      }
      frame True {
        Is Greater Or Equal(x=w30, y=20) -> w34
        case (w34) {
          frame False, Default {
            w35 = "❌"  # String {0}
            Concatenate Strings(w35, " ", "The quantity exceeds 10!") -> w36
            Property Node(instance in=w26, "Comment"=w36) -> ("Comment"=w33)
          }
          frame True {
            w37 = "❌"  # String {0}
            Concatenate Strings(w37, " ", "The quantity exceeds 25!") -> w38
            Property Node(instance in=w26, "Comment"=w38) -> ("Comment"=w33)
          }
        }
        w32 = w26
      }
    }
    Property Node(instance in=w32, "Comment"=w33) -> (instance out=w39)
    append w39 to w27
  }
  $"Diagnostic Service History Output" <- w27
  $"Error Output" <- w17
