vi "Interpret_Diagnostic_Water_iCS_Switch.gviweb"   [G Web Development Software 22.3.0]
inputs:
  "Error Cluster input": error
  "Diagnostic Water iCS Switch Entrys": string[]
  "Device Type": string = "Device"
outputs:
  "Diagnostic Water iCS Switch Output": T1[]
  "Output_Error": error
types:
  T1 = cluster{"Parameter Name": string, "Status": string, "Dimension": string, "Comment": string}
uses:
  NI::G Core::Strings::Search and Replace Pattern.gvi
  NI::G Core::Strings::Trim Whitespace.gvi
diagram:
  # 0: Reference Volume Steam Generator
  # 0: Fill
  s1 = 0  # shift register
  s2 = 0  # shift register
  for {
    w1 = each element of $"Diagnostic Water iCS Switch Entrys"
    # s1: Norm
    # s2: Fill
    Match Pattern(regular expression="Status=", string=w1) -> (after substring=w3, before substring=w4)
    call "Search and Replace Pattern.gvi"(String=w4, Muster="_", Ersetzungs-String=" ", Alle ersetzen=TRUE) -> (Ergebnis-String=w5)
    call "Trim Whitespace.gvi"(string=w5) -> (trimmed string=w6)
    Match Pattern(regular expression="dim=", string=w3) -> (after substring=w7, before substring=w8)
    call "Search and Replace Pattern.gvi"(String=w8, Muster="\"", Alle ersetzen=TRUE) -> (Ergebnis-String=w9)
    call "Trim Whitespace.gvi"(string=w9) -> (trimmed string=w10)
    call "Search and Replace Pattern.gvi"(String=w7, Muster="\"", Alle ersetzen=TRUE) -> (Ergebnis-String=w11)
    call "Trim Whitespace.gvi"(string=w11) -> (trimmed string=w12)
    case ($"Device Type") {
      frame "False", Default {
        w13 = $"Error Cluster input"
        w14 = "✅"
        w15 = s1
        w16 = s2
      }
      frame "623", "E523" {
        case (w6) {
          frame "False", Default {
            w13 = $"Error Cluster input"
            w14 = "✅"
            w15 = s1
            w16 = s2
          }
          frame "Solenoid Valve Care Y4", "Solenoid Valve Control Y2", "Solenoid Valve Filling Y1", "Solenoid Valve Moistening Y3" {
            Concatenate Strings("✅: ", "Value is available.") -> w14
            w13 = $"Error Cluster input"
            w15 = s1
            w16 = s2
          }
          frame "Active Pump", "Active RPM", "Gas blower Hot Air1 M8", "Gas blower Hot Air2 M10", "Gas blower Steam M9", "Gas valve Hot Air 1 Y12", "Gas valve Hot Air 2 Y13", "Gas valve Steam Y11", "Hot Air Bottom Flame Current", "Hot Air Bottom Heat Request", "Hot Air Top Flame Current", "Hot Air Top Heat Request", "Magnetron Cooling Fan bottom", "Magnetron Cooling Fan top", "Magnetron Safety Chain top", "Microwave Anode current bottom", "Microwave Anode current top", "Microwave Heating Voltage bottom", "Microwave Heating Voltage top", "Microwave High Voltage actual bottom", "Microwave High Voltage actual top", "Microwave Target bottom", "Microwave Target top", "Motor Floor M22", "Motor TableFloor M16", "Solenoid Valve Flush Y14", "Steam Flame Current", "Steam Heat Request" {
            w17 = " Information not required for this device type"  # String {0}
            Concatenate Strings("[ℹ]", w17) -> w14
            w13 = $"Error Cluster input"
            w15 = s1
            w16 = s2
          }
          frame "Reference Volume Steam Generator" {
            Floating Point String To Number(default (0 DBL)=0, string=w10, use system decimal point (T)=TRUE) -> (number=w15)
            Multiply(1.9, 1.1) -> w18
            Multiply(1.9, 0.9) -> w19
            In Range And Coerce(lower limit=w19, upper limit=w18, x=w15) -> (In Range?=w20)
            # E623_Volume_Steam_Generator_Norm = 1.9
            case (w20) {
              frame False, Default {
                Number To Fractional String(number=1.9, use system decimal point (T)=TRUE) -> (F-format string=w21)
                w22 = "❌"  # String {0}
                Concatenate Strings(w22, " ", w6, " ", "is out of range !", "\r", "Nominal volume: ", w21, " L") -> w14
              }
              frame True {
                Number To Fractional String(number=1.9, precision (6)=1, use system decimal point (T)=TRUE) -> (F-format string=w23)
                Concatenate Strings("✅", " Nominal volume: ", w23, " L") -> w14
              }
            }
            w13 = $"Error Cluster input"
            w16 = s2
          }
          frame "Actual Filling Volume Steam Generator" {
            Floating Point String To Number(default (0 DBL)=0, string=w10, use system decimal point (T)=TRUE) -> (number=w16)
            Multiply(s1, 0.2) -> w24
            Add(w24, s1) -> w25
            Subtract(x=s1, y=w24) -> w26
            In Range And Coerce(lower limit=w26, upper limit=w25, x=w16) -> (In Range?=w27)
            case (w27) {
              frame False, Default {
                w28 = "❌"  # String {0}
                Concatenate Strings(w28, " ", w6, " ", "doesn't fit to the norm level") -> w14
              }
              frame True {
                Concatenate Strings("✅ ", w6, "is OK:", "\r", "In relation to the reference volume steam generator.") -> w14
              }
            }
            w13 = $"Error Cluster input"
            w15 = s1
          }
          frame "Level Electrode S2 Threshold" {
            Floating Point String To Number(default (0 DBL)=0, string=w10, use system decimal point (T)=TRUE) -> (number=w29)
            In Range And Coerce(lower limit=500, upper limit=2000, x=w29) -> (In Range?=w30)
            case (w30) {
              frame False, Default {
                w31 = "❌"  # String {0}
                Concatenate Strings(w31, " ", w6, " ", "is out of range!") -> w14
              }
              frame True {
                w14 = "✅ "
              }
            }
            w13 = $"Error Cluster input"
            w15 = s1
            w16 = s2
          }
          frame "Level Electrode S2 Current  Value" {
            Floating Point String To Number(default (0 DBL)=0, string=w10, use system decimal point (T)=TRUE) -> (number=w32)
            In Range And Coerce(lower limit=0, upper limit=3000, x=w32) -> (In Range?=w33)
            case (w33) {
              frame False, Default {
                w34 = "❌"  # String {0}
                Concatenate Strings(w34, " ", w6, " ", "is out of range!") -> w14
              }
              frame True {
                w14 = "✅ "
              }
            }
            w13 = $"Error Cluster input"
            w15 = s1
            w16 = s2
          }
          frame "CalcCheck Volume Steam Generator" {
            Floating Point String To Number(default (0 DBL)=0, string=w10, use system decimal point (T)=TRUE) -> (number=w35)
            Is Greater(x=w35, y=s2) -> w36
            Divide(x=s2, y=w35) -> w37
            Is Less(x=w37, y=1.08) -> w38
            Logical Or(w38, w36) -> w39
            case (w39) {
              frame True {
                w40 = "❌"  # String {0}
                Concatenate Strings(w40, " ", "Too much calc in the steam generator!") -> w14
              }
              frame False {
                w14 = "✅"
              }
            }
            w13 = $"Error Cluster input"
            w15 = s1
            w16 = s2
          }
        }
      }
      frame "E61" {
        case (w6) {
          frame "False", Default {
            w13 = $"Error Cluster input"
            w14 = "✅"
            w15 = s1
            w16 = s2
          }
          frame "Ball Valve Motor M7", "Care Pump XS M18", "CleanJet Pump XS M6", "Gas blower Hot Air1 M8", "Gas blower Hot Air2 M10", "Gas blower Steam M9", "Gas valve Hot Air 1 Y12", "Gas valve Hot Air 2 Y13", "Gas valve Steam Y11", "Hot Air Bottom Flame Current", "Hot Air Bottom Heat Request", "Hot Air Top Flame Current", "Hot Air Top Heat Request", "Magnetron Cooling Fan bottom", "Magnetron Cooling Fan top", "Magnetron Safety Chain bottom", "Magnetron Safety Chain top", "Microwave Anode current bottom", "Microwave Anode current top", "Microwave Heating Voltage bottom", "Microwave Heating Voltage top", "Microwave High Voltage actual bottom", "Microwave High Voltage actual top", "Microwave Target bottom", "Microwave Target top", "Motor Floor M22", "Motor TableFloor M16", "SC Pump XS M4", "Steam Flame Current", "Steam Heat Request" {
            w41 = " Information not required for this device type"  # String {0}
            Concatenate Strings("[ℹ]", w41) -> w14
            w13 = $"Error Cluster input"
            w15 = s1
            w16 = s2
          }
          frame "Reference Volume Steam Generator" {
            Floating Point String To Number(default (0 DBL)=0, string=w10, use system decimal point (T)=TRUE) -> (number=w15)
            Multiply(3.9, 1.1) -> w42
            Multiply(3.9, 0.9) -> w43
            In Range And Coerce(lower limit=w43, upper limit=w42, x=w15) -> (In Range?=w44)
            # E61_Volume_Steam_Generator_Norm = 3.9
            case (w44) {
              frame False, Default {
                Number To Fractional String(number=3.9, precision (6)=1, use system decimal point (T)=TRUE) -> (F-format string=w45)
                w46 = "❌"  # String {0}
                Concatenate Strings(w46, " ", w6, " ", "is out of range !", "\r", "Nominal volume: ", w45, " L") -> w14
              }
              frame True {
                Number To Fractional String(number=3.9, use system decimal point (T)=TRUE) -> (F-format string=w47)
                Concatenate Strings("✅", " Nominal volume: ", w47, "L") -> w14
              }
            }
            w13 = $"Error Cluster input"
            w16 = s2
          }
          frame "Actual Filling Volume Steam Generator" {
            Floating Point String To Number(default (0 DBL)=0, string=w10, use system decimal point (T)=TRUE) -> (number=w16)
            Multiply(s1, 0.2) -> w48
            Add(w48, s1) -> w49
            Subtract(x=s1, y=w48) -> w50
            In Range And Coerce(lower limit=w50, upper limit=w49, x=w16) -> (In Range?=w51)
            case (w51) {
              frame False, Default {
                w52 = "❌"  # String {0}
                Concatenate Strings(w52, " ", w6, " ", "doesn't fit to the norm level") -> w14
              }
              frame True {
                Concatenate Strings("✅ ", w6, "is OK:", "\r", "In relation to the reference volume steam generator.") -> w14
              }
            }
            w13 = $"Error Cluster input"
            w15 = s1
          }
          frame "Level Electrode S2 Threshold" {
            Floating Point String To Number(default (0 DBL)=0, string=w10, use system decimal point (T)=TRUE) -> (number=w53)
            In Range And Coerce(lower limit=500, upper limit=2000, x=w53) -> (In Range?=w54)
            case (w54) {
              frame False, Default {
                w55 = "❌"  # String {0}
                Concatenate Strings(w55, " ", w6, " ", "is out of range!") -> w14
              }
              frame True {
                w14 = "✅ "
              }
            }
            w13 = $"Error Cluster input"
            w15 = s1
            w16 = s2
          }
          frame "Level Electrode S2 Current  Value" {
            Floating Point String To Number(default (0 DBL)=0, string=w10, use system decimal point (T)=TRUE) -> (number=w56)
            In Range And Coerce(lower limit=0, upper limit=3000, x=w56) -> (In Range?=w57)
            case (w57) {
              frame False, Default {
                w58 = "❌"  # String {0}
                Concatenate Strings(w58, " ", w6, " ", "is out of range!") -> w14
              }
              frame True {
                w14 = "✅ "
              }
            }
            w13 = $"Error Cluster input"
            w15 = s1
            w16 = s2
          }
          frame "CalcCheck Volume Steam Generator" {
            Floating Point String To Number(default (0 DBL)=0, string=w10, use system decimal point (T)=TRUE) -> (number=w59)
            Is Greater(x=w59, y=s2) -> w60
            Divide(x=s2, y=w59) -> w61
            Is Less(x=w61, y=1.08) -> w62
            Logical Or(w62, w60) -> w63
            case (w63) {
              frame True {
                w64 = "❌"  # String {0}
                Concatenate Strings(w64, " ", "Too much calc in the steam generator!") -> w14
              }
              frame False {
                w14 = "✅"
              }
            }
            w13 = $"Error Cluster input"
            w15 = s1
            w16 = s2
          }
        }
      }
      frame "E62" {
        case (w6) {
          frame "False", Default {
            w13 = $"Error Cluster input"
            w14 = "✅"
            w15 = s1
            w16 = s2
          }
          frame "Ball Valve Motor M7", "Care Pump XS M18", "CleanJet Pump XS M6", "Gas blower Hot Air1 M8", "Gas blower Hot Air2 M10", "Gas blower Steam M9", "Gas valve Hot Air 1 Y12", "Gas valve Hot Air 2 Y13", "Gas valve Steam Y11", "Hot Air Bottom Flame Current", "Hot Air Bottom Heat Request", "Hot Air Top Flame Current", "Hot Air Top Heat Request", "Magnetron Cooling Fan bottom", "Magnetron Cooling Fan top", "Magnetron Safety Chain bottom", "Magnetron Safety Chain top", "Microwave Anode current bottom", "Microwave Anode current top", "Microwave Heating Voltage bottom", "Microwave Heating Voltage top", "Microwave High Voltage actual bottom", "Microwave High Voltage actual top", "Microwave Target bottom", "Microwave Target top", "Motor Floor M22", "Motor TableFloor M16", "SC Pump XS M4", "Steam Flame Current", "Steam Heat Request" {
            w65 = " Information not required for this device type"  # String {0}
            Concatenate Strings("[ℹ]", w65) -> w14
            w13 = $"Error Cluster input"
            w15 = s1
            w16 = s2
          }
          frame "Reference Volume Steam Generator" {
            Floating Point String To Number(default (0 DBL)=0, string=w10, use system decimal point (T)=TRUE) -> (number=w15)
            Multiply(7.5, 1.1) -> w66
            Multiply(7.5, 0.9) -> w67
            In Range And Coerce(lower limit=w67, upper limit=w66, x=w15) -> (In Range?=w68)
            # E62_Volume_Steam_Generator_Norm = 7.5
            case (w68) {
              frame False, Default {
                Number To Fractional String(number=7.5, precision (6)=1, use system decimal point (T)=TRUE) -> (F-format string=w69)
                w70 = "❌"  # String {0}
                Concatenate Strings(w70, " ", w6, " ", "is out of range !", "\r", "Nominal volume: ", w69, " L") -> w14
              }
              frame True {
                Number To Fractional String(number=7.5, use system decimal point (T)=TRUE) -> (F-format string=w71)
                Concatenate Strings("✅", " Nominal volume: ", w71) -> w14
              }
            }
            w13 = $"Error Cluster input"
            w16 = s2
          }
          frame "Actual Filling Volume Steam Generator" {
            Floating Point String To Number(default (0 DBL)=0, string=w10, use system decimal point (T)=TRUE) -> (number=w16)
            Multiply(s1, 0.2) -> w72
            Add(w72, s1) -> w73
            Subtract(x=s1, y=w72) -> w74
            In Range And Coerce(lower limit=w74, upper limit=w73, x=w16) -> (In Range?=w75)
            case (w75) {
              frame False, Default {
                w76 = "❌"  # String {0}
                Concatenate Strings(w76, " ", w6, " ", "doesn't fit to the norm level") -> w14
              }
              frame True {
                Concatenate Strings("✅ ", w6, "is OK:", "\r", "In relation to the reference volume steam generator.") -> w14
              }
            }
            w13 = $"Error Cluster input"
            w15 = s1
          }
          frame "Level Electrode S2 Threshold" {
            Floating Point String To Number(default (0 DBL)=0, string=w10, use system decimal point (T)=TRUE) -> (number=w77)
            In Range And Coerce(lower limit=500, upper limit=2000, x=w77) -> (In Range?=w78)
            case (w78) {
              frame False, Default {
                w79 = "❌"  # String {0}
                Concatenate Strings(w79, " ", w6, " ", "is out of range!") -> w14
              }
              frame True {
                w14 = "✅ "
              }
            }
            w13 = $"Error Cluster input"
            w15 = s1
            w16 = s2
          }
          frame "Level Electrode S2 Current  Value" {
            Floating Point String To Number(default (0 DBL)=0, string=w10, use system decimal point (T)=TRUE) -> (number=w80)
            In Range And Coerce(lower limit=0, upper limit=3000, x=w80) -> (In Range?=w81)
            case (w81) {
              frame False, Default {
                w82 = "❌"  # String {0}
                Concatenate Strings(w82, " ", w6, " ", "is out of range!") -> w14
              }
              frame True {
                w14 = "✅ "
              }
            }
            w13 = $"Error Cluster input"
            w15 = s1
            w16 = s2
          }
          frame "CalcCheck Volume Steam Generator" {
            Floating Point String To Number(default (0 DBL)=0, string=w10, use system decimal point (T)=TRUE) -> (number=w83)
            Is Greater(x=w83, y=s2) -> w84
            Divide(x=s2, y=w83) -> w85
            Is Less(x=w85, y=1.08) -> w86
            Logical Or(w86, w84) -> w87
            case (w87) {
              frame True {
                w88 = "❌"  # String {0}
                Concatenate Strings(w88, " ", "Too much calc in the steam generator!") -> w14
              }
              frame False {
                w14 = "✅"
              }
            }
            w13 = $"Error Cluster input"
            w15 = s1
            w16 = s2
          }
        }
      }
      frame "E61T" {
        case (w6) {
          frame "False", Default {
            w13 = $"Error Cluster input"
            w14 = "✅"
            w15 = s1
            w16 = s2
          }
          frame "Ball Valve Motor M7", "Care Pump XS M18", "CleanJet Pump XS M6", "Gas blower Hot Air1 M8", "Gas blower Hot Air2 M10", "Gas blower Steam M9", "Gas valve Hot Air 1 Y12", "Gas valve Hot Air 2 Y13", "Gas valve Steam Y11", "Hot Air Bottom Flame Current", "Hot Air Bottom Heat Request", "Hot Air Top Flame Current", "Hot Air Top Heat Request", "Magnetron Cooling Fan bottom", "Magnetron Cooling Fan top", "Magnetron Safety Chain bottom", "Magnetron Safety Chain top", "Microwave Anode current bottom", "Microwave Anode current top", "Microwave Heating Voltage bottom", "Microwave Heating Voltage top", "Microwave High Voltage actual bottom", "Microwave High Voltage actual top", "Microwave Target bottom", "Microwave Target top", "Motor Floor M22", "Motor TableFloor M16", "SC Pump XS M4", "Steam Flame Current", "Steam Heat Request" {
            w89 = " Information not required for this device type"  # String {0}
            Concatenate Strings("[ℹ]", w89) -> w14
            w13 = $"Error Cluster input"
            w15 = s1
            w16 = s2
          }
          frame "Reference Volume Steam Generator" {
            Floating Point String To Number(default (0 DBL)=0, string=w10, use system decimal point (T)=TRUE) -> (number=w15)
            Multiply(3.9, 1.1) -> w90
            Multiply(3.9, 0.9) -> w91
            In Range And Coerce(lower limit=w91, upper limit=w90, x=w15) -> (In Range?=w92)
            # E61_Volume_Steam_Generator_Norm = 3.9
            case (w92) {
              frame False, Default {
                Number To Fractional String(number=3.9, use system decimal point (T)=TRUE) -> (F-format string=w93)
                w94 = "❌"  # String {0}
                Concatenate Strings(w94, " ", w6, " ", "is out of range !", "\r", "Nominal volume: ", w93, " L") -> w14
              }
              frame True {
                Number To Fractional String(number=3.9, precision (6)=1, use system decimal point (T)=TRUE) -> (F-format string=w95)
                Concatenate Strings("✅", " Nominal volume: ", w95, " L") -> w14
              }
            }
            w13 = $"Error Cluster input"
            w16 = s2
          }
          frame "Actual Filling Volume Steam Generator" {
            Floating Point String To Number(default (0 DBL)=0, string=w10, use system decimal point (T)=TRUE) -> (number=w16)
            Multiply(s1, 0.2) -> w96
            Add(w96, s1) -> w97
            Subtract(x=s1, y=w96) -> w98
            In Range And Coerce(lower limit=w98, upper limit=w97, x=w16) -> (In Range?=w99)
            case (w99) {
              frame False, Default {
                w100 = "❌"  # String {0}
                Concatenate Strings(w100, " ", w6, " ", "doesn't fit to the norm level") -> w14
              }
              frame True {
                Concatenate Strings("✅ ", w6, "is OK:", "\r", "In relation to the reference volume steam generator.") -> w14
              }
            }
            w13 = $"Error Cluster input"
            w15 = s1
          }
          frame "Level Electrode S2 Threshold" {
            Floating Point String To Number(default (0 DBL)=0, string=w10, use system decimal point (T)=TRUE) -> (number=w101)
            In Range And Coerce(lower limit=500, upper limit=2000, x=w101) -> (In Range?=w102)
            case (w102) {
              frame False, Default {
                w103 = "❌"  # String {0}
                Concatenate Strings(w103, " ", w6, " ", "is out of range!") -> w14
              }
              frame True {
                w14 = "✅ "
              }
            }
            w13 = $"Error Cluster input"
            w15 = s1
            w16 = s2
          }
          frame "Level Electrode S2 Current  Value" {
            Floating Point String To Number(default (0 DBL)=0, string=w10, use system decimal point (T)=TRUE) -> (number=w104)
            In Range And Coerce(lower limit=0, upper limit=3000, x=w104) -> (In Range?=w105)
            case (w105) {
              frame False, Default {
                w106 = "❌"  # String {0}
                Concatenate Strings(w106, " ", w6, " ", "is out of range!") -> w14
              }
              frame True {
                w14 = "✅ "
              }
            }
            w13 = $"Error Cluster input"
            w15 = s1
            w16 = s2
          }
          frame "CalcCheck Volume Steam Generator" {
            Floating Point String To Number(default (0 DBL)=0, string=w10, use system decimal point (T)=TRUE) -> (number=w107)
            Is Greater(x=w107, y=s2) -> w108
            Divide(x=s2, y=w107) -> w109
            Is Less(x=w109, y=1.08) -> w110
            Logical Or(w110, w108) -> w111
            case (w111) {
              frame True {
                w112 = "❌"  # String {0}
                Concatenate Strings(w112, " ", "Too much calc in the steam generator!") -> w14
              }
              frame False {
                w14 = "✅"
              }
            }
            w13 = $"Error Cluster input"
            w15 = s1
            w16 = s2
          }
        }
      }
      frame "G61" {
        case (w6) {
          frame "False", Default {
            w13 = $"Error Cluster input"
            w14 = "✅"
            w15 = s1
            w16 = s2
          }
          frame "Reference Volume Steam Generator" {
            Floating Point String To Number(default (0 DBL)=0, string=w10, use system decimal point (T)=TRUE) -> (number=w15)
            Multiply(4.4, 1.1) -> w113
            Multiply(4.4, 0.9) -> w114
            In Range And Coerce(lower limit=w114, upper limit=w113, x=w15) -> (In Range?=w115)
            # G61_Volume_Steam_Generator_Norm = 4.5
            case (w115) {
              frame False, Default {
                Number To Fractional String(number=4.4, use system decimal point (T)=TRUE) -> (F-format string=w116)
                w117 = "❌"  # String {0}
                Concatenate Strings(w117, " ", w6, " ", "is out of range !", "\r", "Nominal volume: ", w116, " L") -> w14
              }
              frame True {
                Number To Fractional String(number=4.4, precision (6)=1, use system decimal point (T)=TRUE) -> (F-format string=w118)
                Concatenate Strings("✅", " Nominal volume: ", w118, " L") -> w14
              }
            }
            w13 = $"Error Cluster input"
            w16 = s2
          }
          frame "Actual Filling Volume Steam Generator" {
            Floating Point String To Number(default (0 DBL)=0, string=w10, use system decimal point (T)=TRUE) -> (number=w16)
            Multiply(s1, 0.2) -> w119
            Add(w119, s1) -> w120
            Subtract(x=s1, y=w119) -> w121
            In Range And Coerce(lower limit=w121, upper limit=w120, x=w16) -> (In Range?=w122)
            case (w122) {
              frame False, Default {
                w123 = "❌"  # String {0}
                Concatenate Strings(w123, " ", w6, " ", "doesn't fit to the norm level") -> w14
              }
              frame True {
                Concatenate Strings("✅ ", w6, "is OK:", "\r", "In relation to the reference volume steam generator.") -> w14
              }
            }
            w13 = $"Error Cluster input"
            w15 = s1
          }
          frame "Level Electrode S2 Threshold" {
            Floating Point String To Number(default (0 DBL)=0, string=w10, use system decimal point (T)=TRUE) -> (number=w124)
            In Range And Coerce(lower limit=500, upper limit=2000, x=w124) -> (In Range?=w125)
            case (w125) {
              frame False, Default {
                w126 = "❌"  # String {0}
                Concatenate Strings(w126, " ", w6, " ", "is out of range!") -> w14
              }
              frame True {
                w14 = "✅ "
              }
            }
            w13 = $"Error Cluster input"
            w15 = s1
            w16 = s2
          }
          frame "Level Electrode S2 Current  Value" {
            Floating Point String To Number(default (0 DBL)=0, string=w10, use system decimal point (T)=TRUE) -> (number=w127)
            In Range And Coerce(lower limit=0, upper limit=3000, x=w127) -> (In Range?=w128)
            case (w128) {
              frame False, Default {
                w129 = "❌"  # String {0}
                Concatenate Strings(w129, " ", w6, " ", "is out of range!") -> w14
              }
              frame True {
                w14 = "✅ "
              }
            }
            w13 = $"Error Cluster input"
            w15 = s1
            w16 = s2
          }
          frame "CalcCheck Volume Steam Generator" {
            Floating Point String To Number(default (0 DBL)=0, string=w10, use system decimal point (T)=TRUE) -> (number=w130)
            Is Greater(x=w130, y=s2) -> w131
            Divide(x=s2, y=w130) -> w132
            Is Less(x=w132, y=1.08) -> w133
            Logical Or(w133, w131) -> w134
            case (w134) {
              frame True {
                w135 = "❌"  # String {0}
                Concatenate Strings(w135, " ", "Too much calc in the steam generator!") -> w14
              }
              frame False {
                w14 = "✅"
              }
            }
            w13 = $"Error Cluster input"
            w15 = s1
            w16 = s2
          }
          frame "Ball Valve Motor M7", "Care Pump XS M18", "CleanJet Pump XS M6", "Gas blower Hot Air2 M10", "Gas valve Hot Air 2 Y13", "Hot Air Bottom Flame Current", "Hot Air Bottom Heat Request", "Magnetron Cooling Fan bottom", "Magnetron Cooling Fan top", "Magnetron Safety Chain bottom", "Magnetron Safety Chain top", "Microwave Anode current bottom", "Microwave Anode current top", "Microwave Heating Voltage bottom", "Microwave Heating Voltage top", "Microwave High Voltage actual bottom", "Microwave High Voltage actual top", "Microwave Target bottom", "Microwave Target top", "Motor Floor M22", "Motor TableFloor M16", "SC Pump XS M4", "Steam Flame Current", "Steam Heat Request" {
            w136 = " Information not required for this device type"  # String {0}
            Concatenate Strings("[ℹ]", w136) -> w14
            w13 = $"Error Cluster input"
            w15 = s1
            w16 = s2
          }
        }
      }
      frame "G62" {
        case (w6) {
          frame "False", Default {
            w13 = $"Error Cluster input"
            w14 = "✅"
            w15 = s1
            w16 = s2
          }
          frame "Reference Volume Steam Generator" {
            Floating Point String To Number(default (0 DBL)=0, string=w10, use system decimal point (T)=TRUE) -> (number=w15)
            Multiply(7.5, 1.1) -> w137
            Multiply(7.5, 0.9) -> w138
            In Range And Coerce(lower limit=w138, upper limit=w137, x=w15) -> (In Range?=w139)
            # G62_Volume_Steam_Generator_Norm = 7.6
            case (w139) {
              frame False, Default {
                Number To Fractional String(number=7.5, use system decimal point (T)=TRUE) -> (F-format string=w140)
                w141 = "❌"  # String {0}
                Concatenate Strings(w141, " ", w6, " ", "is out of range !", "\r", "Nominal volume: ", w140, " L") -> w14
              }
              frame True {
                Number To Fractional String(number=7.5, precision (6)=1, use system decimal point (T)=TRUE) -> (F-format string=w142)
                Concatenate Strings("✅", " Nominal volume: ", w142, " L") -> w14
              }
            }
            w13 = $"Error Cluster input"
            w16 = s2
          }
          frame "Actual Filling Volume Steam Generator" {
            Floating Point String To Number(default (0 DBL)=0, string=w10, use system decimal point (T)=TRUE) -> (number=w16)
            Multiply(s1, 0.2) -> w143
            Add(w143, s1) -> w144
            Subtract(x=s1, y=w143) -> w145
            In Range And Coerce(lower limit=w145, upper limit=w144, x=w16) -> (In Range?=w146)
            case (w146) {
              frame False, Default {
                w147 = "❌"  # String {0}
                Concatenate Strings(w147, " ", w6, " ", "doesn't fit to the norm level") -> w14
              }
              frame True {
                Concatenate Strings("✅ ", w6, "is OK:", "\r", "In relation to the reference volume steam generator.") -> w14
              }
            }
            w13 = $"Error Cluster input"
            w15 = s1
          }
          frame "Level Electrode S2 Threshold" {
            Floating Point String To Number(default (0 DBL)=0, string=w10, use system decimal point (T)=TRUE) -> (number=w148)
            In Range And Coerce(lower limit=500, upper limit=2000, x=w148) -> (In Range?=w149)
            case (w149) {
              frame False, Default {
                w150 = "❌"  # String {0}
                Concatenate Strings(w150, " ", w6, " ", "is out of range!") -> w14
              }
              frame True {
                w14 = "✅ "
              }
            }
            w13 = $"Error Cluster input"
            w15 = s1
            w16 = s2
          }
          frame "Level Electrode S2 Current  Value" {
            Floating Point String To Number(default (0 DBL)=0, string=w10, use system decimal point (T)=TRUE) -> (number=w151)
            In Range And Coerce(lower limit=0, upper limit=3000, x=w151) -> (In Range?=w152)
            case (w152) {
              frame False, Default {
                w153 = "❌"  # String {0}
                Concatenate Strings(w153, " ", w6, " ", "is out of range!") -> w14
              }
              frame True {
                w14 = "✅ "
              }
            }
            w13 = $"Error Cluster input"
            w15 = s1
            w16 = s2
          }
          frame "CalcCheck Volume Steam Generator" {
            Floating Point String To Number(default (0 DBL)=0, string=w10, use system decimal point (T)=TRUE) -> (number=w154)
            Is Greater(x=w154, y=s2) -> w155
            Divide(x=s2, y=w154) -> w156
            Is Less(x=w156, y=1.08) -> w157
            Logical Or(w157, w155) -> w158
            case (w158) {
              frame True {
                w159 = "❌"  # String {0}
                Concatenate Strings(w159, " ", "Too much calc in the steam generator!") -> w14
              }
              frame False {
                w14 = "✅"
              }
            }
            w13 = $"Error Cluster input"
            w15 = s1
            w16 = s2
          }
          frame "Ball Valve Motor M7", "Care Pump XS M18", "CleanJet Pump XS M6", "Gas blower Hot Air2 M10", "Gas valve Hot Air 2 Y13", "Hot Air Bottom Flame Current", "Hot Air Bottom Heat Request", "Magnetron Cooling Fan bottom", "Magnetron Cooling Fan top", "Magnetron Safety Chain bottom", "Magnetron Safety Chain top", "Microwave Anode current bottom", "Microwave Anode current top", "Microwave Heating Voltage bottom", "Microwave Heating Voltage top", "Microwave High Voltage actual bottom", "Microwave High Voltage actual top", "Microwave Target bottom", "Microwave Target top", "Motor Floor M22", "Motor TableFloor M16", "SC Pump XS M4", "Steam Flame Current", "Steam Heat Request" {
            w160 = " Information not required for this device type"  # String {0}
            Concatenate Strings("[ℹ]", w160) -> w14
            w13 = $"Error Cluster input"
            w15 = s1
            w16 = s2
          }
        }
      }
      frame "E101" {
        case (w6) {
          frame "False", Default {
            w13 = $"Error Cluster input"
            w14 = "✅"
            w15 = s1
            w16 = s2
          }
          frame "Ball Valve Motor M7", "Care Pump XS M18", "CleanJet Pump XS M6", "Gas blower Hot Air1 M8", "Gas blower Hot Air2 M10", "Gas blower Steam M9", "Gas valve Hot Air 1 Y12", "Gas valve Hot Air 2 Y13", "Gas valve Steam Y11", "Hot Air Bottom Flame Current", "Hot Air Bottom Heat Request", "Hot Air Top Flame Current", "Hot Air Top Heat Request", "Magnetron Cooling Fan bottom", "Magnetron Cooling Fan top", "Magnetron Safety Chain bottom", "Magnetron Safety Chain top", "Microwave Anode current bottom", "Microwave Anode current top", "Microwave Heating Voltage bottom", "Microwave Heating Voltage top", "Microwave High Voltage actual bottom", "Microwave High Voltage actual top", "Microwave Target bottom", "Microwave Target top", "Motor Floor M22", "SC Pump XS M4", "Steam Flame Current", "Steam Heat Request" {
            w161 = " Information not required for this device type"  # String {0}
            Concatenate Strings("[ℹ]", w161) -> w14
            w13 = $"Error Cluster input"
            w15 = s1
            w16 = s2
          }
          frame "Reference Volume Steam Generator" {
            Floating Point String To Number(default (0 DBL)=0, string=w10, use system decimal point (T)=TRUE) -> (number=w15)
            Multiply(4, 1.1) -> w162
            Multiply(4, 0.9) -> w163
            In Range And Coerce(lower limit=w163, upper limit=w162, x=w15) -> (In Range?=w164)
            # E101_Volume_Steam_Generator_Norm = 3.8
            case (w164) {
              frame False, Default {
                Number To Fractional String(number=4, use system decimal point (T)=TRUE) -> (F-format string=w165)
                w166 = "❌"  # String {0}
                Concatenate Strings(w166, " ", w6, " ", "is out of range !", "\r", "Nominal volume: ", w165, " L") -> w14
              }
              frame True {
                Number To Fractional String(number=4, precision (6)=1, use system decimal point (T)=TRUE) -> (F-format string=w167)
                Concatenate Strings("✅", " Nominal volume: ", w167, " L") -> w14
              }
            }
            w13 = $"Error Cluster input"
            w16 = s2
          }
          frame "Actual Filling Volume Steam Generator" {
            Floating Point String To Number(default (0 DBL)=0, string=w10, use system decimal point (T)=TRUE) -> (number=w16)
            Multiply(s1, 0.2) -> w168
            Add(w168, s1) -> w169
            Subtract(x=s1, y=w168) -> w170
            In Range And Coerce(lower limit=w170, upper limit=w169, x=w16) -> (In Range?=w171)
            case (w171) {
              frame False, Default {
                w172 = "❌"  # String {0}
                Concatenate Strings(w172, " ", w6, " ", "doesn't fit to the norm level") -> w14
              }
              frame True {
                Concatenate Strings("✅ ", w6, "is OK:", "\r", "In relation to the reference volume steam generator.") -> w14
              }
            }
            w13 = $"Error Cluster input"
            w15 = s1
          }
          frame "Level Electrode S2 Threshold" {
            Floating Point String To Number(default (0 DBL)=0, string=w10, use system decimal point (T)=TRUE) -> (number=w173)
            In Range And Coerce(lower limit=500, upper limit=2000, x=w173) -> (In Range?=w174)
            case (w174) {
              frame False, Default {
                w175 = "❌"  # String {0}
                Concatenate Strings(w175, " ", w6, " ", "is out of range!") -> w14
              }
              frame True {
                w14 = "✅ "
              }
            }
            w13 = $"Error Cluster input"
            w15 = s1
            w16 = s2
          }
          frame "Level Electrode S2 Current  Value" {
            Floating Point String To Number(default (0 DBL)=0, string=w10, use system decimal point (T)=TRUE) -> (number=w176)
            In Range And Coerce(lower limit=0, upper limit=3000, x=w176) -> (In Range?=w177)
            case (w177) {
              frame False, Default {
                w178 = "❌"  # String {0}
                Concatenate Strings(w178, " ", w6, " ", "is out of range!") -> w14
              }
              frame True {
                w14 = "✅ "
              }
            }
            w13 = $"Error Cluster input"
            w15 = s1
            w16 = s2
          }
          frame "CalcCheck Volume Steam Generator" {
            Floating Point String To Number(default (0 DBL)=0, string=w10, use system decimal point (T)=TRUE) -> (number=w179)
            Is Greater(x=w179, y=s2) -> w180
            Divide(x=s2, y=w179) -> w181
            Is Less(x=w181, y=1.08) -> w182
            Logical Or(w182, w180) -> w183
            case (w183) {
              frame True {
                w184 = "❌"  # String {0}
                Concatenate Strings(w184, " ", "Too much calc in the steam generator!") -> w14
              }
              frame False {
                w14 = "✅"
              }
            }
            w13 = $"Error Cluster input"
            w15 = s1
            w16 = s2
          }
        }
      }
      frame "E102" {
        case (w6) {
          frame "False", Default {
            w13 = $"Error Cluster input"
            w14 = "✅"
            w15 = s1
            w16 = s2
          }
          frame "Ball Valve Motor M7", "Care Pump XS M18", "CleanJet Pump XS M6", "Gas blower Hot Air1 M8", "Gas blower Hot Air2 M10", "Gas blower Steam M9", "Gas valve Hot Air 1 Y12", "Gas valve Hot Air 2 Y13", "Gas valve Steam Y11", "Hot Air Bottom Flame Current", "Hot Air Bottom Heat Request", "Hot Air Top Flame Current", "Hot Air Top Heat Request", "Magnetron Cooling Fan bottom", "Magnetron Cooling Fan top", "Magnetron Safety Chain bottom", "Magnetron Safety Chain top", "Microwave Anode current bottom", "Microwave Anode current top", "Microwave Heating Voltage bottom", "Microwave Heating Voltage top", "Microwave High Voltage actual bottom", "Microwave High Voltage actual top", "Microwave Target bottom", "Microwave Target top", "Motor Floor M22", "SC Pump XS M4", "Steam Flame Current", "Steam Heat Request" {
            w185 = " Information not required for this device type"  # String {0}
            Concatenate Strings("[ℹ]", w185) -> w14
            w13 = $"Error Cluster input"
            w15 = s1
            w16 = s2
          }
          frame "Reference Volume Steam Generator" {
            Floating Point String To Number(default (0 DBL)=0, string=w10, use system decimal point (T)=TRUE) -> (number=w15)
            Multiply(9.5, 1.1) -> w186
            Multiply(9.5, 0.9) -> w187
            In Range And Coerce(lower limit=w187, upper limit=w186, x=w15) -> (In Range?=w188)
            # E102_Volume_Steam_Generator_Norm = 9.5
            case (w188) {
              frame False, Default {
                Number To Fractional String(number=9.5, use system decimal point (T)=TRUE) -> (F-format string=w189)
                w190 = "❌"  # String {0}
                Concatenate Strings(w190, " ", w6, " ", "is out of range !", "\r", "Nominal volume: ", w189, " L") -> w14
              }
              frame True {
                Number To Fractional String(number=9.5, precision (6)=1, use system decimal point (T)=TRUE) -> (F-format string=w191)
                Concatenate Strings("✅", " Nominal volume: ", w191, " L") -> w14
              }
            }
            w13 = $"Error Cluster input"
            w16 = s2
          }
          frame "Actual Filling Volume Steam Generator" {
            Floating Point String To Number(default (0 DBL)=0, string=w10, use system decimal point (T)=TRUE) -> (number=w16)
            Multiply(s1, 0.2) -> w192
            Add(w192, s1) -> w193
            Subtract(x=s1, y=w192) -> w194
            In Range And Coerce(lower limit=w194, upper limit=w193, x=w16) -> (In Range?=w195)
            case (w195) {
              frame False, Default {
                w196 = "❌"  # String {0}
                Concatenate Strings(w196, " ", w6, " ", "doesn't fit to the norm level") -> w14
              }
              frame True {
                Concatenate Strings("✅ ", w6, "is OK:", "\r", "In relation to the reference volume steam generator.") -> w14
              }
            }
            w13 = $"Error Cluster input"
            w15 = s1
          }
          frame "Level Electrode S2 Threshold" {
            Floating Point String To Number(default (0 DBL)=0, string=w10, use system decimal point (T)=TRUE) -> (number=w197)
            In Range And Coerce(lower limit=500, upper limit=2000, x=w197) -> (In Range?=w198)
            case (w198) {
              frame False, Default {
                w199 = "❌"  # String {0}
                Concatenate Strings(w199, " ", w6, " ", "is out of range!") -> w14
              }
              frame True {
                w14 = "✅ "
              }
            }
            w13 = $"Error Cluster input"
            w15 = s1
            w16 = s2
          }
          frame "Level Electrode S2 Current  Value" {
            Floating Point String To Number(default (0 DBL)=0, string=w10, use system decimal point (T)=TRUE) -> (number=w200)
            In Range And Coerce(lower limit=0, upper limit=3000, x=w200) -> (In Range?=w201)
            case (w201) {
              frame False, Default {
                w202 = "❌"  # String {0}
                Concatenate Strings(w202, " ", w6, " ", "is out of range!") -> w14
              }
              frame True {
                w14 = "✅ "
              }
            }
            w13 = $"Error Cluster input"
            w15 = s1
            w16 = s2
          }
          frame "CalcCheck Volume Steam Generator" {
            Floating Point String To Number(default (0 DBL)=0, string=w10, use system decimal point (T)=TRUE) -> (number=w203)
            Is Greater(x=w203, y=s2) -> w204
            Divide(x=s2, y=w203) -> w205
            Is Less(x=w205, y=1.08) -> w206
            Logical Or(w206, w204) -> w207
            case (w207) {
              frame True {
                w208 = "❌"  # String {0}
                Concatenate Strings(w208, " ", "Too much calc in the steam generator!") -> w14
              }
              frame False {
                w14 = "✅"
              }
            }
            w13 = $"Error Cluster input"
            w15 = s1
            w16 = s2
          }
        }
      }
      frame "G101" {
        case (w6) {
          frame "False", Default {
            w13 = $"Error Cluster input"
            w14 = "✅"
            w15 = s1
            w16 = s2
          }
          frame "Ball Valve Motor M7", "Care Pump XS M18", "CleanJet Pump XS M6", "Gas blower Hot Air2 M10", "Gas valve Hot Air 2 Y13", "Hot Air Bottom Flame Current", "Hot Air Bottom Heat Request", "Magnetron Cooling Fan bottom", "Magnetron Cooling Fan top", "Magnetron Safety Chain bottom", "Magnetron Safety Chain top", "Microwave Anode current bottom", "Microwave Anode current top", "Microwave Heating Voltage bottom", "Microwave Heating Voltage top", "Microwave High Voltage actual bottom", "Microwave High Voltage actual top", "Microwave Target bottom", "Microwave Target top", "Motor Floor M22", "SC Pump XS M4" {
            w209 = " Information not required for this device type"  # String {0}
            Concatenate Strings("[ℹ]", w209) -> w14
            w13 = $"Error Cluster input"
            w15 = s1
            w16 = s2
          }
          frame "Reference Volume Steam Generator" {
            Floating Point String To Number(default (0 DBL)=0, string=w10, use system decimal point (T)=TRUE) -> (number=w15)
            Multiply(8, 1.1) -> w210
            Multiply(8, 0.9) -> w211
            In Range And Coerce(lower limit=w211, upper limit=w210, x=w15) -> (In Range?=w212)
            # G101_Volume_Steam_Generator_Norm = 8.4
            case (w212) {
              frame False, Default {
                Number To Fractional String(number=8, use system decimal point (T)=TRUE) -> (F-format string=w213)
                w214 = "❌"  # String {0}
                Concatenate Strings(w214, " ", w6, " ", "is out of range !", "\r", "Nominal volume: ", w213, " L") -> w14
              }
              frame True {
                Number To Fractional String(number=8, precision (6)=1, use system decimal point (T)=TRUE) -> (F-format string=w215)
                Concatenate Strings("✅", " Nominal volume: ", w215, " L") -> w14
              }
            }
            w13 = $"Error Cluster input"
            w16 = s2
          }
          frame "Actual Filling Volume Steam Generator" {
            Floating Point String To Number(default (0 DBL)=0, string=w10, use system decimal point (T)=TRUE) -> (number=w16)
            Multiply(s1, 0.2) -> w216
            Add(w216, s1) -> w217
            Subtract(x=s1, y=w216) -> w218
            In Range And Coerce(lower limit=w218, upper limit=w217, x=w16) -> (In Range?=w219)
            case (w219) {
              frame False, Default {
                w220 = "❌"  # String {0}
                Concatenate Strings(w220, " ", w6, " ", "doesn't fit to the norm level") -> w14
              }
              frame True {
                Concatenate Strings("✅ ", w6, "is OK:", "\r", "In relation to the reference volume steam generator.") -> w14
              }
            }
            w13 = $"Error Cluster input"
            w15 = s1
          }
          frame "Level Electrode S2 Threshold" {
            Floating Point String To Number(default (0 DBL)=0, string=w10, use system decimal point (T)=TRUE) -> (number=w221)
            In Range And Coerce(lower limit=500, upper limit=2000, x=w221) -> (In Range?=w222)
            case (w222) {
              frame False, Default {
                w223 = "❌"  # String {0}
                Concatenate Strings(w223, " ", w6, " ", "is out of range!") -> w14
              }
              frame True {
                w14 = "✅ "
              }
            }
            w13 = $"Error Cluster input"
            w15 = s1
            w16 = s2
          }
          frame "Level Electrode S2 Current  Value" {
            Floating Point String To Number(default (0 DBL)=0, string=w10, use system decimal point (T)=TRUE) -> (number=w224)
            In Range And Coerce(lower limit=0, upper limit=3000, x=w224) -> (In Range?=w225)
            case (w225) {
              frame False, Default {
                w226 = "❌"  # String {0}
                Concatenate Strings(w226, " ", w6, " ", "is out of range!") -> w14
              }
              frame True {
                w14 = "✅ "
              }
            }
            w13 = $"Error Cluster input"
            w15 = s1
            w16 = s2
          }
          frame "CalcCheck Volume Steam Generator" {
            Floating Point String To Number(default (0 DBL)=0, string=w10, use system decimal point (T)=TRUE) -> (number=w227)
            Is Greater(x=w227, y=s2) -> w228
            Divide(x=s2, y=w227) -> w229
            Is Less(x=w229, y=1.08) -> w230
            Logical Or(w230, w228) -> w231
            case (w231) {
              frame True {
                w232 = "❌"  # String {0}
                Concatenate Strings(w232, " ", "Too much calc in the steam generator!") -> w14
              }
              frame False {
                w14 = "✅"
              }
            }
            w13 = $"Error Cluster input"
            w15 = s1
            w16 = s2
          }
        }
      }
      frame "G102" {
        case (w6) {
          frame "False", Default {
            w13 = $"Error Cluster input"
            w14 = "✅"
            w15 = s1
            w16 = s2
          }
          frame "Ball Valve Motor M7", "Care Pump XS M18", "CleanJet Pump XS M6", "Gas blower Hot Air2 M10", "Gas valve Hot Air 2 Y13", "Hot Air Bottom Flame Current", "Hot Air Bottom Heat Request", "Magnetron Cooling Fan bottom", "Magnetron Cooling Fan top", "Magnetron Safety Chain bottom", "Magnetron Safety Chain top", "Microwave Anode current bottom", "Microwave Anode current top", "Microwave Heating Voltage bottom", "Microwave Heating Voltage top", "Microwave High Voltage actual bottom", "Microwave High Voltage actual top", "Microwave Target bottom", "Microwave Target top", "Motor Floor M22", "SC Pump XS M4" {
            w233 = " Information not required for this device type"  # String {0}
            Concatenate Strings("[ℹ]", w233) -> w14
            w13 = $"Error Cluster input"
            w15 = s1
            w16 = s2
          }
          frame "Reference Volume Steam Generator" {
            Floating Point String To Number(default (0 DBL)=0, string=w10, use system decimal point (T)=TRUE) -> (number=w15)
            Multiply(11, 1.1) -> w234
            Multiply(11, 0.9) -> w235
            In Range And Coerce(lower limit=w235, upper limit=w234, x=w15) -> (In Range?=w236)
            # G102_Volume_Steam_Generator_Norm = 11.2
            case (w236) {
              frame False, Default {
                Number To Fractional String(number=11, use system decimal point (T)=TRUE) -> (F-format string=w237)
                w238 = "❌"  # String {0}
                Concatenate Strings(w238, " ", w6, " ", "is out of range !", "\r", "Nominal volume: ", w237, " L") -> w14
              }
              frame True {
                Number To Fractional String(number=11, precision (6)=1, use system decimal point (T)=TRUE) -> (F-format string=w239)
                Concatenate Strings("✅", " Nominal volume: ", w239, " L") -> w14
              }
            }
            w13 = $"Error Cluster input"
            w16 = s2
          }
          frame "Actual Filling Volume Steam Generator" {
            Floating Point String To Number(default (0 DBL)=0, string=w10, use system decimal point (T)=TRUE) -> (number=w16)
            Multiply(s1, 0.2) -> w240
            Add(w240, s1) -> w241
            Subtract(x=s1, y=w240) -> w242
            In Range And Coerce(lower limit=w242, upper limit=w241, x=w16) -> (In Range?=w243)
            case (w243) {
              frame False, Default {
                w244 = "❌"  # String {0}
                Concatenate Strings(w244, " ", w6, " ", "doesn't fit to the norm level") -> w14
              }
              frame True {
                Concatenate Strings("✅ ", w6, "is OK:", "\r", "In relation to the reference volume steam generator.") -> w14
              }
            }
            w13 = $"Error Cluster input"
            w15 = s1
          }
          frame "Level Electrode S2 Threshold" {
            Floating Point String To Number(default (0 DBL)=0, string=w10, use system decimal point (T)=TRUE) -> (number=w245)
            In Range And Coerce(lower limit=500, upper limit=2000, x=w245) -> (In Range?=w246)
            case (w246) {
              frame False, Default {
                w247 = "❌"  # String {0}
                Concatenate Strings(w247, " ", w6, " ", "is out of range!") -> w14
              }
              frame True {
                w14 = "✅ "
              }
            }
            w13 = $"Error Cluster input"
            w15 = s1
            w16 = s2
          }
          frame "Level Electrode S2 Current  Value" {
            Floating Point String To Number(default (0 DBL)=0, string=w10, use system decimal point (T)=TRUE) -> (number=w248)
            In Range And Coerce(lower limit=0, upper limit=3000, x=w248) -> (In Range?=w249)
            case (w249) {
              frame False, Default {
                w250 = "❌"  # String {0}
                Concatenate Strings(w250, " ", w6, " ", "is out of range!") -> w14
              }
              frame True {
                w14 = "✅ "
              }
            }
            w13 = $"Error Cluster input"
            w15 = s1
            w16 = s2
          }
          frame "CalcCheck Volume Steam Generator" {
            Floating Point String To Number(default (0 DBL)=0, string=w10, use system decimal point (T)=TRUE) -> (number=w251)
            Is Greater(x=w251, y=s2) -> w252
            Divide(x=s2, y=w251) -> w253
            Is Less(x=w253, y=1.08) -> w254
            Logical Or(w254, w252) -> w255
            case (w255) {
              frame True {
                w256 = "❌"  # String {0}
                Concatenate Strings(w256, " ", "Too much calc in the steam generator!") -> w14
              }
              frame False {
                w14 = "✅"
              }
            }
            w13 = $"Error Cluster input"
            w15 = s1
            w16 = s2
          }
        }
      }
      frame "E201" {
        case (w6) {
          frame "False", Default {
            w13 = $"Error Cluster input"
            w14 = "✅"
            w15 = s1
            w16 = s2
          }
          frame "Ball Valve Motor M7", "Care Pump XS M18", "CleanJet Pump XS M6", "Gas blower Hot Air1 M8", "Gas blower Hot Air2 M10", "Gas blower Steam M9", "Gas valve Hot Air 1 Y12", "Gas valve Hot Air 2 Y13", "Gas valve Steam Y11", "Hot Air Bottom Flame Current", "Hot Air Bottom Heat Request", "Hot Air Top Flame Current", "Hot Air Top Heat Request", "Magnetron Cooling Fan bottom", "Magnetron Cooling Fan top", "Magnetron Safety Chain bottom", "Magnetron Safety Chain top", "Microwave Anode current bottom", "Microwave Anode current top", "Microwave Heating Voltage bottom", "Microwave Heating Voltage top", "Microwave High Voltage actual bottom", "Microwave High Voltage actual top", "Microwave Target bottom", "Microwave Target top", "SC Pump XS M4", "Steam Flame Current", "Steam Heat Request" {
            w257 = " Information not required for this device type"  # String {0}
            Concatenate Strings("[ℹ]", w257) -> w14
            w13 = $"Error Cluster input"
            w15 = s1
            w16 = s2
          }
          frame "Reference Volume Steam Generator" {
            Floating Point String To Number(default (0 DBL)=0, string=w10, use system decimal point (T)=TRUE) -> (number=w15)
            Multiply(9.3, 1.1) -> w258
            Multiply(9.3, 0.9) -> w259
            In Range And Coerce(lower limit=w259, upper limit=w258, x=w15) -> (In Range?=w260)
            # E201_Volume_Steam_Generator_Norm = 9.3
            case (w260) {
              frame False, Default {
                Number To Fractional String(number=9.3, use system decimal point (T)=TRUE) -> (F-format string=w261)
                w262 = "❌"  # String {0}
                Concatenate Strings(w262, " ", w6, " ", "is out of range !", "\r", "Nominal volume: ", w261, " L") -> w14
              }
              frame True {
                Number To Fractional String(number=9.3, precision (6)=1, use system decimal point (T)=TRUE) -> (F-format string=w263)
                Concatenate Strings("✅", " Nominal volume: ", w263, " L") -> w14
              }
            }
            w13 = $"Error Cluster input"
            w16 = s2
          }
          frame "Actual Filling Volume Steam Generator" {
            Floating Point String To Number(default (0 DBL)=0, string=w10, use system decimal point (T)=TRUE) -> (number=w16)
            Multiply(s1, 0.2) -> w264
            Add(w264, s1) -> w265
            Subtract(x=s1, y=w264) -> w266
            In Range And Coerce(lower limit=w266, upper limit=w265, x=w16) -> (In Range?=w267)
            case (w267) {
              frame False, Default {
                w268 = "❌"  # String {0}
                Concatenate Strings(w268, " ", w6, " ", "doesn't fit to the norm level") -> w14
              }
              frame True {
                Concatenate Strings("✅ ", w6, "is OK:", "\r", "In relation to the reference volume steam generator.") -> w14
              }
            }
            w13 = $"Error Cluster input"
            w15 = s1
          }
          frame "Level Electrode S2 Threshold" {
            Floating Point String To Number(default (0 DBL)=0, string=w10, use system decimal point (T)=TRUE) -> (number=w269)
            In Range And Coerce(lower limit=500, upper limit=2000, x=w269) -> (In Range?=w270)
            case (w270) {
              frame False, Default {
                w271 = "❌"  # String {0}
                Concatenate Strings(w271, " ", w6, " ", "is out of range!") -> w14
              }
              frame True {
                w14 = "✅ "
              }
            }
            w13 = $"Error Cluster input"
            w15 = s1
            w16 = s2
          }
          frame "Level Electrode S2 Current  Value" {
            Floating Point String To Number(default (0 DBL)=0, string=w10, use system decimal point (T)=TRUE) -> (number=w272)
            In Range And Coerce(lower limit=0, upper limit=3000, x=w272) -> (In Range?=w273)
            case (w273) {
              frame False, Default {
                w274 = "❌"  # String {0}
                Concatenate Strings(w274, " ", w6, " ", "is out of range!") -> w14
              }
              frame True {
                w14 = "✅ "
              }
            }
            w13 = $"Error Cluster input"
            w15 = s1
            w16 = s2
          }
          frame "CalcCheck Volume Steam Generator" {
            Floating Point String To Number(default (0 DBL)=0, string=w10, use system decimal point (T)=TRUE) -> (number=w275)
            Is Greater(x=w275, y=s2) -> w276
            Divide(x=s2, y=w275) -> w277
            Is Less(x=w277, y=1.08) -> w278
            Logical Or(w278, w276) -> w279
            case (w279) {
              frame True {
                w280 = "❌"  # String {0}
                Concatenate Strings(w280, " ", "Too much calc in the steam generator!") -> w14
              }
              frame False {
                w14 = "✅"
              }
            }
            w13 = $"Error Cluster input"
            w15 = s1
            w16 = s2
          }
        }
      }
      frame "E202" {
        case (w6) {
          frame "False", Default {
            w13 = $"Error Cluster input"
            w14 = "✅"
            w15 = s1
            w16 = s2
          }
          frame "Ball Valve Motor M7", "Care Pump XS M18", "CleanJet Pump XS M6", "Gas blower Hot Air1 M8", "Gas blower Hot Air2 M10", "Gas blower Steam M9", "Gas valve Hot Air 1 Y12", "Gas valve Hot Air 2 Y13", "Gas valve Steam Y11", "Hot Air Bottom Flame Current", "Hot Air Bottom Heat Request", "Hot Air Top Flame Current", "Hot Air Top Heat Request", "Magnetron Cooling Fan bottom", "Magnetron Cooling Fan top", "Magnetron Safety Chain bottom", "Magnetron Safety Chain top", "Microwave Anode current bottom", "Microwave Anode current top", "Microwave Heating Voltage bottom", "Microwave Heating Voltage top", "Microwave High Voltage actual bottom", "Microwave High Voltage actual top", "Microwave Target bottom", "Microwave Target top", "SC Pump XS M4", "Steam Flame Current", "Steam Heat Request" {
            w281 = " Information not required for this device type"  # String {0}
            Concatenate Strings("[ℹ]", w281) -> w14
            w13 = $"Error Cluster input"
            w15 = s1
            w16 = s2
          }
          frame "Reference Volume Steam Generator" {
            Floating Point String To Number(default (0 DBL)=0, string=w10, use system decimal point (T)=TRUE) -> (number=w15)
            Multiply(13.4, 1.1) -> w282
            Multiply(13.4, 0.9) -> w283
            In Range And Coerce(lower limit=w283, upper limit=w282, x=w15) -> (In Range?=w284)
            # E202_Volume_Steam_Generator_Norm = 13.4
            case (w284) {
              frame False, Default {
                Number To Fractional String(number=13.4, use system decimal point (T)=TRUE) -> (F-format string=w285)
                w286 = "❌"  # String {0}
                Concatenate Strings(w286, " ", w6, " ", "is out of range !", "\r", "Nominal volume: ", w285, " L") -> w14
              }
              frame True {
                Number To Fractional String(number=13.4, precision (6)=1, use system decimal point (T)=TRUE) -> (F-format string=w287)
                Concatenate Strings("✅", " Nominal volume: ", w287, " L") -> w14
              }
            }
            w13 = $"Error Cluster input"
            w16 = s2
          }
          frame "Actual Filling Volume Steam Generator" {
            Floating Point String To Number(default (0 DBL)=0, string=w10, use system decimal point (T)=TRUE) -> (number=w16)
            Multiply(s1, 0.2) -> w288
            Add(w288, s1) -> w289
            Subtract(x=s1, y=w288) -> w290
            In Range And Coerce(lower limit=w290, upper limit=w289, x=w16) -> (In Range?=w291)
            case (w291) {
              frame False, Default {
                w292 = "❌"  # String {0}
                Concatenate Strings(w292, " ", w6, " ", "doesn't fit to the norm level") -> w14
              }
              frame True {
                Concatenate Strings("✅ ", w6, "is OK:", "\r", "In relation to the reference volume steam generator.") -> w14
              }
            }
            w13 = $"Error Cluster input"
            w15 = s1
          }
          frame "Level Electrode S2 Threshold" {
            Floating Point String To Number(default (0 DBL)=0, string=w10, use system decimal point (T)=TRUE) -> (number=w293)
            In Range And Coerce(lower limit=500, upper limit=2000, x=w293) -> (In Range?=w294)
            case (w294) {
              frame False, Default {
                w295 = "❌"  # String {0}
                Concatenate Strings(w295, " ", w6, " ", "is out of range!") -> w14
              }
              frame True {
                w14 = "✅ "
              }
            }
            w13 = $"Error Cluster input"
            w15 = s1
            w16 = s2
          }
          frame "Level Electrode S2 Current  Value" {
            Floating Point String To Number(default (0 DBL)=0, string=w10, use system decimal point (T)=TRUE) -> (number=w296)
            In Range And Coerce(lower limit=0, upper limit=3000, x=w296) -> (In Range?=w297)
            case (w297) {
              frame False, Default {
                w298 = "❌"  # String {0}
                Concatenate Strings(w298, " ", w6, " ", "is out of range!") -> w14
              }
              frame True {
                w14 = "✅ "
              }
            }
            w13 = $"Error Cluster input"
            w15 = s1
            w16 = s2
          }
          frame "CalcCheck Volume Steam Generator" {
            Floating Point String To Number(default (0 DBL)=0, string=w10, use system decimal point (T)=TRUE) -> (number=w299)
            Is Greater(x=w299, y=s2) -> w300
            Divide(x=s2, y=w299) -> w301
            Is Less(x=w301, y=1.08) -> w302
            Logical Or(w302, w300) -> w303
            case (w303) {
              frame True {
                w304 = "❌"  # String {0}
                Concatenate Strings(w304, " ", "Too much calc in the steam generator!") -> w14
              }
              frame False {
                w14 = "✅"
              }
            }
            w13 = $"Error Cluster input"
            w15 = s1
            w16 = s2
          }
        }
      }
      frame "G201" {
        case (w6) {
          frame "False", Default {
            w13 = $"Error Cluster input"
            w14 = "✅"
            w15 = s1
            w16 = s2
          }
          frame "Ball Valve Motor M7", "Care Pump XS M18", "CleanJet Pump XS M6", "Magnetron Cooling Fan bottom", "Magnetron Cooling Fan top", "Magnetron Safety Chain bottom", "Magnetron Safety Chain top", "Microwave Anode current bottom", "Microwave Anode current top", "Microwave Heating Voltage bottom", "Microwave Heating Voltage top", "Microwave High Voltage actual bottom", "Microwave High Voltage actual top", "Microwave Target bottom", "Microwave Target top", "SC Pump XS M4" {
            w305 = " Information not required for this device type"  # String {0}
            Concatenate Strings("[ℹ]", w305) -> w14
            w13 = $"Error Cluster input"
            w15 = s1
            w16 = s2
          }
          frame "Reference Volume Steam Generator" {
            Floating Point String To Number(default (0 DBL)=0, string=w10, use system decimal point (T)=TRUE) -> (number=w15)
            Multiply(9.3, 1.1) -> w306
            Multiply(9.3, 0.9) -> w307
            In Range And Coerce(lower limit=w307, upper limit=w306, x=w15) -> (In Range?=w308)
            # G201_Volume_Steam_Generator_Norm = 9.1
            case (w308) {
              frame False, Default {
                Number To Fractional String(number=9.3, use system decimal point (T)=TRUE) -> (F-format string=w309)
                w310 = "❌"  # String {0}
                Concatenate Strings(w310, " ", w6, " ", "is out of range !", "\r", "Nominal volume: ", w309, " L") -> w14
              }
              frame True {
                Number To Fractional String(number=9.3, precision (6)=1, use system decimal point (T)=TRUE) -> (F-format string=w311)
                Concatenate Strings("✅", " Nominal volume: ", w311, " L") -> w14
              }
            }
            w13 = $"Error Cluster input"
            w16 = s2
          }
          frame "Actual Filling Volume Steam Generator" {
            Floating Point String To Number(default (0 DBL)=0, string=w10, use system decimal point (T)=TRUE) -> (number=w16)
            Multiply(s1, 0.2) -> w312
            Add(w312, s1) -> w313
            Subtract(x=s1, y=w312) -> w314
            In Range And Coerce(lower limit=w314, upper limit=w313, x=w16) -> (In Range?=w315)
            case (w315) {
              frame False, Default {
                w316 = "❌"  # String {0}
                Concatenate Strings(w316, " ", w6, " ", "doesn't fit to the norm level") -> w14
              }
              frame True {
                Concatenate Strings("✅ ", w6, "is OK:", "\r", "In relation to the reference volume steam generator.") -> w14
              }
            }
            w13 = $"Error Cluster input"
            w15 = s1
          }
          frame "Level Electrode S2 Threshold" {
            Floating Point String To Number(default (0 DBL)=0, string=w10, use system decimal point (T)=TRUE) -> (number=w317)
            In Range And Coerce(lower limit=500, upper limit=2000, x=w317) -> (In Range?=w318)
            case (w318) {
              frame False, Default {
                w319 = "❌"  # String {0}
                Concatenate Strings(w319, " ", w6, " ", "is out of range!") -> w14
              }
              frame True {
                w14 = "✅ "
              }
            }
            w13 = $"Error Cluster input"
            w15 = s1
            w16 = s2
          }
          frame "Level Electrode S2 Current  Value" {
            Floating Point String To Number(default (0 DBL)=0, string=w10, use system decimal point (T)=TRUE) -> (number=w320)
            In Range And Coerce(lower limit=0, upper limit=3000, x=w320) -> (In Range?=w321)
            case (w321) {
              frame False, Default {
                w322 = "❌"  # String {0}
                Concatenate Strings(w322, " ", w6, " ", "is out of range!") -> w14
              }
              frame True {
                w14 = "✅ "
              }
            }
            w13 = $"Error Cluster input"
            w15 = s1
            w16 = s2
          }
          frame "CalcCheck Volume Steam Generator" {
            Floating Point String To Number(default (0 DBL)=0, string=w10, use system decimal point (T)=TRUE) -> (number=w323)
            Is Greater(x=w323, y=s2) -> w324
            Divide(x=s2, y=w323) -> w325
            Is Less(x=w325, y=1.08) -> w326
            Logical Or(w326, w324) -> w327
            case (w327) {
              frame True {
                w328 = "❌"  # String {0}
                Concatenate Strings(w328, " ", "Too much calc in the steam generator!") -> w14
              }
              frame False {
                w14 = "✅"
              }
            }
            w13 = $"Error Cluster input"
            w15 = s1
            w16 = s2
          }
        }
      }
      frame "G202" {
        case (w6) {
          frame "False", Default {
            w13 = $"Error Cluster input"
            w14 = "✅"
            w15 = s1
            w16 = s2
          }
          frame "Ball Valve Motor M7", "Care Pump XS M18", "CleanJet Pump XS M6", "Magnetron Cooling Fan bottom", "Magnetron Cooling Fan top", "Magnetron Safety Chain bottom", "Magnetron Safety Chain top", "Microwave Anode current bottom", "Microwave Anode current top", "Microwave Heating Voltage bottom", "Microwave Heating Voltage top", "Microwave High Voltage actual bottom", "Microwave High Voltage actual top", "Microwave Target bottom", "Microwave Target top", "SC Pump XS M4" {
            w329 = " Information not required for this device type"  # String {0}
            Concatenate Strings("[ℹ]", w329) -> w14
            w13 = $"Error Cluster input"
            w15 = s1
            w16 = s2
          }
          frame "Reference Volume Steam Generator" {
            # G202_Volume_Steam_Generator_Norm = 13.5
            Floating Point String To Number(default (0 DBL)=0, string=w10, use system decimal point (T)=TRUE) -> (number=w15)
            Multiply(13, 1.1) -> w330
            Multiply(13, 0.9) -> w331
            In Range And Coerce(lower limit=w331, upper limit=w330, x=w15) -> (In Range?=w332)
            case (w332) {
              frame False, Default {
                Number To Fractional String(number=13, use system decimal point (T)=TRUE) -> (F-format string=w333)
                w334 = "❌"  # String {0}
                Concatenate Strings(w334, " ", w6, " ", "is out of range !", "\r", "Nominal volume: ", w333) -> w14
              }
              frame True {
                Number To Fractional String(number=13, precision (6)=1, use system decimal point (T)=TRUE) -> (F-format string=w335)
                Concatenate Strings("✅", " Nominal volume: ", w335) -> w14
              }
            }
            w13 = $"Error Cluster input"
            w16 = s2
          }
          frame "Actual Filling Volume Steam Generator" {
            Floating Point String To Number(default (0 DBL)=0, string=w10, use system decimal point (T)=TRUE) -> (number=w16)
            Multiply(s1, 0.2) -> w336
            Add(w336, s1) -> w337
            Subtract(x=s1, y=w336) -> w338
            In Range And Coerce(lower limit=w338, upper limit=w337, x=w16) -> (In Range?=w339)
            case (w339) {
              frame False, Default {
                w340 = "❌"  # String {0}
                Concatenate Strings(w340, " ", w6, " ", "doesn't fit to the norm level", " L") -> w14
              }
              frame True {
                w14 = "✅"
              }
            }
            w13 = $"Error Cluster input"
            w15 = s1
          }
          frame "Level Electrode S2 Threshold" {
            Floating Point String To Number(default (0 DBL)=0, string=w10, use system decimal point (T)=TRUE) -> (number=w341)
            In Range And Coerce(lower limit=500, upper limit=2000, x=w341) -> (In Range?=w342)
            case (w342) {
              frame False, Default {
                w343 = "❌"  # String {0}
                Concatenate Strings(w343, " ", w6, " ", "is out of range!") -> w14
              }
              frame True {
                w14 = "✅"
              }
            }
            w13 = $"Error Cluster input"
            w15 = s1
            w16 = s2
          }
          frame "Level Electrode S2 Current  Value" {
            Floating Point String To Number(default (0 DBL)=0, string=w10, use system decimal point (T)=TRUE) -> (number=w344)
            In Range And Coerce(lower limit=0, upper limit=3000, x=w344) -> (In Range?=w345)
            case (w345) {
              frame False, Default {
                w346 = "❌"  # String {0}
                Concatenate Strings(w346, " ", w6, " ", "is out of range!") -> w14
              }
              frame True {
                w14 = "✅"
              }
            }
            w13 = $"Error Cluster input"
            w15 = s1
            w16 = s2
          }
          frame "CalcCheck Volume Steam Generator" {
            Floating Point String To Number(default (0 DBL)=0, string=w10, use system decimal point (T)=TRUE) -> (number=w347)
            Is Greater(x=w347, y=s2) -> w348
            Divide(x=s2, y=w347) -> w349
            Is Less(x=w349, y=1.08) -> w350
            Logical Or(w350, w348) -> w351
            case (w351) {
              frame True {
                w352 = "❌"  # String {0}
                Concatenate Strings(w352, " ", "Too much calc in the steam generator!") -> w14
              }
              frame False {
                Concatenate Strings("✅ ", w6, "is OK:", "\r", "In relation to the reference volume steam generator.") -> w14
              }
            }
            w13 = $"Error Cluster input"
            w15 = s1
            w16 = s2
          }
        }
      }
    }
    Property Node(instance in=T1 {all zero or empty}, "Parameter Name"=w6, "Status"=w10, "Dimension"=w12, "Comment"=w14) -> (instance out=w353)
    append w353 to w2
    next s1 = w15
    next s2 = w16
  }
  $Output_Error <- w13
  $"Diagnostic Water iCS Switch Output" <- w2
