vi "index.gviweb"   [G Web Development Software 22.3.0]
# Press “Analyse” and select a service report xml file
panel controls:
  "Analyse": bool  # Press the button “Analyse” and select a service report xml file.
  "Page 1": i32
  "Page selector": enum{"Page 1", "Page 2", "Page 3", "Page 4"} = "Page 1"
  "Page 2": i32
  "Page 3": i32
  "Page 4": i32
  "Device": enum{"iCombi", "iVario"} = "iCombi"
  "ivario": i32
  "Info_Plot": bool
  "Sort table ivario": bool
  "Sort table iCombi": bool
panel indicators:
  "Device:": string
  "Board Information:": cluster{"Board": string, "Information": string}[]
  "common": T1[]
  "URL-Grafik": string
  "Basic_Settings": T2[]
  "Diagnostic RT Calibration": T3[]
  "Checkbox": bool
  "Diagnostic_Water_iCS_Switch": T4[]
  "Diagnostic-Service-History": T5[]
  "Diagnostic Running Times Comp": T6[]
  "Diagnostic Running Times Modes": T6[]
  "System Logger Output": T7[]
  "Histogram cpu pcb Temperature profile Celsius": f64[]
  "skala histogram CPU": string
  "Histogram IO Temperature profile Celsius": f64[]
  "skala histogram IO": string
  "Histogram LED hinge side Temperature profile Celsius": f64[]
  "skala Histogram LED hinge": string
  "Histogram LED handle side Temperature profile Celsius": f64[]
  "Skala Histogram LED handle": string
  "Histogram pump pcb Temperature profile Celsius": f64[]
  "skala Histogram pump pcb": string
  "Histogram gas box Temperature profile Celsius": f64[]
  "Skala Histogram Gas box": string
  "Histogram fan 1 RPM profile 1 min": f64[]
  "skala Histogram fan 1 rpm": string
  "Histogram fan 1 power profile W": f64[]
  "Skala Histogram fan power": string
  "Histogram fan 1 Temperature_profile Celsius": f64[]
  "Skala Histogram fan1 temp": string
  "Histogram fan 1 Voltage max_V_1phase_3phase": f64[]
  "Skala Histogram fan1 max Volt": string
  "Histogram fan 1 Voltage min_V_1phase_3phase": f64[]
  "Skala Histogram fan1 minVolt": string
  "Histogram fan 2 RPM profile 1 min": f64[]
  "skala Histogram fan 2 rpm": string
  "Histogram fan 2 power profile W": f64[]
  "Skala Histogram fan2 power": string
  "Histogram fan 2 Temperature_profile Celsius": f64[]
  "Skala Histogram fan2 temp": string
  "Histogram fan 2 Voltage max_V_1phase_3phase": f64[]
  "Histogram fan 2 Voltage min_V_1phase_3phase": f64[]
  "Skala Histogram fan2 minVolt": string
  "Skala Histogram fan2 maxVolt": string
  "Histogram fan 3 RPM profile 1 min": f64[]
  "skala Histogram fan 3 rpm": string
  "Histogram fan 3 power profile W": f64[]
  "Skala Histogram fan3 power": string
  "Histogram fan 3 Temperature_profile Celsius": f64[]
  "Skala Histogram fan3 temp": string
  "Histogram fan 3 Voltage max_V_1phase_3phase": f64[]
  "Histogram fan 3 Voltage min_V_1phase_3phase": f64[]
  "Skala Histogram fan3 minVolt": string
  "Skala Histogram fan3 maxVolt": string
  "Histogram MMI CPU Load Percent": f64[]
  "Skala Histogram MMI CPU": string
  "Histogram MMI RAM Load Percent": f64[]
  "Skala Histogram MMI Load": string
  "Histogram Basis CPU Load Percent": f64[]
  "Skala Histogram Basis MMI CPU": string
  "Histogram Basis RAM Load Percent": f64[]
  "Skala Histogram Basis MMI Load": string
  "Histogram Magnetron Top Temperatur profile Celsius": f64[]
  "skala Magnetron top": string
  "Histogram Magnetron bottom Temperature profile Celsius": f64[]
  "skala Magnetron bottom": string
  "Histogram Power Supply Top Temperature profile Celsius": f64[]
  "skala Power Supply top": string
  "Histogram Power Supply bottom Temperature profile Celsius": f64[]
  "skala histogram Power Supply bottom": string
  "Boards_Information:": cluster{"Board": string, "Information": string}[]
  "Device :": string
  "common Information ivario": T1[]
  "Basic Informations": T2[]
  "Diagnostic_RT_Data_Sensors_Heating": T8[]
  "Diagnostic_RT_Data_Sensors": T9[]
  "Diagnostic_RT_Data_Sensors_mouvement": T10[]
  "Diagnostic_RT_Data_Sensors_Pressure": T4[]
  "Diagnostic-Service-History_iVario": T5[]
  "Total Running Time:": T6[]
  "Diagnostic Running Times Components:": T6[]
  "String": string
  "Total Running Time :": T6[]
  "Measured_temperature IO °C [Min/Max]:": f64[]
  "wrong unit type": bool
types:
  T1 = cluster{"Parameter Name": string, "Value": string, "Comment": string}
  T2 = cluster{"Parameter Name": string, "Value": string, "Dimension": string, "Comment": string}
  T3 = cluster{"Parameter Name": string, "Combi": string, "Dry": string, "Wet": string, "Dimension": string, "Comment": string}
  T4 = cluster{"Parameter Name": string, "Status": string, "Dimension": string, "Comment": string}
  T5 = cluster{"Parameter Name": string, "First Time": string, "Last Time": string, "Quantity": string, "Comment": string}
  T6 = cluster{"Parameter Name": string, "Count": string, "Duration": string, "Dimension": string, "Comment": string}
  T7 = cluster{"Parameter Name": string, "Value": string, "Value relative": string, "Dimension": string, "Comment": string}
  T8 = cluster{"Parameter Name": string, "Actual": string, "Dimension": string, "Comment": string}
  T9 = cluster{"Parameter Name": string, "Actual": string, "Dimension": string, "Limit": string, "maximum": string, "Time_stamp": string, "Comment": string}
  T10 = cluster{"Parameter Name": string, "Command": string, "Down_Switch": string, "Status": string, "Up_Switch": string, "Dimension": string, "Comment": string}
  T11 = cluster{"Parameter Name": string, "Status": string, "Dimension": string, "comment": string}
  T12 = cluster{"Boards": string, "Informations": string}
  T13 = cluster{"Parameter Name": string, "Actual": string, "Dimension": string, "comment": string}
  T14 = cluster{"Parameter Name": string, "Command": string, "Down_Switch": string, "Status": string, "Up_Switch": string, "dim": string, "Comment": string}
uses:
  NI::HTTP::GET.gvi
  Uppy::Function.gvi
  FileTasks::Read File Text.gvi
  NI::G Core::Error::Clear Error Cluster.gvi
  Library::Check_XML_Device.gviweb
  WebApp::Sort_Service_History_event.gviweb
  WebApp::Read_XML_Part.gviweb
  WebApp::Exlude_WA_Entrys.gviweb
  WebApp::Interpret_Common_Information.gviweb
  WebApp::Interpret_Common_Information_iVario.gviweb
  WebApp::Interpret_Basic_Settings.gviweb
  WebApp::Exclude_Entry.gviweb
  WebApp::Interpret_Basic_Settings_iVario.gviweb
  WebApp::Interpret_Diagnostic_RT_Data_Sensors.gviweb
  WebApp::Interpret_Diagnostic_RT_Data_Sensors_Heating.gviweb
  WebApp::Interpret_Diagnostic_RT_Data_Sensors_Movement.gviweb
  WebApp::Interpret_Diagnostic_RT_Data_Sensors_Pressure.gviweb
  WebApp::Interpret_Diagnostic_RT_Calibration.gviweb
  WebApp::Interpret_Diagnostic_Water_iCS_Switch.gviweb
  WebApp::Interpret_Diagnostic_Service_History.gviweb
  WebApp::Sort_Service_History_MSGs_Default.gviweb
  WebApp::Interpret_Diagnostic_RunningTimes_Comp.gviweb
  WebApp::Interpret_SystemLogger.gviweb
  WebApp::Interpret_Histogram_CPU_IO_Temperature.gviweb
  WebApp::Interpret_Diagnostic_RunningTimes_Modes.gviweb
diagram:
  w1 = "Init"  # State
  # "": Auto Dose available
  # "": Unit-Type
  s1 = w1  # shift register
  s2 = ""  # shift register
  s3 = string[] []  # shift register
  s4 = ""  # shift register
  s5 = ""  # shift register
  s6 = ""  # shift register
  s7 = ""  # shift register
  while {
    case (s1) {
      frame "Init", Default {
        $"Skala Histogram fan1 temp" <- "skala_fan_temp.jpg"
        $"skala Histogram pump pcb" <- "skala_120.jpg"
        w10 = "Read Ini File"  # State
        $"skala histogram IO" <- "skala_120.jpg"
        $"Skala Histogram fan2 temp" <- "skala_fan_temp.jpg"
        $"skala histogram CPU" <- "skala_120.jpg"
        $"Skala Histogram fan3 temp" <- "skala_fan_temp.jpg"
        $"Device:" <- "No_Picture.jpg"
        $"skala Histogram LED hinge" <- "skala_120.jpg"
        $"Skala Histogram fan2 power" <- "skala_fan_Puis.jpg"
        $"URL-Grafik" <- "Rational_Logo.png"
        $"Skala Histogram LED handle" <- "skala_120.jpg"
        $"Skala Histogram fan power" <- "skala_fan_Puis.jpg"
        $"Skala Histogram Gas box" <- "skala_120.jpg"
        $"Skala Histogram fan3 power" <- "skala_fan_Puis.jpg"
        $"Skala Histogram fan3 minVolt" <- "skala_fan_voltage.jpg"
        $"Skala Histogram fan1 minVolt" <- "skala_fan_voltage.jpg"
        $"skala Histogram fan 3 rpm" <- "skala_fan_RPM.jpg"
        $"Skala Histogram Basis MMI Load" <- "skala_MMI.jpg"
        $"skala Magnetron top" <- "skala_120.jpg"
        $"Skala Histogram fan1 max Volt" <- "skala_fan_voltage.jpg"
        $"skala Histogram fan 1 rpm" <- "skala_fan_RPM.jpg"
        $"skala Power Supply top" <- "skala_120.jpg"
        $"Skala Histogram Basis MMI CPU" <- "skala_MMI.jpg"
        $"Skala Histogram fan2 minVolt" <- "skala_fan_voltage.jpg"
        $"skala Histogram fan 2 rpm" <- "skala_fan_RPM.jpg"
        $"skala Magnetron bottom" <- "skala_120.jpg"
        $"Skala Histogram MMI CPU" <- "skala_MMI.jpg"
        $"Skala Histogram fan2 maxVolt" <- "skala_fan_voltage.jpg"
        $"skala histogram Power Supply bottom" <- "skala_120.jpg"
        $"Skala Histogram MMI Load" <- "skala_MMI.jpg"
        $"Skala Histogram fan3 maxVolt" <- "skala_fan_voltage.jpg"
        Property Node(instance in=reference to "Device", "Value"="iCombi", error in=no error) -> (error out=w11, instance out=w12)
        Close Reference(error in=w11, reference=w12) -> (error out=w13)
        Property Node(instance in=reference to "String", "Visible"=FALSE, error in=w13) -> (error out=w14, instance out=w15)
        Close Reference(error in=w14, reference=w15) -> (error out=w16)
        Property Node(instance in=reference to "Page 1", "Visible"=TRUE, error in=w16) -> (error out=w17, instance out=w18)
        Property Node(instance in=reference to "Page 2", "Visible"=FALSE, error in=w17) -> (error out=w19, instance out=w20)
        Property Node(instance in=reference to "Page 3", "Visible"=FALSE, error in=w19) -> (error out=w21, instance out=w22)
        Property Node(instance in=reference to "Page 4", "Visible"=FALSE, error in=w21) -> (error out=w23, instance out=w24)
        Property Node(instance in=reference to "ivario", "Visible"=FALSE, error in=w23) -> (error out=w25, instance out=w26)
        Close Reference(error in=w25, reference=w18) -> (error out=w27)
        Close Reference(error in=w27, reference=w20) -> (error out=w28)
        Close Reference(error in=w28, reference=w22) -> (error out=w29)
        Close Reference(error in=w29, reference=w24) -> (error out=w30)
        Close Reference(error in=w30, reference=w26) -> (error out=w2)
        w3 = w10
        w4 = s2
        w5 = s3
        w6 = s4
        w7 = s5
        w8 = s6
        w9 = s7
      }
      frame "Reset all" {
        case ($"wrong unit type") {
          frame True { }
          frame False {
            $"Device :" <- "No_Picture.jpg"
            $"Device:" <- "No_Picture.jpg"
            $common <- T1[] []
            $"common Information ivario" <- T1[] []
          }
        }
        $"Total Running Time :" <- T6[] []
        $"Diagnostic Running Times Modes" <- T6[] []
        $"Total Running Time:" <- T6[] []
        $"System Logger Output" <- T7[] []
        $Checkbox <- FALSE
        $"Diagnostic Running Times Components:" <- T6[] []
        $"Diagnostic RT Calibration" <- T3[] []
        w31 = "Wait For Interaction"  # State
        $"Histogram Basis RAM Load Percent" <- f64[] []
        $"Diagnostic Running Times Comp" <- T6[] []
        $"Histogram Basis CPU Load Percent" <- f64[] []
        $Diagnostic_RT_Data_Sensors_Pressure <- T11[] []
        $"Histogram MMI RAM Load Percent" <- f64[] []
        $"Diagnostic-Service-History" <- T5[] []
        $"Basic Informations" <- T2[] []
        $"Histogram MMI CPU Load Percent" <- f64[] []
        $Basic_Settings <- T2[] []
        $Diagnostic_Water_iCS_Switch <- T4[] []
        $"Boards_Information:" <- T12[] []
        $"Histogram fan 3 power profile W" <- f64[] []
        $"Board Information:" <- T12[] []
        $Diagnostic_RT_Data_Sensors <- T9[] []
        $"Diagnostic-Service-History_iVario" <- T5[] []
        $Diagnostic_RT_Data_Sensors_Heating <- T13[] []
        $Diagnostic_RT_Data_Sensors_mouvement <- T14[] []
        case ($Device) {
          frame "iCombi", Default {
            for (N = 4) (iteration -> i1) {
              case (i1) {
                frame 0, Default {
                  Property Node(instance in=reference to "Page 1", "Value"=i1, "Visible"=TRUE, error in=no error) -> (error out=w32, instance out=w33)
                  Close Reference(error in=w32, reference=w33) -> (error out=w2)
                }
                frame 1 {
                  Property Node(instance in=reference to "Page 2", "Value"=i1, "Visible"=FALSE, error in=no error) -> (error out=w34, instance out=w35)
                  Close Reference(error in=w34, reference=w35) -> (error out=w2)
                }
                frame 2 {
                  Property Node(instance in=reference to "Page 3", "Value"=i1, "Visible"=FALSE, error in=no error) -> (error out=w36, instance out=w37)
                  Close Reference(error in=w36, reference=w37) -> (error out=w2)
                }
                frame 3 {
                  Property Node(instance in=reference to "Page 4", "Value"=i1, "Visible"=FALSE, error in=no error) -> (error out=w38, instance out=w39)
                  Close Reference(error in=w38, reference=w39) -> (error out=w2)
                }
              }
            }
          }
          frame "iVario" {
            Property Node(instance in=reference to "ivario", "Value"=0, error in=no error) -> (error out=w40, instance out=w41)
            Close Reference(error in=w40, reference=w41) -> (error out=w2)
          }
        }
        $"Histogram fan 1 Voltage min_V_1phase_3phase" <- f64[] []
        $"Histogram fan 1 Voltage max_V_1phase_3phase" <- f64[] []
        $"Histogram fan 3 RPM profile 1 min" <- f64[] []
        $"Histogram fan 1 Temperature_profile Celsius" <- f64[] []
        $"Histogram fan 2 RPM profile 1 min" <- f64[] []
        $"Histogram fan 3 Voltage min_V_1phase_3phase" <- f64[] []
        $"Histogram fan 2 power profile W" <- f64[] []
        $"Histogram fan 1 power profile W" <- f64[] []
        $"Histogram fan 3 power profile W" <- f64[] []
        $"Histogram gas box Temperature profile Celsius" <- f64[] []
        $"Histogram fan 3 Temperature_profile Celsius" <- f64[] []
        $"Histogram fan 1 RPM profile 1 min" <- f64[] []
        $"Histogram fan 2 Temperature_profile Celsius" <- f64[] []
        $"Histogram pump pcb Temperature profile Celsius" <- f64[] []
        $"Histogram cpu pcb Temperature profile Celsius" <- f64[] []
        $"Histogram fan 2 Voltage max_V_1phase_3phase" <- f64[] []
        $"Histogram LED handle side Temperature profile Celsius" <- f64[] []
        $"Histogram IO Temperature profile Celsius" <- f64[] []
        $"Histogram LED hinge side Temperature profile Celsius" <- f64[] []
        w3 = w31
        w4 = s2
        w5 = s3
        w6 = s4
        w7 = s5
        w8 = s6
        w9 = s7
      }
      frame "Change Page" {
        w42 = "Wait For Interaction"  # State
        case ($"Page selector") {
          frame "Page 1", Default {
            Property Node(instance in=reference to "Page 2", "Visible"=FALSE, error in=no error) -> (error out=w48, instance out=w44)
            Property Node(instance in=reference to "Page 1", "Visible"=TRUE, error in=w48) -> (error out=w49, instance out=w45)
            Property Node(instance in=reference to "Page 3", "Visible"=FALSE, error in=w49) -> (error out=w50, instance out=w46)
            Property Node(instance in=reference to "Page 4", "Visible"=FALSE, error in=w50) -> (error out=w43, instance out=w47)
          }
          frame "Page 2" {
            Property Node(instance in=reference to "Page 2", "Visible"=TRUE, error in=no error) -> (error out=w51, instance out=w44)
            Property Node(instance in=reference to "Page 1", "Visible"=FALSE, error in=w51) -> (error out=w52, instance out=w45)
            Property Node(instance in=reference to "Page 3", "Visible"=FALSE, error in=w52) -> (error out=w53, instance out=w46)
            Property Node(instance in=reference to "Page 4", "Visible"=FALSE, error in=w53) -> (error out=w43, instance out=w47)
          }
          frame "Page 3" {
            Property Node(instance in=reference to "Page 2", "Visible"=FALSE, error in=no error) -> (error out=w54, instance out=w44)
            Property Node(instance in=reference to "Page 1", "Visible"=FALSE, error in=w54) -> (error out=w55, instance out=w45)
            Property Node(instance in=reference to "Page 3", "Visible"=TRUE, error in=w55) -> (error out=w56, instance out=w46)
            Property Node(instance in=reference to "Page 4", "Visible"=FALSE, error in=w56) -> (error out=w43, instance out=w47)
          }
          frame "Page 4" {
            Property Node(instance in=reference to "Page 2", "Visible"=FALSE, error in=no error) -> (error out=w57, instance out=w44)
            Property Node(instance in=reference to "Page 1", "Visible"=FALSE, error in=w57) -> (error out=w58, instance out=w45)
            Property Node(instance in=reference to "Page 3", "Visible"=FALSE, error in=w58) -> (error out=w59, instance out=w46)
            Property Node(instance in=reference to "Page 4", "Visible"=TRUE, error in=w59) -> (error out=w43, instance out=w47)
          }
        }
        Close Reference(error in=w43, reference=w44) -> (error out=w60)
        Close Reference(error in=w60, reference=w45) -> (error out=w61)
        Close Reference(error in=w61, reference=w46) -> (error out=w62)
        Close Reference(error in=w62, reference=w47) -> (error out=w2)
        w3 = w42
        w4 = s2
        w5 = s3
        w6 = s4
        w7 = s5
        w8 = s6
        w9 = s7
      }
      frame "Change Device" {
        w63 = "Wait For Interaction"  # State
        case ($Device) {
          frame "iCombi", Default {
            Property Node(instance in=reference to "Page selector", "Visible"=TRUE, "Value"="Page 1", error in=no error) -> (error out=w71, instance out=w70)
            Property Node(instance in=reference to "ivario", "Visible"=FALSE, error in=w71) -> (error out=w72, instance out=w69)
            Property Node(instance in=reference to "Page 2", "Visible"=FALSE, error in=w72) -> (error out=w73, instance out=w65)
            Property Node(instance in=reference to "Page 1", "Visible"=TRUE, error in=w73) -> (error out=w74, instance out=w66)
            Property Node(instance in=reference to "Page 3", "Visible"=FALSE, error in=w74) -> (error out=w75, instance out=w67)
            Property Node(instance in=reference to "Page 4", "Visible"=FALSE, error in=w75) -> (error out=w64, instance out=w68)
          }
          frame "iVario" {
            Property Node(instance in=reference to "Page selector", "Visible"=FALSE, error in=no error) -> (error out=w76, instance out=w70)
            Property Node(instance in=reference to "ivario", "Visible"=TRUE, error in=w76) -> (error out=w77, instance out=w69)
            Property Node(instance in=reference to "Page 2", "Visible"=FALSE, error in=w77) -> (error out=w78, instance out=w65)
            Property Node(instance in=reference to "Page 1", "Visible"=FALSE, error in=w78) -> (error out=w79, instance out=w66)
            Property Node(instance in=reference to "Page 3", "Visible"=FALSE, error in=w79) -> (error out=w80, instance out=w67)
            Property Node(instance in=reference to "Page 4", "Visible"=FALSE, error in=w80) -> (error out=w64, instance out=w68)
          }
        }
        Close Reference(error in=w64, reference=w65) -> (error out=w81)
        Close Reference(error in=w81, reference=w66) -> (error out=w82)
        Close Reference(error in=w82, reference=w67) -> (error out=w83)
        Close Reference(error in=w83, reference=w68) -> (error out=w84)
        Close Reference(error in=w84, reference=w69) -> (error out=w85)
        Close Reference(error in=w85, reference=w70) -> (error out=w2)
        w3 = w63
        w4 = s2
        w5 = s3
        w6 = s4
        w7 = s5
        w8 = s6
        w9 = s7
      }
      frame "Read Ini File" {
        w86 = "Wait For Interaction"  # State
        call "GET.gvi"(url="Config_XML_Datainterpreter.ini", error in=no error) -> (body=w87, error out=w88)
        call "Function.gvi"(string in=w87, Error Cluster Constant=w88) -> (Output=w5, Output_error=w2)
        w3 = w86
        w4 = s2
        w6 = s4
        w7 = s5
        w8 = s6
        w9 = s7
      }
      frame "Read XML File" {
        call "Read File Text.gvi"(allowed file types=[".xml"], error in=no error) -> (file content=w89, file name=w90, error out=w91)
        case (w91) {
          frame Error, Default {
            w92 = "Wait For Interaction"  # State
            call "Clear Error Cluster.gvi"(error in=w91) -> (error out=w2)
            w3 = w92
            w4 = ""
          }
          frame No Error {
            call "Clear Error Cluster.gvi"(error in=w91) -> (error out=w93)
            case ($Device) {
              frame "iVario" {
                call "Check_XML_Device.gviweb"(XML Name=w90, Error Input=w93, XML Content=w89, First Check="Pan", Second Check="Potentiometer", Sous-Fix="RAT") -> (Error Output=w94, XML fine ?=w95)
                case (w95) {
                  frame False, Default {
                    $"wrong unit type" <- FALSE
                    w96 = "Reset all"  # State
                    call "Check_XML_Device.gviweb"(XML Name=w90, Error Input=w94, XML Content=w89, First Check="Histogram", Second Check="CalibN1", Sous-Fix="RAG") -> (Error Output=w2, XML fine ?=w97)
                    case (w97) {
                      frame False, Default {
                        w98 = "The service report is invalid, please check the XML file you have opened"
                        One Button Dialog(message=w98)
                      }
                      frame True {
                        w99 = "Please select iCombi as device and reload the selected Service Report XML file !"
                        One Button Dialog(message=w99)
                      }
                    }
                    w3 = w96
                  }
                  frame True {
                    w100 = "Common Information iVario"  # State
                    w3 = w100
                    w2 = w94
                  }
                }
              }
              frame "iCombi", Default {
                call "Check_XML_Device.gviweb"(XML Name=w90, Error Input=w93, XML Content=w89, First Check="Histogram", Second Check="CalibN1", Sous-Fix="RAG") -> (Error Output=w101, XML fine ?=w102)
                case (w102) {
                  frame False, Default {
                    $"wrong unit type" <- FALSE
                    w103 = "Reset all"  # State
                    call "Check_XML_Device.gviweb"(XML Name=w90, Error Input=w101, XML Content=w89, First Check="Pan", Second Check="Potentiometer", Sous-Fix="RAT") -> (Error Output=w2, XML fine ?=w104)
                    case (w104) {
                      frame False, Default {
                        w105 = "The service report is invalid, please check the XML file you have opened"
                        One Button Dialog(message=w105)
                      }
                      frame True {
                        w106 = "Please select iVario as device and reload the selected Service Report XML file !"
                        One Button Dialog(message=w106)
                      }
                    }
                    w3 = w103
                  }
                  frame True {
                    w107 = "Common Information"  # State
                    w3 = w107
                    w2 = w101
                  }
                }
              }
            }
            w4 = w89
          }
        }
        w5 = s3
        w6 = s4
        w7 = s5
        w8 = s6
        w9 = s7
      }
      frame "Wait For Interaction" {
        event {
          on "Analyse" Value changed {
            w108 = "Read XML File"  # State
            w2 = no error
            w3 = w108
          }
          on "Page selector" Value changed {
            w109 = "Change Page"  # State
            w2 = no error
            w3 = w109
          }
          on "Device" Value changed {
            w110 = "Change Device"  # State
            w2 = no error
            w3 = w110
          }
          on "Info_Plot" Value changed {
            w111 = "Wait For Interaction"  # State
            Event Data() -> ("New Value"=w112)
            case (w112) {
              frame False, Default {
                Property Node(instance in=reference to "String", "Visible"=FALSE, error in=no error) -> (error out=w113, instance out=w114)
              }
              frame True {
                Property Node(instance in=reference to "String", "Visible"=TRUE, error in=no error) -> (error out=w113, instance out=w114)
                w115 = "Press the drop down menu under \"Plot\" \nand change the graph settings as desired."
                $String <- w115
              }
            }
            Close Reference(error in=w113, reference=w114) -> (error out=w2)
            w3 = w111
          }
          on "Sort table ivario" Value changed {
            w116 = "Wait For Interaction"  # State
            Event Data() -> ("Old Value"=w117)
            Not(x=w117) -> w118
            call "Sort_Service_History_event.gviweb"(Diagnostic Service History input=$"Diagnostic-Service-History_iVario", Event=w118, Error Cluster input=no error) -> (Diagnostic Service History output=w119, Error Output=w2)
            $"Diagnostic-Service-History_iVario" <- w119
            w3 = w116
          }
          on "Sort table iCombi" Value changed {
            w120 = "Wait For Interaction"  # State
            Event Data() -> ("Old Value"=w121)
            Not(x=w121) -> w122
            call "Sort_Service_History_event.gviweb"(Diagnostic Service History input=$"Diagnostic-Service-History", Event=w122, Error Cluster input=no error) -> (Diagnostic Service History output=w123, Error Output=w2)
            $"Diagnostic-Service-History" <- w123
            w3 = w120
          }
        }
        w4 = s2
        w5 = s3
        w6 = s4
        w7 = s5
        w8 = s6
        w9 = s7
      }
      frame "Common Information" {
        call "Read_XML_Part.gviweb"(Input XML=s2, Start XML Part="<Common_Information>", End XML Part="</Common_Information>", Error in=no error) -> (Output XML array=w124, Error out=w125)
        call "Exlude_WA_Entrys.gviweb"(Input XML array=w124, Error in=w125) -> (Without_WA_Entrys=w126, Output Error=w127)
        call "Interpret_Common_Information.gviweb"(Common Information Entrys=w126, Language Entrys=s3, Error Cluster Constant=w127) -> (Startup Date and Time=w8, Device:=w128, common=w129, Boards Informations:=w130, Output Error=w2, Auto Dose=w9, Unit-type=w6)
        case (w128) {
          frame "No_Analyse.png" {
            $"wrong unit type" <- TRUE
            w131 = "Reset all"  # State
            $"Page selector" <- "Page 1"
            $"Page 1" <- 0
            w3 = w131
          }
          frame "False", Default {
            w132 = "Basic Settings"  # State
            w3 = w132
          }
        }
        $"Device:" <- w128
        $common <- w129
        $"Board Information:" <- w130
        w4 = s2
        w5 = s3
        w7 = s5
      }
      frame "Common Information iVario" {
        call "Read_XML_Part.gviweb"(Input XML=s2, Start XML Part="<Common_Information>", End XML Part="</Common_Information>", Error in=no error) -> (Output XML array=w133, Error out=w134)
        call "Exlude_WA_Entrys.gviweb"(Input XML array=w133, Error in=w134) -> (Without_WA_Entrys=w135, Output Error=w136)
        call "Interpret_Common_Information_iVario.gviweb"(Common Information Entrys=w135, Language Entrys=s3, Error Cluster Constant=w136) -> (Device:=w137, common=w138, Boards Informations:=w139, Output Error=w2, Unit-type=w6)
        case (w137) {
          frame "False", Default {
            w140 = "Basic Settings iVario"  # State
            w3 = w140
          }
          frame "No_Analyse.png" {
            $"wrong unit type" <- TRUE
            w141 = "Reset all"  # State
            w3 = w141
          }
        }
        $"Device :" <- w137
        $"common Information ivario" <- w138
        $"Boards_Information:" <- w139
        w4 = s2
        w5 = s3
        w7 = s5
        w8 = s6
        w9 = s7
      }
      frame "Basic Settings" {
        w142 = "Diagnostic RT Data Sensors"  # State
        call "Read_XML_Part.gviweb"(Input XML=s2, Start XML Part="<Basic_Settings>", End XML Part="</Basic_Settings>", Error in=no error) -> (Output XML array=w143, Error out=w144)
        call "Exlude_WA_Entrys.gviweb"(Input XML array=w143, Error in=w144) -> (Without_WA_Entrys=w145, Output Error=w146)
        call "Interpret_Basic_Settings.gviweb"(Basic Settings Entrys=w145, Config File infos=s3, Device Type=s4, Error input=w146) -> (Basic Informations=w147, Output Error=w2)
        $Basic_Settings <- w147
        w3 = w142
        w4 = s2
        w5 = s3
        w6 = s4
        w7 = s5
        w8 = s6
        w9 = s7
      }
      frame "Basic Settings iVario" {
        w148 = "Diagnostic RT Data Sensors Heating iVario"  # State
        call "Read_XML_Part.gviweb"(Input XML=s2, Start XML Part="<Basic_Settings>", End XML Part="</Basic_Settings>", Error in=no error) -> (Output XML array=w149, Error out=w150)
        call "Exlude_WA_Entrys.gviweb"(Input XML array=w149, Error in=w150) -> (Without_WA_Entrys=w151, Output Error=w152)
        call "Exclude_Entry.gviweb"(Input XML array=w151, Excluded Entry="Power_State_WA82", Error in=w152) -> (Without_Excluded_Entrys=w153, Output Error=w154)
        call "Interpret_Basic_Settings_iVario.gviweb"(Basic Settings Entrys=w153, Device Type=s4, Error input=w154) -> (Basic Informations=w155, Output Error=w2)
        $"Basic Informations" <- w155
        w3 = w148
        w4 = s2
        w5 = s3
        w6 = s4
        w7 = s5
        w8 = s6
        w9 = s7
      }
      frame "Diagnostic RT Data Sensors" {
        w156 = "DIagnostic RT Calibration"  # State
        call "Read_XML_Part.gviweb"(Input XML=s2, Start XML Part="<Diagnostic_RT_Data_Sensors>", End XML Part="</Diagnostic_RT_Data_Sensors>", Error in=no error) -> (Output XML array=w157, Error out=w158)
        call "Exlude_WA_Entrys.gviweb"(Input XML array=w157, Error in=w158) -> (Without_WA_Entrys=w159, Output Error=w160)
        # s7: Auto Dose Available
        call "Interpret_Diagnostic_RT_Data_Sensors.gviweb"(Diagnostic Settings Entrys=w159, Config File infos=s3, Device Type=s4, Error input=w160, Auto Dose=s7) -> (Diagnostic_RT_Data_Sensors=w161, Output Error=w2)
        $Diagnostic_RT_Data_Sensors <- w161
        w3 = w156
        w4 = s2
        w5 = s3
        w6 = s4
        w7 = s5
        w8 = s6
        w9 = s7
      }
      frame "Diagnostic RT Data Sensors Heating iVario" {
        w162 = "Diagnostic RT Data Sensors Movement iVario"  # State
        call "Read_XML_Part.gviweb"(Input XML=s2, Start XML Part="<Diagnostic_RT_Data_Sensors_Heating>", End XML Part="</Diagnostic_RT_Data_Sensors_Heating>", Error in=no error) -> (Output XML array=w163, Error out=w164)
        Array Size(array=w163) -> (size(s)=w165)
        Is Greater Than 0(x=w165) -> w166
        case (w166) {
          frame False, Default {
            call "Read_XML_Part.gviweb"(Input XML=s2, Start XML Part="<Diagnostic_RT_Data_Sensors_(Heating)>", End XML Part="</Diagnostic_RT_Data_Sensors_(Heating)>", Error in=w164) -> (Output XML array=w168, Error out=w167)
          }
          frame True {
            w167 = w164
            w168 = w163
          }
        }
        call "Exlude_WA_Entrys.gviweb"(Input XML array=w168, Error in=w167) -> (Without_WA_Entrys=w169, Output Error=w170)
        call "Interpret_Diagnostic_RT_Data_Sensors_Heating.gviweb"(Diagnostic Settings Entrys=w169, Device Type=s4, Error input=w170) -> (Output=w171, Output Error=w2)
        $Diagnostic_RT_Data_Sensors_Heating <- w171
        w3 = w162
        w4 = s2
        w5 = s3
        w6 = s4
        w7 = s5
        w8 = s6
        w9 = s7
      }
      frame "Diagnostic RT Data Sensors Movement iVario" {
        w172 = "Diagnostic RT Data Sensors Pressure"  # State
        call "Read_XML_Part.gviweb"(Input XML=s2, Start XML Part="<Diagnostic_RT_Data_Sensors_Movement>", End XML Part="</Diagnostic_RT_Data_Sensors_Movement>", Error in=no error) -> (Output XML array=w173, Error out=w174)
        Array Size(array=w173) -> (size(s)=w175)
        Is Greater Than 0(x=w175) -> w176
        case (w176) {
          frame False, Default {
            call "Read_XML_Part.gviweb"(Input XML=s2, Start XML Part="<Diagnostic_RT_Data_Sensors_(Movement)>", End XML Part="</Diagnostic_RT_Data_Sensors_(Movement)>", Error in=w174) -> (Output XML array=w178, Error out=w177)
          }
          frame True {
            w177 = w174
            w178 = w173
          }
        }
        call "Exlude_WA_Entrys.gviweb"(Input XML array=w178, Error in=w177) -> (Without_WA_Entrys=w179, Output Error=w180)
        call "Interpret_Diagnostic_RT_Data_Sensors_Movement.gviweb"(Diagnostic Settings mouvement Entrys=w179, Device Type=s4, Error input=w180) -> (Output mouvement=w181, Output Error=w2)
        $Diagnostic_RT_Data_Sensors_mouvement <- w181
        w3 = w172
        w4 = s2
        w5 = s3
        w6 = s4
        w7 = s5
        w8 = s6
        w9 = s7
      }
      frame "Diagnostic RT Data Sensors Pressure" {
        w182 = "Diagnostic Service History iVario"  # State
        call "Read_XML_Part.gviweb"(Input XML=s2, Start XML Part="<Diagnostic_RT_Data_Sensors_Pressure>", End XML Part="</Diagnostic_RT_Data_Sensors_Pressure>", Error in=no error) -> (Output XML array=w183, Error out=w184)
        Array Size(array=w183) -> (size(s)=w185)
        Is Greater Than 0(x=w185) -> w186
        case (w186) {
          frame False, Default {
            call "Read_XML_Part.gviweb"(Input XML=s2, Start XML Part="<Diagnostic_RT_Data_Sensors_(Pressure)>", End XML Part="</Diagnostic_RT_Data_Sensors_(Pressure)>", Error in=w184) -> (Output XML array=w188, Error out=w187)
          }
          frame True {
            w187 = w184
            w188 = w183
          }
        }
        call "Exlude_WA_Entrys.gviweb"(Input XML array=w188, Error in=w187) -> (Without_WA_Entrys=w189, Output Error=w190)
        call "Interpret_Diagnostic_RT_Data_Sensors_Pressure.gviweb"(Pressure Entrys=w189, Device Type=s4, Error input=w190) -> (Output Pressure=w191, Output Error=w2)
        $Diagnostic_RT_Data_Sensors_Pressure <- w191
        w3 = w182
        w4 = s2
        w5 = s3
        w6 = s4
        w7 = s5
        w8 = s6
        w9 = s7
      }
      frame "DIagnostic RT Calibration" {
        w192 = "Diagnostic Water iCS Switch"  # State
        call "Read_XML_Part.gviweb"(Input XML=s2, Start XML Part="<Diagnostic_RT_Calibration>", End XML Part="</Diagnostic_RT_Calibration>", Error in=no error) -> (Output XML array=w193, Error out=w194)
        call "Exlude_WA_Entrys.gviweb"(Input XML array=w193, Error in=w194) -> (Without_WA_Entrys=w195, Output Error=w196)
        call "Interpret_Diagnostic_RT_Calibration.gviweb"(Diagnostic RT Calibration Entrys=w195, Error Cluster Constant=w196) -> (Diagnostic RT Calibration=w197, Calibrated=w198, Output Error=w2)
        $"Diagnostic RT Calibration" <- w197
        $Checkbox <- w198
        w3 = w192
        w4 = s2
        w5 = s3
        w6 = s4
        w7 = s5
        w8 = s6
        w9 = s7
      }
      frame "Diagnostic Water iCS Switch" {
        w199 = "Diagnostic Service History"  # State
        call "Read_XML_Part.gviweb"(Input XML=s2, Start XML Part="<Diagnostic_Water_iCS_Switch>", End XML Part="</Diagnostic_Water_iCS_Switch>", Error in=no error) -> (Output XML array=w200, Error out=w201)
        call "Exlude_WA_Entrys.gviweb"(Input XML array=w200, Error in=w201) -> (Without_WA_Entrys=w202, Output Error=w203)
        call "Interpret_Diagnostic_Water_iCS_Switch.gviweb"(Diagnostic Water iCS Switch Entrys=w202, Device Type=s4, Error Cluster input=w203, Auto Dose=s7) -> (Diagnostic Water iCS Switch Output=w204, Output_Error=w2)
        $Diagnostic_Water_iCS_Switch <- w204
        w3 = w199
        w4 = s2
        w5 = s3
        w6 = s4
        w7 = s5
        w8 = s6
        w9 = s7
      }
      frame "Diagnostic Service History" {
        w205 = "Diagnostic Running Times Modes"  # State
        call "Read_XML_Part.gviweb"(Input XML=s2, Start XML Part="<Diagnostic-Service-History>", End XML Part="</Diagnostic-Service-History>", Error in=no error) -> (Output XML array=w206, Error out=w207)
        call "Exlude_WA_Entrys.gviweb"(Input XML array=w206, Error in=w207) -> (Without_WA_Entrys=w208, Output Error=w209)
        call "Interpret_Diagnostic_Service_History.gviweb"(Diagnostic Service History Entrys=w208, Device Type=s4, Error Cluster input=w209) -> (Diagnostic Service History Output=w210, Error Output=w211)
        call "Sort_Service_History_MSGs_Default.gviweb"(Diagnostic Service History input=w210, Error Cluster input=w211) -> (Diagnostic Service History output=w212, Error Output=w2)
        $"Diagnostic-Service-History" <- w212
        w3 = w205
        w4 = s2
        w5 = s3
        w6 = s4
        w7 = s5
        w8 = s6
        w9 = s7
      }
      frame "Diagnostic Service History iVario" {
        w213 = "Diagnostic Running Times Modes iVario "  # State
        call "Read_XML_Part.gviweb"(Input XML=s2, Start XML Part="<Diagnostic-Service-History>", End XML Part="</Diagnostic-Service-History>", Error in=no error) -> (Output XML array=w214, Error out=w215)
        call "Exlude_WA_Entrys.gviweb"(Input XML array=w214, Error in=w215) -> (Without_WA_Entrys=w216, Output Error=w217)
        call "Interpret_Diagnostic_Service_History.gviweb"(Diagnostic Service History Entrys=w216, Device Type=s4, Error Cluster input=w217) -> (Diagnostic Service History Output=w218, Error Output=w219)
        call "Sort_Service_History_MSGs_Default.gviweb"(Diagnostic Service History input=w218, Error Cluster input=w219) -> (Diagnostic Service History output=w220, Error Output=w2)
        $"Diagnostic-Service-History_iVario" <- w220
        w3 = w213
        w4 = s2
        w5 = s3
        w6 = s4
        w7 = s5
        w8 = s6
        w9 = s7
      }
      frame "Diagnostic Running Times Comp" {
        w221 = "System Logger"  # State
        call "Read_XML_Part.gviweb"(Input XML=s2, Start XML Part="<Diagnostic-RunningTimes-Comp>", End XML Part="</Diagnostic-RunningTimes-Comp>", Error in=no error) -> (Output XML array=w222, Error out=w223)
        call "Exlude_WA_Entrys.gviweb"(Input XML array=w222, Error in=w223) -> (Without_WA_Entrys=w224, Output Error=w225)
        call "Interpret_Diagnostic_RunningTimes_Comp.gviweb"(Diagnostic Service History Entrys=w224, Total running time=s5, Error Cluster input=w225) -> (Running Time Component Output=w226, Error Cluster output=w2)
        $"Diagnostic Running Times Comp" <- w226
        w3 = w221
        w4 = s2
        w5 = s3
        w6 = s4
        w7 = s5
        w8 = s6
        w9 = s7
      }
      frame "Diagnostic Running Times Component iVario " {
        w227 = "System Logger"  # State
        call "Read_XML_Part.gviweb"(Input XML=s2, Start XML Part="<Diagnostic-RunningTimes-Comp>", End XML Part="</Diagnostic-RunningTimes-Comp>", Error in=no error) -> (Output XML array=w228, Error out=w229)
        call "Exlude_WA_Entrys.gviweb"(Input XML array=w228, Error in=w229) -> (Without_WA_Entrys=w230, Output Error=w231)
        call "Interpret_Diagnostic_RunningTimes_Comp.gviweb"(Diagnostic Service History Entrys=w230, Total running time=s5, Error Cluster input=w231) -> (Running Time Component Output=w232, Error Cluster output=w2)
        $"Diagnostic Running Times Components:" <- w232
        w3 = w227
        w4 = s2
        w5 = s3
        w6 = s4
        w7 = s5
        w8 = s6
        w9 = s7
      }
      frame "System Logger" {
        w233 = "Histogram temperature CPU"  # State
        call "Read_XML_Part.gviweb"(Input XML=s2, Start XML Part="<SystemLogger>", End XML Part="</SystemLogger>", Error in=no error) -> (Output XML array=w234, Error out=w235)
        call "Exlude_WA_Entrys.gviweb"(Input XML array=w234, Error in=w235) -> (Without_WA_Entrys=w236, Output Error=w237)
        call "Interpret_SystemLogger.gviweb"(SystemLogger Entrys=w236, Startup Date and Time=s6, Error Cluster input=w237) -> (System Logger output=w238, Error Cluster output=w2)
        $"System Logger Output" <- w238
        w3 = w233
        w4 = s2
        w5 = s3
        w6 = s4
        w7 = s5
        w8 = s6
        w9 = s7
      }
      frame "Histogram temperature CPU" {
        w239 = "Histogram temperature IO"  # State
        call "Read_XML_Part.gviweb"(Input XML=s2, Start XML Part="<Histogram_cpu_pcb_-_Temperature_profile_Celsius>", End XML Part="</Histogram_cpu_pcb_-_Temperature_profile_Celsius>", Error in=no error) -> (Output XML array=w240, Error out=w241)
        call "Exlude_WA_Entrys.gviweb"(Input XML array=w240, Error in=w241) -> (Without_WA_Entrys=w242, Output Error=w243)
        call "Interpret_Histogram_CPU_IO_Temperature.gviweb"(Histogramm Entrys=w242, Error Cluster input=w243) -> (Signal=w244, Error Output=w2)
        $"Histogram cpu pcb Temperature profile Celsius" <- w244
        w3 = w239
        w4 = s2
        w5 = s3
        w6 = s4
        w7 = s5
        w8 = s6
        w9 = s7
      }
      frame "Histogram temperature IO" {
        w245 = "Histogram temperature LED hinge"  # State
        call "Read_XML_Part.gviweb"(Input XML=s2, Start XML Part="<Histogram_IO_pcb_-_Temperature_profile_Celsius>", End XML Part="</Histogram_IO_pcb_-_Temperature_profile_Celsius>", Error in=no error) -> (Output XML array=w246, Error out=w247)
        call "Exlude_WA_Entrys.gviweb"(Input XML array=w246, Error in=w247) -> (Without_WA_Entrys=w248, Output Error=w249)
        call "Interpret_Histogram_CPU_IO_Temperature.gviweb"(Histogramm Entrys=w248, Error Cluster input=w249) -> (Signal=w250, Error Output=w2)
        Array Subset(array=w250, index0=16, length0=2) -> w251
        $"Measured_temperature IO °C [Min/Max]:" <- w251
        Array Subset(array=w250, length0=16) -> w252
        $"Histogram IO Temperature profile Celsius" <- w252
        w3 = w245
        w4 = s2
        w5 = s3
        w6 = s4
        w7 = s5
        w8 = s6
        w9 = s7
      }
      frame "Histogram temperature LED hinge" {
        w253 = "Histogram temperature LED handle"  # State
        call "Read_XML_Part.gviweb"(Input XML=s2, Start XML Part="<Histogram_LED_hinge_side_-_Temperature_profile_Celsius>", End XML Part="</Histogram_LED_hinge_side_-_Temperature_profile_Celsius>", Error in=no error) -> (Output XML array=w254, Error out=w255)
        call "Exlude_WA_Entrys.gviweb"(Input XML array=w254, Error in=w255) -> (Without_WA_Entrys=w256, Output Error=w257)
        call "Interpret_Histogram_CPU_IO_Temperature.gviweb"(Histogramm Entrys=w256, Error Cluster input=w257) -> (Signal=w258, Error Output=w2)
        $"Histogram LED hinge side Temperature profile Celsius" <- w258
        w3 = w253
        w4 = s2
        w5 = s3
        w6 = s4
        w7 = s5
        w8 = s6
        w9 = s7
      }
      frame "Histogram temperature LED handle" {
        w259 = "Histogram temperature pump pcb"  # State
        call "Read_XML_Part.gviweb"(Input XML=s2, Start XML Part="<Histogram_LED_handle_side_-_Temperature_profile_Celsius>", End XML Part="</Histogram_LED_handle_side_-_Temperature_profile_Celsius>", Error in=no error) -> (Output XML array=w260, Error out=w261)
        call "Exlude_WA_Entrys.gviweb"(Input XML array=w260, Error in=w261) -> (Without_WA_Entrys=w262, Output Error=w263)
        call "Interpret_Histogram_CPU_IO_Temperature.gviweb"(Histogramm Entrys=w262, Error Cluster input=w263) -> (Signal=w264, Error Output=w2)
        $"Histogram LED handle side Temperature profile Celsius" <- w264
        w3 = w259
        w4 = s2
        w5 = s3
        w6 = s4
        w7 = s5
        w8 = s6
        w9 = s7
      }
      frame "Histogram temperature pump pcb" {
        w265 = "Histogram temperature Gas Box"  # State
        call "Read_XML_Part.gviweb"(Input XML=s2, Start XML Part="<Histogram_pump_pcb_-_Temperature_profile_Celsius>", End XML Part="</Histogram_pump_pcb_-_Temperature_profile_Celsius>", Error in=no error) -> (Output XML array=w266, Error out=w267)
        call "Exlude_WA_Entrys.gviweb"(Input XML array=w266, Error in=w267) -> (Without_WA_Entrys=w268, Output Error=w269)
        call "Interpret_Histogram_CPU_IO_Temperature.gviweb"(Histogramm Entrys=w268, Error Cluster input=w269) -> (Signal=w270, Error Output=w2)
        $"Histogram pump pcb Temperature profile Celsius" <- w270
        w3 = w265
        w4 = s2
        w5 = s3
        w6 = s4
        w7 = s5
        w8 = s6
        w9 = s7
      }
      frame "Histogram temperature Gas Box" {
        w271 = "Histogram Fan 1 RPM"  # State
        call "Read_XML_Part.gviweb"(Input XML=s2, Start XML Part="<Histogram_gas_box_-_Temperature_profile_Celsius>", End XML Part="</Histogram_gas_box_-_Temperature_profile_Celsius>", Error in=no error) -> (Output XML array=w272, Error out=w273)
        call "Exlude_WA_Entrys.gviweb"(Input XML array=w272, Error in=w273) -> (Without_WA_Entrys=w274, Output Error=w275)
        call "Interpret_Histogram_CPU_IO_Temperature.gviweb"(Histogramm Entrys=w274, Error Cluster input=w275) -> (Signal=w276, Error Output=w2)
        $"Histogram gas box Temperature profile Celsius" <- w276
        w3 = w271
        w4 = s2
        w5 = s3
        w6 = s4
        w7 = s5
        w8 = s6
        w9 = s7
      }
      frame "Histogram Fan 1 RPM" {
        w277 = "Histogram Fan 1 Power"  # State
        call "Read_XML_Part.gviweb"(Input XML=s2, Start XML Part="<Histogram_fan_1_-_RPM_profile_1_min>", End XML Part="</Histogram_fan_1_-_RPM_profile_1_min>", Error in=no error) -> (Output XML array=w278, Error out=w279)
        call "Exlude_WA_Entrys.gviweb"(Input XML array=w278, Error in=w279) -> (Without_WA_Entrys=w280, Output Error=w281)
        call "Interpret_Histogram_CPU_IO_Temperature.gviweb"(Histogramm Entrys=w280, Error Cluster input=w281) -> (Signal=w282, Error Output=w2)
        $"Histogram fan 1 RPM profile 1 min" <- w282
        w3 = w277
        w4 = s2
        w5 = s3
        w6 = s4
        w7 = s5
        w8 = s6
        w9 = s7
      }
      frame "Histogram Fan 1 Power" {
        w283 = "Histogram Fan 1 Temperature"  # State
        call "Read_XML_Part.gviweb"(Input XML=s2, Start XML Part="<Histogram_fan_1_-_power_profile_W>", End XML Part="</Histogram_fan_1_-_power_profile_W>", Error in=no error) -> (Output XML array=w284, Error out=w285)
        call "Exlude_WA_Entrys.gviweb"(Input XML array=w284, Error in=w285) -> (Without_WA_Entrys=w286, Output Error=w287)
        call "Interpret_Histogram_CPU_IO_Temperature.gviweb"(Histogramm Entrys=w286, Error Cluster input=w287) -> (Signal=w288, Error Output=w2)
        $"Histogram fan 1 power profile W" <- w288
        w3 = w283
        w4 = s2
        w5 = s3
        w6 = s4
        w7 = s5
        w8 = s6
        w9 = s7
      }
      frame "Histogram Fan 1 Temperature" {
        w289 = "Histogram Fan 1 Voltage min"  # State
        call "Read_XML_Part.gviweb"(Input XML=s2, Start XML Part="<Histogram_fan_1_-_Temperature_profile_Celsius>", End XML Part="</Histogram_fan_1_-_Temperature_profile_Celsius>", Error in=no error) -> (Output XML array=w290, Error out=w291)
        call "Exlude_WA_Entrys.gviweb"(Input XML array=w290, Error in=w291) -> (Without_WA_Entrys=w292, Output Error=w293)
        call "Interpret_Histogram_CPU_IO_Temperature.gviweb"(Histogramm Entrys=w292, Error Cluster input=w293) -> (Signal=w294, Error Output=w2)
        $"Histogram fan 1 Temperature_profile Celsius" <- w294
        w3 = w289
        w4 = s2
        w5 = s3
        w6 = s4
        w7 = s5
        w8 = s6
        w9 = s7
      }
      frame "Histogram Fan 1 Voltage min" {
        w295 = "Histogram Fan 1 Voltage max"  # State
        call "Read_XML_Part.gviweb"(Input XML=s2, Start XML Part="<Histogram_fan_1_-_Voltage_min_V_-_1phase_3phase>", End XML Part="</Histogram_fan_1_-_Voltage_min_V_-_1phase_3phase>", Error in=no error) -> (Output XML array=w296, Error out=w297)
        call "Exlude_WA_Entrys.gviweb"(Input XML array=w296, Error in=w297) -> (Without_WA_Entrys=w298, Output Error=w299)
        call "Interpret_Histogram_CPU_IO_Temperature.gviweb"(Histogramm Entrys=w298, Error Cluster input=w299) -> (Signal=w300, Error Output=w2)
        $"Histogram fan 1 Voltage min_V_1phase_3phase" <- w300
        w3 = w295
        w4 = s2
        w5 = s3
        w6 = s4
        w7 = s5
        w8 = s6
        w9 = s7
      }
      frame "Histogram Fan 1 Voltage max" {
        w301 = "Histogram Fan 2 RPM"  # State
        call "Read_XML_Part.gviweb"(Input XML=s2, Start XML Part="<Histogram_fan_1_-_Voltage_min_V_-_1phase_3phase>", End XML Part="</Histogram_fan_1_-_Voltage_min_V_-_1phase_3phase>", Error in=no error) -> (Output XML array=w302, Error out=w303)
        call "Exlude_WA_Entrys.gviweb"(Input XML array=w302, Error in=w303) -> (Without_WA_Entrys=w304, Output Error=w305)
        call "Interpret_Histogram_CPU_IO_Temperature.gviweb"(Histogramm Entrys=w304, Error Cluster input=w305) -> (Signal=w306, Error Output=w2)
        $"Histogram fan 1 Voltage max_V_1phase_3phase" <- w306
        w3 = w301
        w4 = s2
        w5 = s3
        w6 = s4
        w7 = s5
        w8 = s6
        w9 = s7
      }
      frame "Histogram Fan 2 RPM" {
        w307 = "Histogram Fan 2 Power"  # State
        call "Read_XML_Part.gviweb"(Input XML=s2, Start XML Part="<Histogram_fan_2_-_RPM_profile_1_min>", End XML Part="</Histogram_fan_2_-_RPM_profile_1_min>", Error in=no error) -> (Output XML array=w308, Error out=w309)
        call "Exlude_WA_Entrys.gviweb"(Input XML array=w308, Error in=w309) -> (Without_WA_Entrys=w310, Output Error=w311)
        call "Interpret_Histogram_CPU_IO_Temperature.gviweb"(Histogramm Entrys=w310, Error Cluster input=w311) -> (Signal=w312, Error Output=w2)
        $"Histogram fan 2 RPM profile 1 min" <- w312
        w3 = w307
        w4 = s2
        w5 = s3
        w6 = s4
        w7 = s5
        w8 = s6
        w9 = s7
      }
      frame "Histogram Fan 2 Power" {
        w313 = "Histogram Fan 2 Temperature"  # State
        call "Read_XML_Part.gviweb"(Input XML=s2, Start XML Part="<Histogram_fan_2_-_power_profile_W>", End XML Part="</Histogram_fan_2_-_power_profile_W>", Error in=no error) -> (Output XML array=w314, Error out=w315)
        call "Exlude_WA_Entrys.gviweb"(Input XML array=w314, Error in=w315) -> (Without_WA_Entrys=w316, Output Error=w317)
        call "Interpret_Histogram_CPU_IO_Temperature.gviweb"(Histogramm Entrys=w316, Error Cluster input=w317) -> (Signal=w318, Error Output=w2)
        $"Histogram fan 2 power profile W" <- w318
        w3 = w313
        w4 = s2
        w5 = s3
        w6 = s4
        w7 = s5
        w8 = s6
        w9 = s7
      }
      frame "Histogram Fan 2 Temperature" {
        w319 = "Histogram Fan 2 Voltage min"  # State
        call "Read_XML_Part.gviweb"(Input XML=s2, Start XML Part="<Histogram_fan_2_-_Temperature_profile_Celsius>", End XML Part="</Histogram_fan_2_-_Temperature_profile_Celsius>", Error in=no error) -> (Output XML array=w320, Error out=w321)
        call "Exlude_WA_Entrys.gviweb"(Input XML array=w320, Error in=w321) -> (Without_WA_Entrys=w322, Output Error=w323)
        call "Interpret_Histogram_CPU_IO_Temperature.gviweb"(Histogramm Entrys=w322, Error Cluster input=w323) -> (Signal=w324, Error Output=w2)
        $"Histogram fan 2 Temperature_profile Celsius" <- w324
        w3 = w319
        w4 = s2
        w5 = s3
        w6 = s4
        w7 = s5
        w8 = s6
        w9 = s7
      }
      frame "Histogram Fan 2 Voltage min" {
        w325 = "Histogram Fan 2 Voltage max"  # State
        call "Read_XML_Part.gviweb"(Input XML=s2, Start XML Part="<Histogram_fan_2_-_Voltage_min_V_-_1phase_3phase>", End XML Part="</Histogram_fan_2_-_Voltage_min_V_-_1phase_3phase>", Error in=no error) -> (Output XML array=w326, Error out=w327)
        call "Exlude_WA_Entrys.gviweb"(Input XML array=w326, Error in=w327) -> (Without_WA_Entrys=w328, Output Error=w329)
        call "Interpret_Histogram_CPU_IO_Temperature.gviweb"(Histogramm Entrys=w328, Error Cluster input=w329) -> (Signal=w330, Error Output=w2)
        $"Histogram fan 2 Voltage min_V_1phase_3phase" <- w330
        w3 = w325
        w4 = s2
        w5 = s3
        w6 = s4
        w7 = s5
        w8 = s6
        w9 = s7
      }
      frame "Histogram Fan 2 Voltage max" {
        w331 = "Histogram Fan 3 RPM"  # State
        call "Read_XML_Part.gviweb"(Input XML=s2, Start XML Part="<Histogram_fan_2_-_Voltage_max_V_-_1phase_3phase>", End XML Part="</Histogram_fan_2_-_Voltage_max_V_-_1phase_3phase>", Error in=no error) -> (Output XML array=w332, Error out=w333)
        call "Exlude_WA_Entrys.gviweb"(Input XML array=w332, Error in=w333) -> (Without_WA_Entrys=w334, Output Error=w335)
        call "Interpret_Histogram_CPU_IO_Temperature.gviweb"(Histogramm Entrys=w334, Error Cluster input=w335) -> (Signal=w336, Error Output=w2)
        $"Histogram fan 2 Voltage max_V_1phase_3phase" <- w336
        w3 = w331
        w4 = s2
        w5 = s3
        w6 = s4
        w7 = s5
        w8 = s6
        w9 = s7
      }
      frame "Histogram Fan 3 RPM" {
        w337 = "Histogram Fan 3 Power"  # State
        call "Read_XML_Part.gviweb"(Input XML=s2, Start XML Part="<Histogram_fan_3_-_RPM_profile_1_min>", End XML Part="</Histogram_fan_3_-_RPM_profile_1_min>", Error in=no error) -> (Output XML array=w338, Error out=w339)
        call "Exlude_WA_Entrys.gviweb"(Input XML array=w338, Error in=w339) -> (Without_WA_Entrys=w340, Output Error=w341)
        call "Interpret_Histogram_CPU_IO_Temperature.gviweb"(Histogramm Entrys=w340, Error Cluster input=w341) -> (Signal=w342, Error Output=w2)
        $"Histogram fan 3 RPM profile 1 min" <- w342
        w3 = w337
        w4 = s2
        w5 = s3
        w6 = s4
        w7 = s5
        w8 = s6
        w9 = s7
      }
      frame "Histogram Fan 3 Power" {
        w343 = "Histogram Fan 3 Temperature"  # State
        call "Read_XML_Part.gviweb"(Input XML=s2, Start XML Part="<Histogram_fan_3_-_power_profile_W>", End XML Part="</Histogram_fan_3_-_power_profile_W>", Error in=no error) -> (Output XML array=w344, Error out=w345)
        call "Exlude_WA_Entrys.gviweb"(Input XML array=w344, Error in=w345) -> (Without_WA_Entrys=w346, Output Error=w347)
        call "Interpret_Histogram_CPU_IO_Temperature.gviweb"(Histogramm Entrys=w346, Error Cluster input=w347) -> (Signal=w348, Error Output=w2)
        $"Histogram fan 3 power profile W" <- w348
        w3 = w343
        w4 = s2
        w5 = s3
        w6 = s4
        w7 = s5
        w8 = s6
        w9 = s7
      }
      frame "Histogram Fan 3 Temperature" {
        w349 = "Histogram Fan 3 Voltage min"  # State
        call "Read_XML_Part.gviweb"(Input XML=s2, Start XML Part="<Histogram_fan_3_-_Temperature_profile_Celsius>", End XML Part="</Histogram_fan_3_-_Temperature_profile_Celsius>", Error in=no error) -> (Output XML array=w350, Error out=w351)
        call "Exlude_WA_Entrys.gviweb"(Input XML array=w350, Error in=w351) -> (Without_WA_Entrys=w352, Output Error=w353)
        call "Interpret_Histogram_CPU_IO_Temperature.gviweb"(Histogramm Entrys=w352, Error Cluster input=w353) -> (Signal=w354, Error Output=w2)
        $"Histogram fan 3 Temperature_profile Celsius" <- w354
        w3 = w349
        w4 = s2
        w5 = s3
        w6 = s4
        w7 = s5
        w8 = s6
        w9 = s7
      }
      frame "Histogram Fan 3 Voltage min" {
        w355 = "Histogram Fan 3 Voltage max"  # State
        call "Read_XML_Part.gviweb"(Input XML=s2, Start XML Part="<Histogram_fan_3_-_Voltage_min_V_-_1phase_3phase>", End XML Part="</Histogram_fan_3_-_Voltage_min_V_-_1phase_3phase>", Error in=no error) -> (Output XML array=w356, Error out=w357)
        call "Exlude_WA_Entrys.gviweb"(Input XML array=w356, Error in=w357) -> (Without_WA_Entrys=w358, Output Error=w359)
        call "Interpret_Histogram_CPU_IO_Temperature.gviweb"(Histogramm Entrys=w358, Error Cluster input=w359) -> (Signal=w360, Error Output=w2)
        $"Histogram fan 3 Voltage min_V_1phase_3phase" <- w360
        w3 = w355
        w4 = s2
        w5 = s3
        w6 = s4
        w7 = s5
        w8 = s6
        w9 = s7
      }
      frame "Histogram Fan 3 Voltage max" {
        w361 = "Histogram MMI CPU Load"  # State
        call "Read_XML_Part.gviweb"(Input XML=s2, Start XML Part="<Histogram_fan_3_-_Voltage_max_V_-_1phase_3phase>", End XML Part="</Histogram_fan_3_-_Voltage_max_V_-_1phase_3phase>", Error in=no error) -> (Output XML array=w362, Error out=w363)
        call "Exlude_WA_Entrys.gviweb"(Input XML array=w362, Error in=w363) -> (Without_WA_Entrys=w364, Output Error=w365)
        call "Interpret_Histogram_CPU_IO_Temperature.gviweb"(Histogramm Entrys=w364, Error Cluster input=w365) -> (Signal=w366, Error Output=w2)
        $"Histogram fan 3 Voltage max_V_1phase_3phase" <- w366
        w3 = w361
        w4 = s2
        w5 = s3
        w6 = s4
        w7 = s5
        w8 = s6
        w9 = s7
      }
      frame "Histogram MMI CPU Load" {
        w367 = "Histogram MMI RAM Load"  # State
        call "Read_XML_Part.gviweb"(Input XML=s2, Start XML Part="<Histogram_-_MMI_CPU_Load_Percent>", End XML Part="</Histogram_-_MMI_CPU_Load_Percent>", Error in=no error) -> (Output XML array=w368, Error out=w369)
        call "Exlude_WA_Entrys.gviweb"(Input XML array=w368, Error in=w369) -> (Without_WA_Entrys=w370, Output Error=w371)
        call "Interpret_Histogram_CPU_IO_Temperature.gviweb"(Histogramm Entrys=w370, Error Cluster input=w371) -> (Signal=w372, Error Output=w2)
        $"Histogram MMI CPU Load Percent" <- w372
        w3 = w367
        w4 = s2
        w5 = s3
        w6 = s4
        w7 = s5
        w8 = s6
        w9 = s7
      }
      frame "Histogram MMI RAM Load" {
        w373 = "Histogram Basis CPU Load"  # State
        call "Read_XML_Part.gviweb"(Input XML=s2, Start XML Part="<Histogram_-_MMI_RAM_Load_Percent>", End XML Part="</Histogram_-_MMI_RAM_Load_Percent>", Error in=no error) -> (Output XML array=w374, Error out=w375)
        call "Exlude_WA_Entrys.gviweb"(Input XML array=w374, Error in=w375) -> (Without_WA_Entrys=w376, Output Error=w377)
        call "Interpret_Histogram_CPU_IO_Temperature.gviweb"(Histogramm Entrys=w376, Error Cluster input=w377) -> (Signal=w378, Error Output=w2)
        $"Histogram MMI RAM Load Percent" <- w378
        w3 = w373
        w4 = s2
        w5 = s3
        w6 = s4
        w7 = s5
        w8 = s6
        w9 = s7
      }
      frame "Histogram Basis CPU Load" {
        w379 = "Histogram Basis RAM Load"  # State
        call "Read_XML_Part.gviweb"(Input XML=s2, Start XML Part="<Histogram_-_Basis_CPU_Load_Percent>", End XML Part="</Histogram_-_Basis_CPU_Load_Percent>", Error in=no error) -> (Output XML array=w380, Error out=w381)
        call "Exlude_WA_Entrys.gviweb"(Input XML array=w380, Error in=w381) -> (Without_WA_Entrys=w382, Output Error=w383)
        call "Interpret_Histogram_CPU_IO_Temperature.gviweb"(Histogramm Entrys=w382, Error Cluster input=w383) -> (Signal=w384, Error Output=w2)
        $"Histogram Basis CPU Load Percent" <- w384
        w3 = w379
        w4 = s2
        w5 = s3
        w6 = s4
        w7 = s5
        w8 = s6
        w9 = s7
      }
      frame "Histogram Basis RAM Load" {
        w385 = "Histogram Magnetron Top Temperature"  # State
        call "Read_XML_Part.gviweb"(Input XML=s2, Start XML Part="<Histogram_-_Basis_RAM_Load_Percent>", End XML Part="</Histogram_-_Basis_RAM_Load_Percent>", Error in=no error) -> (Output XML array=w386, Error out=w387)
        call "Exlude_WA_Entrys.gviweb"(Input XML array=w386, Error in=w387) -> (Without_WA_Entrys=w388, Output Error=w389)
        call "Interpret_Histogram_CPU_IO_Temperature.gviweb"(Histogramm Entrys=w388, Error Cluster input=w389) -> (Signal=w390, Error Output=w2)
        $"Histogram Basis RAM Load Percent" <- w390
        w3 = w385
        w4 = s2
        w5 = s3
        w6 = s4
        w7 = s5
        w8 = s6
        w9 = s7
      }
      frame "Histogram Magnetron Top Temperature" {
        w391 = "Histogram Magnetron bottomTemperature"  # State
        call "Read_XML_Part.gviweb"(Input XML=s2, Start XML Part="<Histogram_Magnetron_Top_Temperature_profile_Celsius>", End XML Part="</Histogram_Magnetron_Top_Temperature_profile_Celsius>", Error in=no error) -> (Output XML array=w392, Error out=w393)
        call "Exlude_WA_Entrys.gviweb"(Input XML array=w392, Error in=w393) -> (Without_WA_Entrys=w394, Output Error=w395)
        call "Interpret_Histogram_CPU_IO_Temperature.gviweb"(Histogramm Entrys=w394, Error Cluster input=w395) -> (Signal=w396, Error Output=w2)
        $"Histogram Magnetron Top Temperatur profile Celsius" <- w396
        w3 = w391
        w4 = s2
        w5 = s3
        w6 = s4
        w7 = s5
        w8 = s6
        w9 = s7
      }
      frame "Histogram Magnetron bottomTemperature" {
        w397 = "Histogram Power Supply Top Temperature"  # State
        call "Read_XML_Part.gviweb"(Input XML=s2, Start XML Part="<Histogram_Magnetron_bottom_Temperature_profile_Celsius>", End XML Part="</Histogram_Magnetron_bottom_Temperature_profile_Celsius>", Error in=no error) -> (Output XML array=w398, Error out=w399)
        call "Exlude_WA_Entrys.gviweb"(Input XML array=w398, Error in=w399) -> (Without_WA_Entrys=w400, Output Error=w401)
        call "Interpret_Histogram_CPU_IO_Temperature.gviweb"(Histogramm Entrys=w400, Error Cluster input=w401) -> (Signal=w402, Error Output=w2)
        $"Histogram Magnetron bottom Temperature profile Celsius" <- w402
        w3 = w397
        w4 = s2
        w5 = s3
        w6 = s4
        w7 = s5
        w8 = s6
        w9 = s7
      }
      frame "Histogram Power Supply Top Temperature" {
        w403 = "Histogram Power Supply bottom Temperature"  # State
        call "Read_XML_Part.gviweb"(Input XML=s2, Start XML Part="<Histogram_Power_Supply_Top_Temperature_profile_Celsius>", End XML Part="</Histogram_Power_Supply_Top_Temperature_profile_Celsius>", Error in=no error) -> (Output XML array=w404, Error out=w405)
        call "Exlude_WA_Entrys.gviweb"(Input XML array=w404, Error in=w405) -> (Without_WA_Entrys=w406, Output Error=w407)
        call "Interpret_Histogram_CPU_IO_Temperature.gviweb"(Histogramm Entrys=w406, Error Cluster input=w407) -> (Signal=w408, Error Output=w2)
        $"Histogram Power Supply Top Temperature profile Celsius" <- w408
        w3 = w403
        w4 = s2
        w5 = s3
        w6 = s4
        w7 = s5
        w8 = s6
        w9 = s7
      }
      frame "Histogram Power Supply bottom Temperature" {
        w409 = "Wait For Interaction"  # State
        w410 = "</Histogram_Power_Supply_bottom_Temperature_profile_Celsius>"
        w411 = "<Histogram_Power_Supply_bottom_Temperature_profile_Celsius>"
        call "Read_XML_Part.gviweb"(Input XML=s2, Start XML Part=w411, End XML Part=w410, Error in=no error) -> (Output XML array=w412, Error out=w413)
        call "Exlude_WA_Entrys.gviweb"(Input XML array=w412, Error in=w413) -> (Without_WA_Entrys=w414, Output Error=w415)
        call "Interpret_Histogram_CPU_IO_Temperature.gviweb"(Histogramm Entrys=w414, Error Cluster input=w415) -> (Signal=w416, Error Output=w2)
        $"Histogram Power Supply bottom Temperature profile Celsius" <- w416
        w3 = w409
        w4 = s2
        w5 = s3
        w6 = s4
        w7 = s5
        w8 = s6
        w9 = s7
      }
      frame "Diagnostic Running Times Modes" {
        w417 = "Diagnostic Running Times Comp"  # State
        call "Read_XML_Part.gviweb"(Input XML=s2, Start XML Part="<Diagnostic-RunningTimes-Modes>", End XML Part="</Diagnostic-RunningTimes-Modes>", Error in=no error) -> (Output XML array=w418, Error out=w419)
        call "Exlude_WA_Entrys.gviweb"(Input XML array=w418, Error in=w419) -> (Without_WA_Entrys=w420, Output Error=w421)
        call "Interpret_Diagnostic_RunningTimes_Modes.gviweb"(Diagnostic Service History Entrys=w420, Error Cluster input=w421) -> (Diagnostic Running Time Modes Output=w422, Total running time=w7, Only Total running Time:=w423, Error Cluster output=w2)
        $"Diagnostic Running Times Modes" <- w422
        $"Total Running Time :" <- w423
        w3 = w417
        w4 = s2
        w5 = s3
        w6 = s4
        w8 = s6
        w9 = s7
      }
      frame "Diagnostic Running Times Modes iVario " {
        w424 = "Diagnostic Running Times Component iVario "  # State
        call "Read_XML_Part.gviweb"(Input XML=s2, Start XML Part="<Diagnostic-RunningTimes-Modes>", End XML Part="</Diagnostic-RunningTimes-Modes>", Error in=no error) -> (Output XML array=w425, Error out=w426)
        call "Exlude_WA_Entrys.gviweb"(Input XML array=w425, Error in=w426) -> (Without_WA_Entrys=w427, Output Error=w428)
        call "Interpret_Diagnostic_RunningTimes_Modes.gviweb"(Diagnostic Service History Entrys=w427, Error Cluster input=w428) -> (Total running time=w7, Only Total running Time:=w429, Error Cluster output=w2)
        $"Total Running Time:" <- w429
        w3 = w424
        w4 = s2
        w5 = s3
        w6 = s4
        w8 = s6
        w9 = s7
      }
    }
    next s1 = w3
    next s2 = w4
    next s3 = w5
    next s4 = w6
    next s5 = w7
    next s6 = w8
    next s7 = w9
    stop if FALSE
  }
